# Grasshopper definition debug_multi.gh (Grasshopper 0.9.76)

panel = Panel("""-2
3
-1""")
panel_2 = Panel("""-3
1
3""")
dom = ConstructDomain(DomainStart=Slider(-5, range=-5..5), DomainEnd=Slider(5, range=-5..5))
pt = ConstructPoint(XCoordinate=panel_2, YCoordinate=panel, ZCoordinate=0)
rectangle = Rectangle(Plane=PlaneXY(0, 0, 0), XSize=dom, YSize=dom, Radius=0)  # -> Rectangle, Length
dom_2 = ConstructDomain(DomainStart=Slider(-20, range=-20..20), DomainEnd=Slider(17.2, range=-20..20))
cir = Circle(Plane=pt, Radius=Slider(1, range=0..1))
dom_3 = ConstructDomain(DomainStart=Slider(-10, range=-10..10), DomainEnd=Slider(10, range=-10..10))
dom_4 = ConstructDomain(DomainStart=Slider(-10, range=-10..10), DomainEnd=Slider(10, range=-10..10))
rectangle_2 = Rectangle(Plane=PlaneXY(0, 0, 0), XSize=dom_2, YSize=dom_2, Radius=0)  # -> Rectangle, Length
crv = Curve(rectangle.Rectangle)
crv_2 = Curve(cir)
cir_2 = Circle(Plane=PlaneXY(0, 0, 0), Radius=1)
cir_3 = Circle(Plane=PlaneXY(0, 0, 0), Radius=Slider(-20, range=-20..20))
crv_3 = Curve(<curve referenced from the Rhino model>)
rectangle_3 = Rectangle(Plane=PlaneXY(0, 0, 0), XSize=dom_3, YSize=dom_4, Radius=0)  # -> Rectangle, Length
crv_4 = Curve(<curve referenced from the Rhino model>)
crv_5 = Curve([crv, crv_2])
boundary = BoundarySurfaces(Edges=crv_3)
boundary_2 = BoundarySurfaces(Edges=crv_4)
crv_6 = Curve(crv_5)
crv_7 = Curve(rectangle_3.Rectangle)
boundary_3 = BoundarySurfaces(Edges=crv_5)
xy = XYPlane(Origin=Point(0, 0, 0))
crv_8 = Curve(crv)
crv_9 = Curve(rectangle_2.Rectangle)
brep = Brep(crv_7)
mesh = MeshBrep(
    Brep=boundary_3,
    Settings={GridMaxCount=0, GridMinCount=16, JaggedSeams=False, MaxEdgeLength=0, MinEdgeLength=0.0001, MinTolerance=0, Refine=True, RefineAngle=0, RelativeTolerance=0.65, SimplePlanes=True, Tolerance=0})
c_script = CSharpScript(crvs=crv_6)  # -> out, A, B; inputs crvs: list of Curve
# ---------- c_script: C# ----------
    var crv = (List<Curve>) crvs;
    

    Brep[] temp_brep = Brep.CreatePlanarBreps(crv);



    A = temp_brep;
    B = AreaMassProperties.Compute(temp_brep).Area;
# ---------- end c_script ----------
cls = Closed(Curve=crv_8)  # -> Closed, Periodic
cls_2 = Closed(Curve=crv_9)  # -> Closed, Periodic
xy_2 = XYPlane(Origin=Point(0, 0, 0))
mesh_2 = MeshBrep(
    Brep=boundary_2,
    Settings={GridMaxCount=0, GridMinCount=16, JaggedSeams=False, MaxEdgeLength=0, MinEdgeLength=0.0001, MinTolerance=0, Refine=True, RefineAngle=0, RelativeTolerance=0.65, SimplePlanes=True, Tolerance=0})
mesh_3 = MeshBrep(
    Brep=boundary,
    Settings={GridMaxCount=0, GridMinCount=16, JaggedSeams=False, MaxEdgeLength=0, MinEdgeLength=0.0001, MinTolerance=0, Refine=True, RefineAngle=0, RelativeTolerance=0.65, SimplePlanes=True, Tolerance=0})
edges = BrepEdges(Brep=boundary_3)  # -> Naked, Interior, NonManifold
area = Area(Geometry=mesh)  # -> Area, Centroid
medges = MeshEdges(Mesh=mesh)  # -> NakedEdges, InteriorEdges, NonManifoldEdges
panel_3 = Panel(cls.Closed)
preview = CustomPreview(Geometry=boundary_3, Shader=ColourSwatch(SwatchColor=RGBA(255, 255, 255, 99)))
panel_4 = Panel(cls_2.Closed)
xy_3 = XYPlane(Origin=Point(0, 0, 0))
c_script_2 = CSharpScript(x=crv, y=crv_7, z=xy_2)  # -> out, box1, box2, eb1, eb2; inputs x: Curve, y: Curve, z: Plane
# ---------- c_script_2: C# ----------
    var b1 = (Curve) x;
    var b2 = (Curve) y;
    var pl = (Plane) z;


    var bb1 = b1.GetBoundingBox(true).ToBrep();
    var bb2 = b2.GetBoundingBox(true).ToBrep();

    var e1 = new Polyline(bb1.Vertices);
    var e2 = new Polyline(bb2.Vertices);


    Print("bounding box bb1 outline is closed: " + e2.ToNurbsCurve().IsClosed.ToString());
    Print("bounding box bb2 outline is closed: " + e2.ToNurbsCurve().IsClosed.ToString());


    RegionContainment status = Curve.PlanarClosedCurveRelationship(b1, b2, pl, 0.001);
    Print(status.ToString());


    box1 = bb1;
    box2 = bb2;
    eb1 = e1;
    eb2 = e2;
# ---------- end c_script_2 ----------
c_script_3 = CSharpScript(x=c_script.A, y=crv_7, z=xy_2)  # -> out, A, B, C; inputs x: Brep, y: Curve, z: Plane
# ---------- c_script_3: C# ----------
    var b1 = (Brep) x;
    var b2 = (Curve) y;
    var pl = (Plane) z;


    var bb1 = b1.GetBoundingBox(true);
    var bb2 = b2.GetBoundingBox(true);

    Print(bb2.Contains(bb1).ToString());

    if (!bb2.Contains(bb1))
    {

      var temp = b1.Split(Brep.CreatePlanarBreps(b2)[0], 0.001);

      var lsrf = new List<Brep>();

      for (int i = 0;i < temp.Length;i++)
      {
        var currentEdge = Curve.JoinCurves(temp[i].DuplicateNakedEdgeCurves(true, false));

        if (currentEdge.Length != 1){return;}

        var centroidBrep = AreaMassProperties.Compute(temp[i]).Centroid;

        PointContainment s2 = b2.Contains(centroidBrep, pl);
        switch (s2)
        {
          case PointContainment.Unset:
            Print("case1");
            //lsrf.Add(null);
            break;
          case PointContainment.Inside:
            Print("case2");
            lsrf.Add(temp[i]);
            break;
          case PointContainment.Outside:
            Print("case3");
            break;
          case PointContainment.Coincident:
            Print("case4");
            //lsrf.Add(null);
            break;
        }
      }

      A = temp;
      B = lsrf;
      //C = AreaMassProperties.Compute(lsrf).Area;
    }
    else
    {
      var temp = b1;
      var lsrf = b1;

      A = temp;
      B = lsrf;
      //C = AreaMassProperties.Compute(lsrf).Area;

    }
# ---------- end c_script_3 ----------
brep_2 = Brep(c_script.A)
c_script_4 = CSharpScript(x=c_script.A, y=crv_7, z=xy_2)  # -> out, A, B, C; inputs x: Brep, y: Curve, z: Plane
# ---------- c_script_4: C# ----------
    var b1 = (Brep) x;
    var b2 = (Curve) y;
    var pl = (Plane) z;


    var bb1 = b1.GetBoundingBox(true);
    var bb2 = b2.GetBoundingBox(true);
    
    

    Print(bb2.Contains(bb1).ToString());

    if (!bb2.Contains(bb1))
    {
      var un = BoundingBox.Union(bb1, bb2);
      var test = un.IsValid;
      var edge = new Polyline(un.GetCorners());

      Print(un.IsValid.ToString());

      A = un;
      B = test;
      C = edge;
    }
    else
    {
      var un = bb2;
      var test = false;
      var edge = new Polyline(un.GetCorners());

      A = un;
      B = test;
      C = edge;

    }
# ---------- end c_script_4 ----------
c_script_5 = CSharpScript(A=crv_8, B=crv_9, plane=xy)  # -> out; inputs A: Curve, B: Curve, plane: Plane
# ---------- c_script_5: C# ----------
    var b1 = (Curve) A;
    var b2 = (Curve) B;
    var pl = (Plane) plane;

    RegionContainment status = Curve.PlanarClosedCurveRelationship(b1, b2, pl, 0.001);
    Print(status.ToString());
# ---------- end c_script_5 ----------
c_script_6 = CSharpScript(x=crv_8, y=crv_9, z=xy_2)  # -> out, box1, box2, eb1, eb2; inputs x: Curve, y: Curve, z: Plane
# ---------- c_script_6: C# ----------
    var b1 = (Curve) x;
    var b2 = (Curve) y;
    var pl = (Plane) z;


    var bb1 = b1.GetBoundingBox(true);
    var bb2 = b2.GetBoundingBox(true);

    var e1 = new Polyline(bb1.GetCorners());
    var e2 = new Polyline(bb2.GetCorners());

    e1.Add(e1[0]);
    e2.Add(e2[0]);

    Print("bounding box bb1 outline is closed: " + e2.ToNurbsCurve().IsClosed.ToString());
    Print("bounding box bb2 outline is closed: " + e2.ToNurbsCurve().IsClosed.ToString());

    RegionContainment status = Curve.PlanarClosedCurveRelationship(b1, b2, pl, 0.001);
    Print(status.ToString());
    /*
    switch (status)
    {
      case RegionContainment.Disjoint:
        Print("Disjoint");
        break;

      case RegionContainment.MutualIntersection:
        Print("Mutual Intersection");
        break;

      case RegionContainment.AInsideB:
        Print("x inside y");
        break;

      case RegionContainment.BInsideA:
        Print("y inside x");
        break;
    }
  */

    box1 = bb1;
    box2 = bb2;
    eb1 = e1;
    eb2 = e2;
# ---------- end c_script_6 ----------
panel_5 = Panel(area.Area)
c_script_7 = CSharpScript(x=mesh_3, y=mesh_2, z=xy_3)  # -> out, box1, box2, eb1, eb2; inputs x: Mesh, y: Mesh, z: Plane
# ---------- c_script_7: C# ----------
    var b1 = (Mesh) x;
    var b2 = (Mesh) y;
    var pl = (Plane) z;


    var bb1 = b1.GetBoundingBox(true).ToBrep();
    var bb2 = b2.GetBoundingBox(true).ToBrep();

    //var e1 = bb1.DuplicateNakedEdgeCurves(true, false);
    //var e2 = bb2.DuplicateNakedEdgeCurves(true, false);



    //RegionContainment status = Curve.PlanarClosedCurveRelationship(b1, b2, pl, 0.001);
    //Print(status.ToString());


    box1 = bb1;
    box2 = bb2;
    //eb1 = e1;
    //eb2 = e2;
# ---------- end c_script_7 ----------
box = Box(c_script_2.box2)
box_2 = Box(c_script_2.box1)
crv_10 = Curve(c_script_2.eb1)
crv_11 = Curve(c_script_2.eb2)
box_3 = Box(c_script_6.box2)
box_4 = Box(c_script_6.box1)
crv_12 = Curve(c_script_6.eb1)
crv_13 = Curve(c_script_6.eb2)
panel_6 = Panel(c_script_3.out)
panel_7 = Panel(c_script_5)
brep_3 = Brep(c_script_3.B)
box_5 = Box(c_script_7.box2)
box_6 = Box(c_script_7.box1)
crv_14 = Curve(c_script_7.eb1)
crv_15 = Curve(c_script_7.eb2)
panel_8 = Panel(edges.Naked)
panel_9 = Panel(c_script_6.out)
panel_10 = Panel(c_script_2.out)
panel_11 = Panel(c_script_4.A)
panel_12 = Panel(c_script_4.B)
crv_16 = Curve(c_script_4.C)
panel_13 = Panel(c_script_7.out)
panel_14 = Panel(box_6)
box_7 = Box(c_script_4.A)
area_2 = Area(Geometry=c_script_3.A)  # -> Area, Centroid
