# Grasshopper definition debug_shadeAssess.gh (Grasshopper 0.9.76)
# plug-ins: SunTools

number_slider = Slider(8.51, range=-10..10)
number_slider_2 = Slider(0.79, range=-10..10)
number_slider_3 = Slider(-10, range=-10..10)
number_slider_4 = Slider(-10, range=-10..10)
yz = YZPlane(Origin=Point(0, 0, 0))
dom = ConstructDomain(DomainStart=Slider(-10, range=-10..10), DomainEnd=Slider(10, range=-10..10))
dom_2 = ConstructDomain(DomainStart=Slider(-10, range=-10..10), DomainEnd=Slider(10, range=-10..10))
pt = ConstructPoint(XCoordinate=Slider(-5, range=-10..10), YCoordinate=Slider(0, range=-10..10), ZCoordinate=Slider(5.25, range=-10..10))
vec = VectorXYZ(XComponent=Slider(5, range=-10..10), YComponent=Slider(-2.86, range=-10..10), ZComponent=Slider(-5, range=-10..10))  # -> Vector, Length
dom_3 = ConstructDomain(DomainStart=number_slider_4, DomainEnd=number_slider_2)
dom_4 = ConstructDomain(DomainStart=number_slider_3, DomainEnd=number_slider)
rectangle = Rectangle(Plane=yz, XSize=dom, YSize=dom_2, Radius=0)  # -> Rectangle, Length
unit = UnitVector(Vector=vec.Vector)
pl = PlaneNormal(Origin=pt, ZAxis=unit)
boundary = BoundarySurfaces(Edges=rectangle.Rectangle)
mesh = MeshBrep(
    Brep=boundary,
    Settings={GridMaxCount=0, GridMinCount=16, JaggedSeams=False, MaxEdgeLength=0, MinEdgeLength=0.0001, MinTolerance=0, Refine=True, RefineAngle=0, RelativeTolerance=0.65, SimplePlanes=True, Tolerance=0})
subtraction = Subtraction(A=number_slider, B=number_slider_3)
subtraction_2 = Subtraction(A=number_slider_2, B=number_slider_4)
addition = Addition(A=subtraction, B=1)
addition_2 = Addition(A=subtraction_2, B=1)
division = Division(A=addition, B=2)
division_2 = Division(A=addition_2, B=2)
subtraction_3 = Subtraction(A=addition, B=division)
subtraction_4 = Subtraction(A=addition_2, B=division_2)
dom_5 = ConstructDomain(DomainStart=expr("-x", subtraction_3), DomainEnd=subtraction_3)
dom_6 = ConstructDomain(DomainStart=expr("-x", subtraction_4), DomainEnd=subtraction_4)
rectangle_2 = Rectangle(Plane=pl, XSize=dom_4, YSize=dom_3, Radius=0)  # -> Rectangle, Length
rectangle_3 = Rectangle(Plane=pl, XSize=dom_5, YSize=dom_6, Radius=0)  # -> Rectangle, Length
arrrec = RectangularArray(Geometry=rectangle_2.Rectangle, Cell=rectangle_3.Rectangle, XCount=Slider(1, range=0..10), YCount=Slider(1, range=0..10))  # -> Geometry, Transform
boundary_2 = BoundarySurfaces(Edges=arrrec.Geometry)
mesh_2 = MeshBrep(
    Brep=boundary_2,
    Settings={GridMaxCount=0, GridMinCount=16, JaggedSeams=False, MaxEdgeLength=0, MinEdgeLength=0.0001, MinTolerance=0, Refine=True, RefineAngle=0, RelativeTolerance=0.65, SimplePlanes=True, Tolerance=0})
mjoin = MeshJoin(Meshes=mesh_2)
mesh_3 = Mesh(mjoin)
preview = CustomPreview(Geometry=mesh_3, Shader=ColourSwatch(SwatchColor=RGBA(71, 160, 255, 113)))
vec_2 = VectorXYZ(XComponent=Slider(1.6, range=-10..10), YComponent=Slider(0.62, range=-10..10), ZComponent=Slider(-0.07, range=-20..20))  # -> Vector, Length
vec_3 = Vector(vec_2.Vector)
shadeassess = ShadeOnFaçadePanel(FaçadePanel=mesh, ShadeSurface=mesh_3, ProjectionDirectionVector=vec_3, LaunchTheAnalysis=Toggle(True))  # -> OutlineOfShade, AreaOfExposed, CommentOnOperationType
vdis = VectorDisplay(Anchor=pt, Vector=vec_2.Vector)
mesh_4 = Mesh(shadeassess.OutlineOfShade)
preview_2 = CustomPreview(Geometry=mesh_4, Shader=ColourSwatch(SwatchColor=RGBA(136, 0, 255, 148)))
panel = Panel(shadeassess.AreaOfExposed)
panel_2 = Panel(shadeassess.CommentOnOperationType)
panel_3 = Panel(mesh_4)
