# Grasshopper definition room_simpleShade_optimization_v5.gh (Grasshopper 0.9.76)
# plug-ins: Kangaroo Components, PlanktonGh, IvyGh, SunTools, Kangaroo2 Components

number_slider = Slider(4, range=0..10)
number_slider_2 = Slider(2.2, range=0..10)
division = Division(A=number_slider_2, B=-2)
division_2 = Division(A=number_slider_2, B=2)
division_3 = Division(A=number_slider, B=-2)
division_4 = Division(A=number_slider, B=2)
pi = Pi(Factor=2)
rad = Radians(Degrees=Slider(105, range=90..270))
yz = YZPlane(Origin=Point(0, 0, 0))
subtraction = Subtraction(A=pi, B=rad)
dom = ConstructDomain(DomainStart=division, DomainEnd=division_2)
dom_2 = ConstructDomain(DomainStart=division_3, DomainEnd=division_4)
rotate = Rotate(Geometry=yz, Angle=subtraction, Plane=PlaneXY(0, 0, 0))  # -> Geometry, Transform
number_slider_3 = Slider(1, range=0..1)
rectangle = Rectangle(Plane=rotate.Geometry, XSize=dom_2, YSize=dom, Radius=0)  # -> Rectangle, Length
mplane = MeshPlane(Boundary=rectangle.Rectangle, WidthCount=number_slider_3, HeightCount=number_slider_3)  # -> Mesh, Area
facen = FaceNormals(Mesh=mplane.Mesh)  # -> Centers, Normals
refine = Refine(Mesh=mplane.Mesh, Level=Slider(4, range=0..10))

# ---- group: ROOM
number_slider_4 = Slider(0.5, range=0..1)
normal_window = Vector(facen.Normals)
mesh = Mesh(mplane.Mesh)
medges = MeshEdges(Mesh=mesh)  # -> NakedEdges, InteriorEdges, NonManifoldEdges
unit = UnitVector(Vector=normal_window)
multiplication = Multiplication(A=number_slider_4, B=-1)
# Room geometry
item = ListItem(List=medges.NakedEdges, Index="1", Wrap=True)
multiplication_2 = Multiplication(A=unit, B=Slider(0, range=-1..0))
Z = UnitZ(Factor=multiplication)
multiplication_3 = Multiplication(A=unit, B=Slider(-5, range=-10..-1))
addition = Addition(A=multiplication_2, B=Z)
move = Move(Geometry=item, Motion=addition)  # -> Geometry, Transform
multiplication_4 = Multiplication(A=number_slider_4, B=2)
end = EndPoints(Curve=move.Geometry)  # -> Start, End
addition_2 = Addition(A=number_slider_2, B=multiplication_4)
move_2 = Move(Geometry=end.Start, Motion=multiplication_3)  # -> Geometry, Transform
move_3 = Move(Geometry=end.End, Motion=multiplication_3)  # -> Geometry, Transform
Z_2 = UnitZ(Factor=addition_2)
pt = Point(end.Start)
move_4 = Move(Geometry=pt, Motion=Z_2)  # -> Geometry, Transform
pt_2 = Point(move_2.Geometry)
move_5 = Move(Geometry=pt_2, Motion=Z_2)  # -> Geometry, Transform
pt_3 = Point(end.End)
move_6 = Move(Geometry=pt_3, Motion=Z_2)  # -> Geometry, Transform
pt_4 = Point(move_3.Geometry)
move_7 = Move(Geometry=pt_4, Motion=Z_2)  # -> Geometry, Transform
c_script = CSharpScript(A=pt, B=pt_2, C=pt_4, D=pt_3)  # -> out, mesh, edges, plane; inputs A: Point3d, B: Point3d, C: Point3d, D: Point3d
# ---------- c_script: C# ----------
    var p1 = (Point3d) A;
    var p2 = (Point3d) B;
    var p3 = (Point3d) C;
    var p4 = (Point3d) D;
    List < Point3d > vert = new List<Point3d>(){p1,p2,p3,p4};

    var f1 = new Rhino.Geometry.MeshFace(0, 1, 2, 3);
    var m1 = new Rhino.Geometry.Mesh();
    var pl1 = new Rhino.Geometry.Plane(p1, p2, p4);

    m1.Vertices.AddVertices(vert);
    m1.Faces.AddFace(f1);

    var e1 = new List<Polyline>(m1.GetNakedEdges());

    mesh = m1;
    plane = pl1;
    edges = e1;
# ---------- end c_script ----------
c_script_2 = CSharpScript(A=pt, B=pt_2, C=move_5.Geometry, D=move_4.Geometry)  # -> out, mesh, edges, plane; inputs A: Point3d, B: Point3d, C: Point3d, D: Point3d; same code as c_script
c_script_3 = CSharpScript(A=pt_2, B=pt_4, C=move_7.Geometry, D=move_5.Geometry)  # -> out, mesh, edges, plane; inputs A: Point3d, B: Point3d, C: Point3d, D: Point3d; same code as c_script
c_script_4 = CSharpScript(A=pt_3, B=pt_4, C=move_7.Geometry, D=move_6.Geometry)  # -> out, mesh, edges, plane; inputs A: Point3d, B: Point3d, C: Point3d, D: Point3d; same code as c_script
number_slider_5 = Slider(4, range=0..10)
mjoin = MeshJoin(Meshes=[c_script.mesh, c_script_2.mesh, c_script_3.mesh, c_script_4.mesh])
refine_2 = Refine(Mesh=c_script_4.mesh, Level=number_slider_5)
refine_3 = Refine(Mesh=c_script.mesh, Level=number_slider_5)
refine_4 = Refine(Mesh=c_script_2.mesh, Level=number_slider_5)
refine_5 = Refine(Mesh=c_script_3.mesh, Level=number_slider_5)
medges_2 = MeshEdges(Mesh=mjoin)  # -> NakedEdges, InteriorEdges, NonManifoldEdges
tri = Triangulate(Mesh=refine_3)  # -> Mesh, Count
tri_2 = Triangulate(Mesh=refine_4)  # -> Mesh, Count
tri_3 = Triangulate(Mesh=refine_5)  # -> Mesh, Count
tri_4 = Triangulate(Mesh=refine_2)  # -> Mesh, Count
preview = CustomPreview(
    Geometry=[medges.NakedEdges, medges_2.NakedEdges, medges_2.InteriorEdges],
    Shader=ColourSwatch(SwatchColor=RGBA(0, 0, 0, 41)))

# ----
rad_2 = Radians(Degrees=Slider(3, range=0..10))
# Window geometry
number_slider_6 = Slider(3, range=1..3000)
series = Series(Start=Slider(1200, range=0..3578), Step=1, Count=number_slider_6)

# ----
# Sun Vectors
X = UnitX(Factor=1)
azi = Number([126.3264092, 137.3313031, 149.9081719, 164.0725822, 179.3051332, 194.5902344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])
ele = Number([5.239618324, 13.76930373, 20.56615289, 25.05155863, 26.71385892, 25.32899458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])
num = Number([8, 9, 10, 11, 12, 13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])
sunsifting = SiftSunOrientations(
    North=X,
    SunAzimuth=azi,
    SunAltitude=ele,
    AssociatedSunHours=num,
    FaçadePanelToEvaluate=mplane.Mesh,
    AngleToleranceInRad=rad_2)  # -> ResultingSiftedSunAzimuthAngles, ResultingSiftedSunAltitudeAngles, ResultingSiftedHours, ResultingSuftedSunVectors
item_2 = ListItem(List=sunsifting.ResultingSuftedSunVectors, Index=series, Wrap=True)  # -> simplify(Item)

item_3 = ListItem(List=sunsifting.ResultingSiftedHours, Index=series, Wrap=True)  # -> simplify(Item)

mesh_2 = Mesh()
medges_3 = MeshEdges(Mesh=mesh_2)  # -> NakedEdges, InteriorEdges, NonManifoldEdges
mc = MeshCorners(Mesh=mesh_2, Angle=2.35619449)
join = JoinCurves(Curves=medges_3.NakedEdges, Preserve=False)
meshmachine = MeshMachine(
    Geometry=simplify(mesh_2),
    Length=simplify(Slider(0.4, range=0.001..5)),
    FixCurves=simplify(join),
    FixVertices=simplify(mc),
    Flip=1,
    PullStrength=Slider(1, range=0..1),
    CurvatureAdaptivity=0,
    BoundaryScale=Slider(0.5, range=0..1),
    BoundaryDistance=Slider(2, range=0..10),
    Exponent=Slider(4, range=0..10),
    Background=0.5,
    Iterations=simplify(Slider(200, range=0..200)),
    Reset=Toggle(False))
pmesh = PlanktonMesh(meshmachine)
mesh_3 = Mesh(pmesh)
medges_4 = MeshEdges(Mesh=mesh_3)  # -> NakedEdges, InteriorEdges, NonManifoldEdges

num_2 = Number(item_3)

vec = Vector(normal_window)
unit_2 = UnitVector(Vector=vec)
# Desk
area = Area(Geometry=c_script.mesh)  # -> Area, Centroid
Z_3 = UnitZ(Factor=Slider(0.8, range=0..1))
xprod = CrossProduct(VectorA=vec, VectorB=Z_3, Unitize=True)  # -> Vector, Length
vec_2 = Vector(xprod.Vector)
multiplication_5 = Multiplication(A=unit_2, B="1")
multiplication_6 = Multiplication(A=vec_2, B="-0.5")
addition_3 = Addition(A=multiplication_5, B=multiplication_6)
scale = Scale(Geometry=c_script.mesh, Center=area.Centroid, Factor=Slider(0.24, range=0.001..1))  # -> Geometry, Transform
addition_4 = Addition(A=Z_3, B=addition_3)
move_8 = Move(Geometry=scale.Geometry, Motion=addition_4)  # -> Geometry, Transform

vec_3 = Vector(item_2)
panel = Panel(num_2)
vdis = VectorDisplay(Anchor=facen.Centers, Vector=item_2)
tri_5 = Triangulate(Mesh=refine)  # -> Mesh, Count
preview_2 = CustomPreview(Geometry=mplane.Mesh, Shader=ColourSwatch(SwatchColor=RGBA(140, 209, 255, 142)))
mesh_4 = Mesh(tri_5.Mesh)
medges_5 = MeshEdges(Mesh=mesh_4)  # -> NakedEdges, InteriorEdges, NonManifoldEdges
xy = XYPlane(Origin=area.Centroid)
refine_6 = Refine(Mesh=move_8.Geometry, Level=number_slider_5)
area_2 = Area(Geometry=move_8.Geometry)  # -> Area, Centroid
move_9 = Move(Geometry=xy, Motion=addition_4)  # -> Geometry, Transform
tri_6 = Triangulate(Mesh=refine_6)  # -> Mesh, Count
swatch = ColourSwatch(SwatchColor=RGBA(130, 121, 17, 188))
preview_3 = CustomPreview(Geometry=area_2.Centroid, Shader=swatch)
preview_4 = CustomPreview(Geometry=move_8.Geometry, Shader=swatch)
series_2 = Series(Start=Slider(0, range=0..1), Step=Slider(0.15, range=0..0.5), Count=Slider(4, range=0..11))
series_3 = Series(Start=Slider(0, range=0..1), Step=Slider(0.1, range=0..0.2), Count=Slider(6, range=0..11))
panel_2 = Panel("""view_summer
directGlare_summer""")
panel_3 = Panel(series_2)
panel_4 = Panel(series_3)
# Seasonal coeficient
entwine = Entwine(Branch00=panel_4, Branch01=panel_3, FlattenInputs=True)
grid = ConstructGrid(InputRange=entwine, Labels=panel_2)  # -> GridInformations, Grid
heating_period_start = Panel("6576")
heating_period_end = Panel("3096")
seasoncoefgrid = SeasonalCoefGrid(
    SunHours=num_2,
    StartOfWinterPeriod=heating_period_start,
    EndOfWinterPeriod=heating_period_end,
    CoolingCoefficientGrid=grid.Grid)  # -> ListOfWeightedCoefficients, GlobalCoefGrid, CoefficientHeatingCooling
vec_4 = Vector(facen.Normals)
vec_5 = Vector(vec_3)
dprod = DotProduct(VectorA=vec_5, VectorB=vec_4, Unitize=invert(False))

# ---- group: V0
solar_gains_area = Number(Tree({0}: [7.659083502, 7.632089482, 7.598306591, 7.544808425, 7.416760117, 7.659121649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], {1}: [7.654558555, 7.59272279, 7.515336174, 7.395805615, 7.13101929, 7.654645817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], {2}: [7.662015812, 7.580099242, 7.477698, 7.325871323, 6.98205246, 7.662131206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], {3}: [7.677521602, 7.575124668, 7.44922976, 7.264245351, 6.84192285, 7.677665845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], {4}: [7.711925872, 7.581988913, 7.426473655, 7.196080283, 6.671794141, 7.712108985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], {5}: [7.772166624, 7.61242164, 7.422775193, 7.140526779, 6.505404445, 7.772394314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]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))
view_area = Number(Tree({0}: [7.67295541], {1}: [7.686334991], {2}: [7.704111472], {3}: [7.730141774], {4}: [7.778761759], {5}: [7.855236909]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))
glare_area = Number(Tree({0}: [13.495164, 14.90661893, 9.822182342, 5.815750098, 2.705143493, 13.52165207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], {1}: [13.48719112, 14.84918976, 9.738945536, 5.726476909, 2.624852992, 13.51375034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], {2}: [13.50033066, 14.8307742, 9.70118656, 5.684576628, 2.58299472, 13.52696526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], {3}: [13.52765162, 14.82351718, 9.672626892, 5.647654198, 2.543619594, 13.55439061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], {4}: [13.58827128, 14.83347428, 9.649797722, 5.606813922, 2.495815028, 13.6151976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], {5}: [13.69441438, 14.87705215, 9.646087383, 5.573529722, 2.44906107, 13.72162721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]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))

# ----
desk_glare_area = Number(Tree({0}: [1.152000042, 1.152000042, 1.149306475, 0.5725099311, 0, 1.152000042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], {1}: [1.152000042, 1.152000042, 1.149306475, 0.5703005825, 0, 1.152000042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], {2}: [1.152000042, 1.152000042, 1.149306475, 0.5706688928, 0, 1.152000042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], {3}: [1.152000042, 1.152000042, 1.149306475, 0.5712854426, 0, 1.152000042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], {4}: [1.152000042, 1.152000042, 1.149306475, 0.5723912212, 0, 1.152000042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], {5}: [1.152000042, 1.152000042, 1.149306475, 0.5736188526, 0, 1.152000042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]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))
cos_facade_sun = Number(dprod)
window_area = Number(mplane.Area)
desk_area = Number(area_2.Area)
division_5 = Division(A=desk_glare_area, B=desk_area)  # -> simplify(Result)
division_6 = Division(A=view_area, B=window_area)
multiplication_7 = Multiplication(A=solar_gains_area, B=dprod)  # -> simplify(Result)
panel_5 = Panel("C:\Users\Victor Charpentier\Documents\GitHub\SuntoolGH\dev\data_fit\")
panel_6 = Panel("C:\Users\victor\Documents\GitHub\SuntoolGH\dev\data_fit\")
matlab_exe_sp4 = FilePath("C:\Program Files\MATLAB\R2016b\bin\matlab.exe")
number_slider_7 = Slider(4, range=0..10)  # disabled
number_slider_8 = Slider(3, range=0..10)  # disabled
mesh_5 = Mesh(mesh_4)  # disabled
desk = Mesh(tri_6.Mesh)  # disabled
vec_6 = Vector(facen.Normals)  # disabled
toggle = BooleanToggle(True)  # disabled
refine_7 = Refine(Mesh=mesh_5, Level=number_slider_7)  # disabled
medges_6 = MeshEdges(Mesh=refine_7)  # -> NakedEdges, InteriorEdges, NonManifoldEdges; disabled
d1_directglare_summer = ValueList({"0", "1", "2"}, selected="0")
d0_view_summer = ValueList({"0", "1", "2", "3", "4", "5"}, selected="0")

grid_2 = Grid(grid.Grid)
slider = GridSlider(grid=grid_2, D0=d0_view_summer, D1=d1_directglare_summer)  # -> Info, ActivePoint, ActiveCell
node_index = NodeIndexFromAddress(Grid=grid_2, Address=slider.ActivePoint)
grid_node = GridNode(Grid=grid_2, NodeIndex=node_index)
panel_7 = Panel(grid_node)
# Visualize data
node_prop = NodeProperties(Node=grid_node)  # -> NodeIndex, Coordinates, NormalizedCoordinates, AddressTuple
panel_8 = Panel(node_prop.NodeIndex)

# ----
# Simple Shade geometry
dom_3 = ConstructDomain(DomainStart=Slider(0, range=0..90), DomainEnd=Slider(70, range=0..90))
dom_4 = ConstructDomain(DomainStart=Slider(0, range=0..1), DomainEnd=Slider(1, range=0..1))
panel_10 = Panel("""agl
ext""")
random = Random(Range=dom_3, Number=Slider(10, range=0..10), Seed=2)
random_2 = Random(Range=dom_4, Number=Slider(7, range=0..10), Seed=2)
txt = Text(panel_10)
entwine_2 = Entwine(Branch00=random, Branch01=random_2, FlattenInputs=True)
grid_3 = ConstructGrid(InputRange=entwine_2, Labels=txt)  # -> GridInformations, Grid
vec_7 = Vector(facen.Normals)
medges_7 = MeshEdges(Mesh=mplane.Mesh)  # -> NakedEdges, InteriorEdges, NonManifoldEdges
panel_11 = Panel(grid_3.GridInformations)
item_4 = ListItem(List=medges_7.NakedEdges, Index=Slider(2, range=0..10), Wrap=True)
divide = DivideCurve(Curve=item_4, Count="2", Kinks=False)  # -> Points, Tangents, Parameters
item_5 = ListItem(List=divide.Points, Index="1", Wrap=True)
Z_4 = UnitZ(Factor=1)
addition_5 = Addition(A=number_slider_2, B="0.10")
c_script_5 = CSharpScript(
    input_grid=grid_3.Grid,
    hwindow=addition_5,
    N=vec_7,
    Reference="C:\Users\Victor Charpentier\AppData\Roaming\Grasshopper\Libraries\IvyCore.dll")  # -> out, V; inputs hwindow: Double, N: Vector3d
# ---------- c_script_5: C# ----------
    var normal = (Vector3d) N;
    var hwin = (double) hwindow;
    var gact = (Grid) input_grid;



    var nn = gact.NodeCount;
    var vec = new List<Vector3d>();
    //var actuationstate = new double[nn][];
    var origin = new Point3d(0.0, 0.0, 0.0);
    var rotaxis = Vector3d.CrossProduct(normal, new Vector3d(0.0, 0.0, -1.0));

    for (int i = 0;i < nn;i++)
    {
      var ag = -Math.PI * gact.Nodes[i][0] / 180;
      var ext = gact.Nodes[i][1];

      var current_vec = new Vector3d(0.0, 0.0, -1.0);

      current_vec.Transform(Transform.Rotation(ag, rotaxis, origin));
      current_vec = ext * (hwin) * current_vec;
      vec.Add(current_vec);

    }

    V = vec;
# ---------- end c_script_5 ----------
vec_8 = Vector(facen.Normals)
scale_2 = Scale(Geometry=item_4, Center=item_5, Factor="1.05")  # -> Geometry, Transform
expression = Expression(x=Z_4, y=vec_8, a="0.10", b="0.03", Expression="a*x+b*y")
move_10 = Move(Geometry=scale_2.Geometry, Motion=expression)  # -> Geometry, Transform
extr = Extrude(Base=move_10.Geometry, Direction=c_script_5.V)
mesh_6 = MeshBrep(
    Brep=extr,
    Settings={GridMaxCount=0, GridMinCount=16, JaggedSeams=False, MaxEdgeLength=0, MinEdgeLength=0.0001, MinTolerance=0, Refine=True, RefineAngle=0, RelativeTolerance=0.65, SimplePlanes=True, Tolerance=0})
refine_8 = Refine(Mesh=mesh_6, Level=Slider(5, range=0..10))

tri_7 = Triangulate(Mesh=refine_8)  # -> Mesh, Count

item_6 = ListItem(List=tri_7.Mesh, Index="25", Wrap=True)
mesh_7 = Mesh(tri_7.Mesh)

medges_8 = MeshEdges(Mesh=item_6)  # -> NakedEdges, InteriorEdges, NonManifoldEdges

grid_4 = Grid(grid_3.Grid)
path = FilePath(panel_5)
# Create Matlab analysis files
c_script_6 = CSharpScript(
    solarGain=multiplication_7,
    View=division_6,
    deskGlare=division_5,
    seasonCoefs=seasoncoefgrid.ListOfWeightedCoefficients,
    perm=seasoncoefgrid.CoefficientHeatingCooling,
    normalizationMin=Slider(0, range=0..20),
    normalizationMax=Slider(1, range=0..20),
    normalizationONOFF=Toggle(False),
    act=grid_4,
    workdir=path,
    start=Button(),
    Reference="C:\USERS\VICTOR CHARPENTIER\APPDATA\ROAMING\GRASSHOPPER\LIBRARIES\IvyCore.dll")  # -> out; inputs solarGain: tree of Double, View: tree of Double, deskGlare: tree of Double, seasonCoefs: tree of String, perm: list of Double, normalizationMin: Double, normalizationMax: Double, normalizationONOFF: Boolean, workdir: String, start: Boolean
# ---------- c_script_6: C# ----------
    var tree_output1 = (DataTree<double>) solarGain;
    var tree_output2 = (DataTree<double>) View;
    var tree_output3 = (DataTree<double>) deskGlare;
    var tree_output4 = (DataTree<string>) seasonCoefs;
    var listkron = (List<double>) perm;
    var minNorm = (double) normalizationMin;
    var maxNorm = (double) normalizationMax;
    var statNorm = (bool) normalizationONOFF;
    var workingDir = (string) workdir;
    var gact = (Grid) act;

    var run = (bool) start;

    if (!run){return;}

    int nb = tree_output1.BranchCount;
    var ncoef = tree_output4.BranchCount;

    var filePath1 = workingDir + "\\gh-" + "solarGain" + ".csv";
    var filePath2 = workingDir + "\\gh-" + "view" + ".csv";
    var filePath3 = workingDir + "\\gh-" + "deskGlare" + ".csv";
    var filePath4 = workingDir + "\\gh-" + "actuation" + ".csv";
    var filePath5 = workingDir + "\\gh-" + "seasonalCoefficients" + ".csv";
    var filePath6 = workingDir + "\\gh-" + "permKron" + ".csv";

    System.Text.StringBuilder csv1 = new System.Text.StringBuilder();
    System.Text.StringBuilder csv2 = new System.Text.StringBuilder();
    System.Text.StringBuilder csv3 = new System.Text.StringBuilder();
    System.Text.StringBuilder csv4 = new System.Text.StringBuilder();
    System.Text.StringBuilder csv5 = new System.Text.StringBuilder();
    System.Text.StringBuilder csv6 = new System.Text.StringBuilder();


    //Normalization of trees
    if (statNorm)
    {
      NormalizeDatatree(tree_output1, minNorm, maxNorm);
      NormalizeDatatree(tree_output2, minNorm, maxNorm);
      NormalizeDatatree(tree_output3, minNorm, maxNorm);
    }

    //write actuation file------------------------------------------------------------------------------
    for (int j = 0;j < gact.NodeCount;j++)
    {
      var newline = string.Format("{0},{1}", gact.Nodes[j][0].ToString(), gact.Nodes[j][1].ToString());
      csv4.AppendLine(newline);
    }

    //write seasonal coefficients file-------------------------------------------------------------------
    for (int i = 0;i < ncoef;i++)
    {
      for (int j = 0;j < tree_output4.Branch(i).Count;j++)
      {
        var newline = string.Format("{0}", tree_output4.Branch(i)[j].ToString());
        csv5.AppendLine(newline);
      }
    }

    //write geometric param file------------------------------------------------------------------------
    for (int j = 0;j < listkron.Count;j++)
    {
      var newline = string.Format("{0}", listkron[j]);
      csv6.AppendLine(newline);
    }

    //write shade, view & glare csv files---------------------------------------------------------------
    for (int i = 0;i < nb;i++)
    {

      //populate shade files
      string newline1 = "";
      for (int j = 0;j < tree_output1.Branch(i).Count;j++)
      {
        if (j + 1 < tree_output1.Branch(i).Count)
        {
          newline1 += tree_output1.Branch(i)[j].ToString() + ",";
        }
        else
        {
          newline1 += tree_output1.Branch(i)[j].ToString();
        }
      }
      csv1.AppendLine(newline1);

      //populate view files
      string newline2 = "";
      for (int j = 0;j < tree_output1.Branch(i).Count;j++)
      {
        if (j + 1 < tree_output1.Branch(i).Count)
        {
          newline2 += tree_output2.Branch(i)[0].ToString() + ",";
        }
        else
        {
          newline2 += tree_output2.Branch(i)[0].ToString();
        }
      }
      csv2.AppendLine(newline2);

      //populate glare files
      string newline3 = "";
      for (int j = 0;j < tree_output3.Branch(i).Count;j++)
      {
        if (j + 1 < tree_output3.Branch(i).Count)
        {
          newline3 += tree_output3.Branch(i)[j].ToString() + ",";
        }
        else
        {
          newline3 += tree_output3.Branch(i)[j].ToString();
        }
      }
      csv3.AppendLine(newline3);
    }

    System.IO.File.WriteAllText(filePath1, csv1.ToString());
    System.IO.File.WriteAllText(filePath2, csv2.ToString());
    System.IO.File.WriteAllText(filePath3, csv3.ToString());
    System.IO.File.WriteAllText(filePath4, csv4.ToString());
    System.IO.File.WriteAllText(filePath5, csv5.ToString());
    System.IO.File.WriteAllText(filePath6, csv6.ToString());


    //GH OUTPUT COMMENTS
    Print("OUTPUT DIR : " + workingDir);
    Print("PROCESS EXIT");
# ---------- c_script_6: C# additional code ----------
  private static DataTree<double> NormalizeDatatree(DataTree < double > tree, double min, double max)
  {
    double treemax = tree.AllData().Max();
    double treemin = tree.AllData().Min();
    double range = treemax - treemin;

    for (int i = 0;i < tree.BranchCount;i++)
    {
      var currentBrancha = new double[tree.Branch(i).Count];
      tree.Branch(i).CopyTo(currentBrancha);
      tree.Branch(i).Clear();
      tree.Branch(i).AddRange(NormalizeList(ArrayToList(currentBrancha), treemin, treemax, min, max));
    }

    return tree;
  }


  private static List<double> NormalizeList(List<double> data, double glmin, double glmax, double min, double max)
  {
    double dataMax = glmax;
    double dataMin = glmin;
    double range = dataMax - dataMin;

    return data
      .Select(d => (d - dataMin) / range)
      .Select(n => (double) ((1 - n) * min + n * max))
      .ToList();
  }

  private static List<double> ArrayToList(double[] data)
  {
    List<double> datalist = new List<double>(data.Length);
    for (int i = 0;i < data.Length;i++)
    {
      datalist.Add(data[i]);
    }
    return datalist;
  }
# ---------- end c_script_6 ----------
panel_12 = Panel(c_script_6)

matlab_exe_work = FilePath("C:\Program Files\MATLAB\R2016b\bin\matlab.exe")
# Launch Matlab analysis
workingdir = FilePath(path)
concat = Concatenate(FragmentA=workingdir, FragmentB="optimization.m")
lanch = Button()
panel_13 = Panel(workingdir)
c_script_7 = CSharpScript(path_to_m=concat, path_to_exe=matlab_exe_work, launch=lanch)  # -> out, A; inputs path_to_exe: String, launch: Boolean
# ---------- c_script_7: C# ----------
    string pathtoexe = (string) path_to_exe;
    string pathtofile = (string) path_to_m;

    string dir = System.IO.Path.GetDirectoryName(path_to_m.ToString());
    string filename = System.IO.Path.GetFileName(path_to_m.ToString());


    if (launch)
    {
      System.Diagnostics.Process p = new System.Diagnostics.Process();

      p.StartInfo.FileName = pathtoexe;
      p.StartInfo.WorkingDirectory = dir + "\\";
      p.StartInfo.Arguments = "/wait /nodisplay /nojvm /nosplash /nodesktop /r \"try, run('" + pathtofile + "\"'),catch,exit,end,exit\"";
      p.StartInfo.Verb = "runas";

      p.Start();
      p.WaitForExit();


    }
    //GH OUTPUT COMMENTS
    Print("MATLAB EXE : " + path_to_exe);
    Print("SCRIPT DIR : " + dir);
    Print("SCRIPT FILE : " + filename);
    Print("PROCESS EXIT");
# ---------- end c_script_7 ----------
panel_14 = Panel(c_script_7.out)

workingdir_2 = FilePath(path)
concat_2 = Concatenate(FragmentA=workingdir_2, FragmentB="outMatlab.csv")
toggle_2 = BooleanToggle(True)
grid_5 = Grid(grid_3.Grid)
c_script_8 = CSharpScript(
    path=concat_2,
    gAct=grid_5,
    run=toggle_2,
    Reference="C:\Users\Victor Charpentier\AppData\Roaming\Grasshopper\Libraries\IvyCore.dll")  # -> out, A; inputs path: String
# ---------- c_script_8: C# ----------
    var filePath = (string) path;
    var gridAct = (IvyCore.Parametric.Grid) gAct;
    var runIt = (bool) run;

    if (!runIt){return;}

    var reader = new StreamReader(filePath);
    var field = new DataTree<string>();

    var ndof = gridAct.Dim;


    while (!reader.EndOfStream)
    {
      var line = reader.ReadLine();
      var values = line.Split(',');
      var ncomb = values.Length / ndof;

      for (int i = 0;i < ncomb;i++)
      {
        field.Add(string.Format("{0},{1}", values[i * ndof].ToString(), values[i * ndof + 1].ToString()), new GH_Path(i));
      }

    }

    A = field;
# ---------- end c_script_8 ----------
viewer = ParamViewer(c_script_8.A)
item_7 = ListItem(List=viewer, Index=node_prop.NodeIndex, Wrap=True)
branch = TreeBranch(Tree=c_script_8.A, Path=item_7, MaintainPaths=True)
window_height = Number(addition_5)
window_normal = Vector(facen.Normals)
crv = Curve(move_10.Geometry)
split = TextSplit(Text=branch, Separators=",")
item_8 = ListItem(List=split, Index=0, Wrap=True)  # -> flatten(Item)
item_9 = ListItem(List=split, Index=1, Wrap=True)  # -> flatten(Item)
top_rolling_shade = CSharpScript(
    act1=item_8,
    act2=item_9,
    hwindow=window_height,
    N=window_normal,
    tedge=crv,
    Reference="C:\USERS\VICTOR CHARPENTIER\APPDATA\ROAMING\GRASSHOPPER\LIBRARIES\IvyCore.dll")  # -> out, V, S; inputs act1: list of Double, act2: list of Double, hwindow: Double, N: Vector3d, tedge: Curve
# ---------- top_rolling_shade: C# ----------
    var normal = (Vector3d) N;
    var hwin = (double) hwindow;
    var Act1 = (List<double>) act1;
    var Act2 = (List<double>) act2;
    var top = (Curve) tedge;

    var surf = new List<GH_Surface>();

    var nn = Act1.Count;
    var vec = new List<Vector3d>();
    var origin = new Point3d(0.0, 0.0, 0.0);
    var rotaxis = Vector3d.CrossProduct(normal, new Vector3d(0.0, 0.0, -1.0));

    for (int i = 0;i < nn;i++)
    {
      var ag = -Math.PI * Act1[i] / 180;
      var ext = Act2[i];

      var current_vec = new Vector3d(0.0, 0.0, -1.0);

      current_vec.Transform(Transform.Rotation(ag, rotaxis, origin));
      current_vec = ext * (hwin) * current_vec;

      var current_surf = Rhino.Geometry.Extrusion.CreateExtrusion(top, current_vec);

      vec.Add(current_vec);
      surf.Add(new Grasshopper.Kernel.Types.GH_Surface(current_surf));

    }

    V = vec;
    S = surf;
# ---------- end top_rolling_shade ----------
srf = Surface(top_rolling_shade.S)

number_slider_9 = Slider(1300, range=0..2385)
item_10 = ListItem(List=num_2, Index=number_slider_9, Wrap=True)  # -> simplify(Item)
item_11 = ListItem(List=vec_3, Index=number_slider_9, Wrap=True)  # -> simplify(Item)
item_12 = ListItem(List=srf, Index=number_slider_9, Wrap=True)
vdis_2 = VectorDisplay(Anchor=facen.Centers, Vector=item_11)
c_script_9 = CSharpScript(x=item_10)  # -> out, A; inputs x: Double
# ---------- c_script_9: C# ----------
    var hour = (double) x;

    var day = Math.Floor(hour / 24);

    var monthLengthArray = new int[12]{31,29,31,30,31,30,31,31,30,31,30,31};
    string[] monthNames = {"January","February","March","April","May","June","July","August","September","October","November","December"};

    var monthIndex = 0;
    for (int i = 0;i < 12;i++)
    {
      if (day > monthLengthArray.Take(i).Sum() - 1)
      {
        monthIndex = i;
      }
    }

    var currentMonth = monthNames[monthIndex];
    var currentDay = day - monthLengthArray.Take(monthIndex).Sum() + 1;
    var currentHour = hour - day * 24;

    string currentDayFull = currentMonth + " " + currentDay.ToString() + " " + currentHour.ToString() + ":00";

    A = currentDayFull;
# ---------- end c_script_9 ----------
panel_15 = Panel(c_script_9.A)

item_13 = ListItem(List=item_9, Index=number_slider_9, Wrap=True)
item_14 = ListItem(List=item_8, Index=number_slider_9, Wrap=True)
panel_16 = Panel(item_14)
panel_17 = Panel(item_13)
refine_9 = Refine(Mesh=item_12, Level=number_slider_8)  # disabled
shadeassess = ShadeAssessment(WindowPanelMesh=refine_7, ShadeModuleMesh=refine_9, ProjectionVector=item_11, LaunchTheAnalysis=toggle)  # -> MeshOfExposedWindowsSurface, AreaOfExposed, CommentOnOperationType, DebugMeshcutter, DebugHull; disabled
shadeassess_2 = ShadeAssessment(WindowPanelMesh=refine_7, ShadeModuleMesh=refine_9, ProjectionVector=vec_6, LaunchTheAnalysis=toggle)  # -> MeshOfExposedWindowsSurface, AreaOfExposed, CommentOnOperationType, DebugMeshcutter, DebugHull; disabled
mesh_8 = Mesh(shadeassess.MeshOfExposedWindowsSurface)  # disabled
glareassess = GlareOnWallPanel(WallPanel=desk, SourceOutline=mesh_8, ProjectionDirectionVector=item_11, LaunchTheAnalysis=toggle)  # -> MeshOfGlareOnTheWallPanel, AreaOfGlareOnTheWallPanel, CommentOnOperationType, DebugMeshcutter; disabled
mesh_9 = Mesh(glareassess.MeshOfGlareOnTheWallPanel)  # disabled
mesh_10 = Mesh(shadeassess_2.MeshOfExposedWindowsSurface)  # disabled

# ----
# Shade
# View
# Glare in room
# Glare on Desk
multiplication_8 = Multiplication(A=vec_3, B=-1)
wall_left = Mesh(tri_4.Mesh)
back_wall = Mesh(tri_3.Mesh)
floor = Mesh(tri.Mesh)
wall_right = Mesh(tri_2.Mesh)
vec_9 = Vector(multiplication_8)
desk_2 = Mesh(tri_6.Mesh)
mesh_11 = Mesh(mesh_4)
mesh_12 = Mesh(mesh_7)
vec_10 = Vector(multiplication_8)
vec_11 = Vector(facen.Normals)
shadeassess_3 = ShadeAssessment(WindowPanelMesh=mesh_11, ShadeModuleMesh=mesh_12, ProjectionVector=vec_10, LaunchTheAnalysis=Toggle(True))  # -> MeshOfExposedWindowsSurface, AreaOfExposed, CommentOnOperationType, DebugMeshcutter, DebugHull
source = Mesh(shadeassess_3.MeshOfExposedWindowsSurface)
shadeassess_4 = ShadeAssessment(WindowPanelMesh=mesh_11, ShadeModuleMesh=mesh_12, ProjectionVector=vec_11, LaunchTheAnalysis=Toggle(True))  # -> MeshOfExposedWindowsSurface, AreaOfExposed, CommentOnOperationType, DebugMeshcutter, DebugHull
mesh_13 = Mesh(shadeassess_3.MeshOfExposedWindowsSurface)
mesh_14 = Mesh(shadeassess_4.MeshOfExposedWindowsSurface)
num_3 = Number(shadeassess_3.AreaOfExposed)
c_script_10 = CSharpScript(x=num_3)  # -> out, A; inputs x: tree of Double
# ---------- c_script_10: C# ----------
    var t = (DataTree<double>) x;
    bool output = false;

    if (t.BranchCount >= 1) {output = true;}

    A = output;
# ---------- end c_script_10 ----------
c_script_11 = CSharpScript(x=num_3)  # -> out, A; inputs x: tree of Double; same code as c_script_10
glareassess_2 = GlareOnWallPanel(WallPanel=desk_2, SourceOutline=source, ProjectionDirectionVector=vec_9, LaunchTheAnalysis=c_script_11.A)  # -> MeshOfGlareOnTheWallPanel, AreaOfGlareOnTheWallPanel, CommentOnOperationType, DebugMeshcutter
num_4 = Number(shadeassess_4.AreaOfExposed)

# ---- group: wall 1
glareassess_3 = GlareOnWallPanel(WallPanel=wall_right, SourceOutline=source, ProjectionDirectionVector=vec_9, LaunchTheAnalysis=c_script_10.A)  # -> MeshOfGlareOnTheWallPanel, AreaOfGlareOnTheWallPanel, CommentOnOperationType, DebugMeshcutter; disabled

# ----
mesh_15 = Mesh(glareassess_2.MeshOfGlareOnTheWallPanel)
num_5 = Number(glareassess_2.AreaOfGlareOnTheWallPanel)

c_script_12 = CSharpScript(x=glareassess_3.AreaOfGlareOnTheWallPanel)  # -> out, A; inputs x: tree of Double; same code as c_script_10

# ---- group: Wall 2
glareassess_4 = GlareOnWallPanel(WallPanel=wall_left, SourceOutline=source, ProjectionDirectionVector=vec_9, LaunchTheAnalysis=c_script_12.A)  # -> MeshOfGlareOnTheWallPanel, AreaOfGlareOnTheWallPanel, CommentOnOperationType, DebugMeshcutter; disabled

# ----
c_script_13 = CSharpScript(x=glareassess_4.AreaOfGlareOnTheWallPanel)  # -> out, A; inputs x: tree of Double; same code as c_script_10

# ---- group: Floor
glareassess_5 = GlareOnWallPanel(WallPanel=floor, SourceOutline=source, ProjectionDirectionVector=vec_9, LaunchTheAnalysis=c_script_13.A)  # -> MeshOfGlareOnTheWallPanel, AreaOfGlareOnTheWallPanel, CommentOnOperationType, DebugMeshcutter; disabled

# ----
c_script_14 = CSharpScript(x=glareassess_5.AreaOfGlareOnTheWallPanel)  # -> out, A; inputs x: tree of Double; same code as c_script_10

# ---- group: back wall
glareassess_6 = GlareOnWallPanel(WallPanel=back_wall, SourceOutline=source, ProjectionDirectionVector=vec_9, LaunchTheAnalysis=c_script_14.A)  # -> MeshOfGlareOnTheWallPanel, AreaOfGlareOnTheWallPanel, CommentOnOperationType, DebugMeshcutter; disabled

# ----
addition_6 = Addition(
    A=glareassess_3.AreaOfGlareOnTheWallPanel,
    B=glareassess_4.AreaOfGlareOnTheWallPanel,
    C=glareassess_5.AreaOfGlareOnTheWallPanel,
    D=glareassess_6.AreaOfGlareOnTheWallPanel)  # disabled
num_6 = Number(addition_6)  # disabled

number_slider_10 = Slider(0, range=0..2442)
number_slider_11 = Slider(22, range=0..39)
item_15 = ListItem(List=mesh_14, Index=number_slider_10, Wrap=True)
# Debug
c_script_15 = CSharpScript(x=mesh_13)  # -> out, A, B, C, D; inputs x: tree of Mesh
# ---------- c_script_15: C# ----------
    var msh = (DataTree<Mesh>) x;
    var nb = x.BranchCount;

    var invalidReportBool = new DataTree<bool>();
    var invalidReportString = new DataTree<string>();
    var countInvalid = 0;
    var itemInvalid = new List<string>();
    

    for (int i = 0;i < nb;i++)
    {
      var shadePath = new GH_Path(i);
      for (int j = 0;j < x.Branch(i).Count;j++)
      {
        if (!x.Branch(i)[j].IsValid)
        {
          invalidReportBool.Add(false, shadePath);
          invalidReportString.Add("mesh " + i.ToString() + " is invalid for the sun vector  " + j.ToString(), shadePath);
          countInvalid += 1;
          itemInvalid.Add("mesh "+i.ToString()+", vsun "+j.ToString());
        }
        else
        {
          invalidReportBool.Add(true, shadePath);
          invalidReportString.Add("valid mesh " + i.ToString() + ", vsun " + j.ToString(), shadePath);
        }
      }

    }

    A = invalidReportBool;
    B = invalidReportString;
    C = countInvalid;
    D = itemInvalid;
# ---------- end c_script_15 ----------
item_16 = ListItem(List=vec_3, Index=number_slider_10, Wrap=True)
viewer_2 = ParamViewer(mesh_14)
item_17 = ListItem(List=viewer_2, Index=number_slider_11, Wrap=True)
branch_2 = TreeBranch(Tree=mesh_14, Path=item_17, MaintainPaths=True)
branch_3 = TreeBranch(Tree=glareassess_4.MeshOfGlareOnTheWallPanel, Path=item_17, MaintainPaths=True)
branch_4 = TreeBranch(Tree=glareassess_5.MeshOfGlareOnTheWallPanel, Path=item_17, MaintainPaths=True)
branch_5 = TreeBranch(Tree=glareassess_6.MeshOfGlareOnTheWallPanel, Path=item_17, MaintainPaths=True)
panel_18 = Panel(c_script_15.C)
item_18 = ListItem(List=mesh_7, Index=number_slider_11, Wrap=True)
item_19 = ListItem(List=branch_2, Index=number_slider_10, Wrap=True)
projecta = ProjectAlong(Geometry=item_18, Plane=rotate.Geometry, Direction=item_16)  # -> Geometry, Transform
item_20 = ListItem(List=branch_3, Index=number_slider_10, Wrap=True)
item_21 = ListItem(List=branch_4, Index=number_slider_10, Wrap=True)
medges_9 = MeshEdges(Mesh=item_15)  # -> NakedEdges, InteriorEdges, NonManifoldEdges
item_22 = ListItem(List=branch_5, Index=number_slider_10, Wrap=True)
vdis_3 = VectorDisplay(Anchor=facen.Centers, Vector=item_16)
preview_5 = CustomPreview(Geometry=item_18, Shader=ColourSwatch(SwatchColor=RGBA(0, 63, 117, 114)))
preview_6 = CustomPreview(Geometry=[item_19, item_20, item_21, item_22], Shader=ColourSwatch(SwatchColor=RGBA(41, 41, 41, 107)))

medges_10 = MeshEdges(Mesh=item_19)  # -> NakedEdges, InteriorEdges, NonManifoldEdges
preview_7 = CustomPreview(
    Geometry=[medges_10.NakedEdges, medges_10.InteriorEdges],
    Shader={ambient=RGB(0, 0, 0), diffuse=RGB(255, 105, 180), emission=RGB(76, 32, 54), shine=0.5, specular=RGB(255, 255, 255), transparency=0})

workingdir_3 = FilePath(path)
concat_3 = Concatenate(FragmentA=workingdir_3, FragmentB="optValCriteria.csv")
c_script_16 = CSharpScript(
    path=concat_3,
    Ncriteria="3",
    run=toggle_2,
    Reference="C:\Users\Victor Charpentier\AppData\Roaming\Grasshopper\Libraries\IvyCore.dll")  # -> out, A; inputs path: String, Ncriteria: Int32
# ---------- c_script_16: C# ----------
    var filePath = (string) path;
    var ncrit = (int) Ncriteria;
    var runIt = (bool) run;

    if (!runIt){return;}

    var reader = new StreamReader(filePath);
    var field = new DataTree<string>();



    while (!reader.EndOfStream)
    {
      var line = reader.ReadLine();
      var values = line.Split(',');
      var ncomb = values.Length / ncrit;

      Print(values.Length.ToString());

      for (int i = 0;i < ncomb;i++)
      {
        field.Add(string.Format("{0},{1},{2}", values[i * ncrit].ToString(), values[i * ncrit + 1].ToString(), values[i * ncrit + 2].ToString()), new GH_Path(i));
      }

    }

    A = field;
# ---------- end c_script_16 ----------
branch_6 = TreeBranch(Tree=c_script_16.A, Path=item_7, MaintainPaths=True)
split_2 = TextSplit(Text=branch_6, Separators=",")
item_23 = ListItem(List=split_2, Index=0, Wrap=True)  # -> flatten(Item)
item_24 = ListItem(List=split_2, Index=2, Wrap=True)  # -> flatten(Item)
item_25 = ListItem(List=split_2, Index=1, Wrap=True)  # -> flatten(Item)

window_area_2 = Number(mplane.Area)
number_slider_12 = Slider(0, range=0..1)
c_script_17 = CSharpScript(x=item_23, upper=window_area_2, lower=number_slider_12)  # -> out, A; inputs x: list of Double, upper: Double, lower: Double
# ---------- c_script_17: C# ----------
    var raw = (List<double>) x;
    var ub = (double) upper;
    var lb = (double) lower;

    var maxRaw = raw.Max();
    var minRaw = raw.Min();

    var norm = new List<double>();

    for (int i = 0;i < raw.Count;i++)
    {
      var current_norm = (ub-lb) * (raw[i] - minRaw) / (maxRaw - minRaw) + lb;
      norm.Add(current_norm);
    }

    A = norm;
# ---------- end c_script_17 ----------
c_script_18 = CSharpScript(x=item_25, upper=window_area_2, lower=number_slider_12)  # -> out, A; inputs x: list of Double, upper: Double, lower: Double; same code as c_script_17
c_script_19 = CSharpScript(x=item_24, upper=Slider(1, range=0..10), lower=number_slider_12)  # -> out, A; inputs x: list of Double, upper: Double, lower: Double; same code as c_script_17

item_26 = ListItem(List=c_script_17.A, Index=number_slider_9, Wrap=True)  # -> simplify(Item)
item_27 = ListItem(List=c_script_18.A, Index=number_slider_9, Wrap=True)  # -> simplify(Item)
item_28 = ListItem(List=c_script_19.A, Index=number_slider_9, Wrap=True)  # -> simplify(Item)

cos_facade_sun_2 = Number(dprod)
window_area_3 = Number(mplane.Area)
desk_area_2 = Number(area_2.Area)
item_29 = ListItem(List=cos_facade_sun_2, Index=number_slider_9, Wrap=True)
panel_19 = Panel(item_26)  # disabled
panel_20 = Panel(item_27)  # disabled
panel_21 = Panel(item_28)  # disabled
multiplication_9 = Multiplication(A=shadeassess.AreaOfExposed, B=item_29)  # -> simplify(Result); disabled
division_7 = Division(A=glareassess.AreaOfGlareOnTheWallPanel, B=desk_area_2)  # -> simplify(Result); disabled
division_8 = Division(A=shadeassess_2.AreaOfExposed, B=window_area_3)  # disabled
panel_22 = Panel(multiplication_9)  # disabled
panel_23 = Panel(division_8)  # disabled
panel_24 = Panel(division_7)  # disabled
expression_2 = Expression(x=panel_23, y=panel_20, Expression="100*(x-y)/x")  # disabled
expression_3 = Expression(x=panel_22, y=panel_19, Expression="100*(x-y)/x")  # disabled
expression_4 = Expression(x=panel_24, y=panel_21, Expression="100*(x-y)/x")  # disabled
panel_25 = Panel(expression_3)  # disabled
panel_26 = Panel(expression_2)  # disabled
panel_27 = Panel(expression_4)  # disabled
