# Grasshopper definition room_simpleShade_optimization_v7.gh (Grasshopper 0.9.76)
# plug-ins: Kangaroo Components, PlanktonGh, IvyGh, SunTools, Kangaroo2 Components

number_slider = Slider(4, range=0..10)
number_slider_2 = Slider(2.2, range=0..10)
division = Division(A=number_slider_2, B=-2)
division_2 = Division(A=number_slider_2, B=2)
division_3 = Division(A=number_slider, B=-2)
division_4 = Division(A=number_slider, B=2)
pi = Pi(Factor=2)
rad = Radians(Degrees=Slider(105, range=90..270))
yz = YZPlane(Origin=Point(0, 0, 0))
subtraction = Subtraction(A=pi, B=rad)
dom = ConstructDomain(DomainStart=division, DomainEnd=division_2)
dom_2 = ConstructDomain(DomainStart=division_3, DomainEnd=division_4)
rotate = Rotate(Geometry=yz, Angle=subtraction, Plane=PlaneXY(0, 0, 0))  # -> Geometry, Transform
number_slider_3 = Slider(1, range=0..1)
rectangle = Rectangle(Plane=rotate.Geometry, XSize=dom_2, YSize=dom, Radius=0)  # -> Rectangle, Length
mplane = MeshPlane(Boundary=rectangle.Rectangle, WidthCount=number_slider_3, HeightCount=number_slider_3)  # -> Mesh, Area
facen = FaceNormals(Mesh=mplane.Mesh)  # -> Centers, Normals
refine = Refine(Mesh=mplane.Mesh, Level=Slider(4, range=0..10))

number_slider_4 = Slider(8, range=0..10)
number_slider_5 = Slider(8, range=0..10)
number_slider_6 = Slider(0.01, range=0..0.01)
division_5 = Division(A=Slider(70, range=0..90), B=number_slider_4)
division_6 = Division(A=Slider(1, range=0..90), B=number_slider_5)
# Simple Shade geometry
panel = Panel("0")
series = Series(Start=Slider(0, range=0..90), Step=division_5, Count=expr("x+1", number_slider_4))
series_2 = Series(Start=Slider(0, range=0..90), Step=division_6, Count=expr("x+1", number_slider_5))
panel_2 = Panel("""agl
ext""")
replace = ReplaceItems(List=series_2, Item=number_slider_6, Indices=panel, Wrap=False)
replace_2 = ReplaceItems(List=series, Item=number_slider_6, Indices=panel, Wrap=False)
txt = Text(panel_2)
entwine = Entwine(Branch00=replace_2, Branch01=replace, FlattenInputs=True)
grid = ConstructGrid(InputRange=entwine, Labels=txt)  # -> GridInformations, Grid
vec = Vector(facen.Normals)
medges = MeshEdges(Mesh=mplane.Mesh)  # -> NakedEdges, InteriorEdges, NonManifoldEdges
panel_3 = Panel(grid.GridInformations)
item = ListItem(List=medges.NakedEdges, Index=Slider(2, range=0..10), Wrap=True)
divide = DivideCurve(Curve=item, Count="2", Kinks=False)  # -> Points, Tangents, Parameters
item_2 = ListItem(List=divide.Points, Index="1", Wrap=True)
Z = UnitZ(Factor=1)
addition = Addition(A=number_slider_2, B="0.10")
c_script = CSharpScript(
    input_grid=grid.Grid,
    hwindow=addition,
    N=vec,
    Reference="C:\Users\Victor Charpentier\AppData\Roaming\Grasshopper\Libraries\IvyCore.dll")  # -> out, V; inputs hwindow: Double, N: Vector3d
# ---------- c_script: C# ----------
    var normal = (Vector3d) N;
    var hwin = (double) hwindow;
    var gact = (Grid) input_grid;



    var nn = gact.NodeCount;
    var vec = new List<Vector3d>();
    //var actuationstate = new double[nn][];
    var origin = new Point3d(0.0, 0.0, 0.0);
    var rotaxis = Vector3d.CrossProduct(normal, new Vector3d(0.0, 0.0, -1.0));

    for (int i = 0;i < nn;i++)
    {
      var ag = -Math.PI * gact.Nodes[i][0] / 180;
      var ext = gact.Nodes[i][1];

      var current_vec = new Vector3d(0.0, 0.0, -1.0);

      current_vec.Transform(Transform.Rotation(ag, rotaxis, origin));
      current_vec = ext * (hwin) * current_vec;
      vec.Add(current_vec);

    }

    V = vec;
# ---------- end c_script ----------
vec_2 = Vector(facen.Normals)
scale = Scale(Geometry=item, Center=item_2, Factor="1.05")  # -> Geometry, Transform
expression = Expression(x=Z, y=vec_2, a="0.10", b="0.03", Expression="a*x+b*y")
move = Move(Geometry=scale.Geometry, Motion=expression)  # -> Geometry, Transform
extr = Extrude(Base=move.Geometry, Direction=c_script.V)
mesh = MeshBrep(
    Brep=extr,
    Settings={GridMaxCount=0, GridMinCount=16, JaggedSeams=False, MaxEdgeLength=0, MinEdgeLength=0.0001, MinTolerance=0, Refine=True, RefineAngle=0, RelativeTolerance=0.65, SimplePlanes=True, Tolerance=0})
refine_2 = Refine(Mesh=mesh, Level=Slider(4, range=0..10))
tri = Triangulate(Mesh=refine_2)  # -> Mesh, Count
item_3 = ListItem(List=tri.Mesh, Index="25", Wrap=True)
mesh_2 = Mesh(tri.Mesh)

# ---- group: ROOM
number_slider_7 = Slider(0.5, range=0..1)
normal_window = Vector(facen.Normals)
mesh_3 = Mesh(mplane.Mesh)
medges_2 = MeshEdges(Mesh=mesh_3)  # -> NakedEdges, InteriorEdges, NonManifoldEdges
unit = UnitVector(Vector=normal_window)
multiplication = Multiplication(A=number_slider_7, B=-1)
# Room geometry
item_4 = ListItem(List=medges_2.NakedEdges, Index="1", Wrap=True)
multiplication_2 = Multiplication(A=unit, B=Slider(0, range=-1..0))
Z_2 = UnitZ(Factor=multiplication)
multiplication_3 = Multiplication(A=unit, B=Slider(-5, range=-10..-1))
addition_2 = Addition(A=multiplication_2, B=Z_2)
move_2 = Move(Geometry=item_4, Motion=addition_2)  # -> Geometry, Transform
multiplication_4 = Multiplication(A=number_slider_7, B=2)
end = EndPoints(Curve=move_2.Geometry)  # -> Start, End
addition_3 = Addition(A=number_slider_2, B=multiplication_4)
move_3 = Move(Geometry=end.Start, Motion=multiplication_3)  # -> Geometry, Transform
move_4 = Move(Geometry=end.End, Motion=multiplication_3)  # -> Geometry, Transform
Z_3 = UnitZ(Factor=addition_3)
pt = Point(end.Start)
move_5 = Move(Geometry=pt, Motion=Z_3)  # -> Geometry, Transform
pt_2 = Point(move_3.Geometry)
move_6 = Move(Geometry=pt_2, Motion=Z_3)  # -> Geometry, Transform
pt_3 = Point(end.End)
move_7 = Move(Geometry=pt_3, Motion=Z_3)  # -> Geometry, Transform
pt_4 = Point(move_4.Geometry)
move_8 = Move(Geometry=pt_4, Motion=Z_3)  # -> Geometry, Transform
c_script_2 = CSharpScript(A=pt, B=pt_2, C=pt_4, D=pt_3)  # -> out, mesh, edges, plane; inputs A: Point3d, B: Point3d, C: Point3d, D: Point3d
# ---------- c_script_2: C# ----------
    var p1 = (Point3d) A;
    var p2 = (Point3d) B;
    var p3 = (Point3d) C;
    var p4 = (Point3d) D;
    List < Point3d > vert = new List<Point3d>(){p1,p2,p3,p4};

    var f1 = new Rhino.Geometry.MeshFace(0, 1, 2, 3);
    var m1 = new Rhino.Geometry.Mesh();
    var pl1 = new Rhino.Geometry.Plane(p1, p2, p4);

    m1.Vertices.AddVertices(vert);
    m1.Faces.AddFace(f1);

    var e1 = new List<Polyline>(m1.GetNakedEdges());

    mesh = m1;
    plane = pl1;
    edges = e1;
# ---------- end c_script_2 ----------
c_script_3 = CSharpScript(A=pt, B=pt_2, C=move_6.Geometry, D=move_5.Geometry)  # -> out, mesh, edges, plane; inputs A: Point3d, B: Point3d, C: Point3d, D: Point3d; same code as c_script_2
c_script_4 = CSharpScript(A=pt_2, B=pt_4, C=move_8.Geometry, D=move_6.Geometry)  # -> out, mesh, edges, plane; inputs A: Point3d, B: Point3d, C: Point3d, D: Point3d; same code as c_script_2
c_script_5 = CSharpScript(A=pt_3, B=pt_4, C=move_8.Geometry, D=move_7.Geometry)  # -> out, mesh, edges, plane; inputs A: Point3d, B: Point3d, C: Point3d, D: Point3d; same code as c_script_2
number_slider_8 = Slider(4, range=0..10)
mjoin = MeshJoin(Meshes=[c_script_2.mesh, c_script_3.mesh, c_script_4.mesh, c_script_5.mesh])
refine_3 = Refine(Mesh=c_script_5.mesh, Level=number_slider_8)
refine_4 = Refine(Mesh=c_script_2.mesh, Level=number_slider_8)
refine_5 = Refine(Mesh=c_script_3.mesh, Level=number_slider_8)
refine_6 = Refine(Mesh=c_script_4.mesh, Level=number_slider_8)
medges_3 = MeshEdges(Mesh=mjoin)  # -> NakedEdges, InteriorEdges, NonManifoldEdges
tri_2 = Triangulate(Mesh=refine_4)  # -> Mesh, Count
tri_3 = Triangulate(Mesh=refine_5)  # -> Mesh, Count
tri_4 = Triangulate(Mesh=refine_6)  # -> Mesh, Count
tri_5 = Triangulate(Mesh=refine_3)  # -> Mesh, Count
preview = CustomPreview(
    Geometry=[medges_2.NakedEdges, medges_3.NakedEdges, medges_3.InteriorEdges],
    Shader=ColourSwatch(SwatchColor=RGBA(0, 0, 0, 41)))

# ----
rad_2 = Radians(Degrees=Slider(3, range=0..10))
# Window geometry
number_slider_9 = Slider(3, range=1..3000)
series_3 = Series(Start=Slider(1128, range=0..3578), Step=1, Count=number_slider_9)

# ----
# Sun Vectors
X = UnitX(Factor=1)
azi = Number([126.3264092, 137.3313031, 149.9081719, 164.0725822, 179.3051332, 194.5902344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])
ele = Number([5.239618324, 13.76930373, 20.56615289, 25.05155863, 26.71385892, 25.32899458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])
num = Number([8, 9, 10, 11, 12, 13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])
sunsifting = SiftSunOrientations(
    North=X,
    SunAzimuth=azi,
    SunAltitude=ele,
    AssociatedSunHours=num,
    FaçadePanelToEvaluate=mplane.Mesh,
    AngleToleranceInRad=rad_2)  # -> ResultingSiftedSunAzimuthAngles, ResultingSiftedSunAltitudeAngles, ResultingSiftedHours, ResultingSuftedSunVectors
item_5 = ListItem(List=sunsifting.ResultingSuftedSunVectors, Index=series_3, Wrap=True)  # -> simplify(Item)

item_6 = ListItem(List=sunsifting.ResultingSiftedHours, Index=series_3, Wrap=True)  # -> simplify(Item)

mesh_4 = Mesh()
medges_4 = MeshEdges(Mesh=mesh_4)  # -> NakedEdges, InteriorEdges, NonManifoldEdges
mc = MeshCorners(Mesh=mesh_4, Angle=2.35619449)
join = JoinCurves(Curves=medges_4.NakedEdges, Preserve=False)
meshmachine = MeshMachine(
    Geometry=simplify(mesh_4),
    Length=simplify(Slider(0.4, range=0.001..5)),
    FixCurves=simplify(join),
    FixVertices=simplify(mc),
    Flip=1,
    PullStrength=Slider(1, range=0..1),
    CurvatureAdaptivity=0,
    BoundaryScale=Slider(0.5, range=0..1),
    BoundaryDistance=Slider(2, range=0..10),
    Exponent=Slider(4, range=0..10),
    Background=0.5,
    Iterations=simplify(Slider(200, range=0..200)),
    Reset=Toggle(False))
pmesh = PlanktonMesh(meshmachine)
mesh_5 = Mesh(pmesh)
medges_5 = MeshEdges(Mesh=mesh_5)  # -> NakedEdges, InteriorEdges, NonManifoldEdges

num_2 = Number(sunsifting.ResultingSiftedHours)

vec_3 = Vector(normal_window)
unit_2 = UnitVector(Vector=vec_3)
# Desk
area = Area(Geometry=c_script_2.mesh)  # -> Area, Centroid
Z_4 = UnitZ(Factor=Slider(0.8, range=0..1))
xprod = CrossProduct(VectorA=vec_3, VectorB=Z_4, Unitize=True)  # -> Vector, Length
vec_4 = Vector(xprod.Vector)
multiplication_5 = Multiplication(A=unit_2, B="1")
multiplication_6 = Multiplication(A=vec_4, B="-0.5")
addition_4 = Addition(A=multiplication_5, B=multiplication_6)
scale_2 = Scale(Geometry=c_script_2.mesh, Center=area.Centroid, Factor=Slider(0.24, range=0.001..1))  # -> Geometry, Transform
addition_5 = Addition(A=Z_4, B=addition_4)
move_9 = Move(Geometry=scale_2.Geometry, Motion=addition_5)  # -> Geometry, Transform

vec_5 = Vector(sunsifting.ResultingSuftedSunVectors)
panel_4 = Panel(num_2)
vdis = VectorDisplay(Anchor=facen.Centers, Vector=item_5)
tri_6 = Triangulate(Mesh=refine)  # -> Mesh, Count
item_7 = ListItem(List=num_2, Index=0, Wrap=True)
c_script_6 = CSharpScript(x=item_7)  # -> out, A; inputs x: Double
# ---------- c_script_6: C# ----------
    var hour = (double) x;

    var day = Math.Floor(hour / 24);

    var monthLengthArray = new int[12]{31,29,31,30,31,30,31,31,30,31,30,31};
    string[] monthNames = {"January","February","March","April","May","June","July","August","September","October","November","December"};

    var monthIndex = 0;
    for (int i = 0;i < 12;i++)
    {
      if (day > monthLengthArray.Take(i).Sum() - 1)
      {
        monthIndex = i;
      }
    }

    var currentMonth = monthNames[monthIndex];
    var currentDay = day - monthLengthArray.Take(monthIndex).Sum() + 1;
    var currentHour = hour - day * 24;

    string currentDayFull = currentMonth + " " + currentDay.ToString() + " " + currentHour.ToString() + ":00";

    A = currentDayFull;
# ---------- end c_script_6 ----------
preview_2 = CustomPreview(Geometry=mplane.Mesh, Shader=ColourSwatch(SwatchColor=RGBA(140, 209, 255, 142)))
mesh_6 = Mesh(tri_6.Mesh)
medges_6 = MeshEdges(Mesh=mesh_6)  # -> NakedEdges, InteriorEdges, NonManifoldEdges
panel_5 = Panel(c_script_6.A)
xy = XYPlane(Origin=area.Centroid)
refine_7 = Refine(Mesh=move_9.Geometry, Level=number_slider_8)
area_2 = Area(Geometry=move_9.Geometry)  # -> Area, Centroid
move_10 = Move(Geometry=xy, Motion=addition_5)  # -> Geometry, Transform
tri_7 = Triangulate(Mesh=refine_7)  # -> Mesh, Count
swatch = ColourSwatch(SwatchColor=RGBA(130, 121, 17, 188))
preview_3 = CustomPreview(Geometry=area_2.Centroid, Shader=swatch)
preview_4 = CustomPreview(Geometry=move_9.Geometry, Shader=swatch)
medges_7 = MeshEdges(Mesh=item_3)  # -> NakedEdges, InteriorEdges, NonManifoldEdges
series_4 = Series(Start=Slider(0, range=0..1), Step=Slider(0.15, range=0..0.5), Count=Slider(4, range=0..11))
series_5 = Series(Start=Slider(0, range=0..1), Step=Slider(0.1, range=0..0.2), Count=Slider(6, range=0..11))
panel_6 = Panel("""view_summer
directGlare_summer""")
panel_7 = Panel(series_4)
panel_8 = Panel(series_5)
# Seasonal coeficient
entwine_2 = Entwine(Branch00=panel_8, Branch01=panel_7, FlattenInputs=True)
grid_2 = ConstructGrid(InputRange=entwine_2, Labels=panel_6)  # -> GridInformations, Grid
heating_period_start = Panel("6576")
heating_period_end = Panel("3096")
seasoncoefgrid = SeasonalCoefGrid(
    SunHours=num_2,
    StartOfWinterPeriod=heating_period_start,
    EndOfWinterPeriod=heating_period_end,
    CoolingCoefficientGrid=grid_2.Grid)  # -> ListOfWeightedCoefficients, GlobalCoefGrid, CoefficientHeatingCooling
vec_6 = Vector(facen.Normals)
vec_7 = Vector(vec_5)
dprod = DotProduct(VectorA=vec_7, VectorB=vec_6, Unitize=invert(False))

# ---- group: V0
solar_gains_area = Number(Tree({0}: [8.800000072, 8.800000072, 8.800000072], {1}: [8.800000072, 8.800000072, 8.800000072], {2}: [8.800000072, 8.800000072, 8.800000072], {3}: [8.800000072, 8.800000072, 8.800000072], {4}: [8.800000072, 8.800000072, 8.800000072], {5}: [8.800000072, 8.800000072, 8.800000072]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))
view_area = Number(Tree({0}: [8.800000072], {1}: [8.800000072], {2}: [8.800000072], {3}: [8.800000072], {4}: [8.800000072], {5}: [8.800000072]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))
glare_area = Number(Tree({0}: [13.495164, 14.90661893, 9.822182342, 5.815750098, 2.705143493, 13.52165207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], {1}: [13.48719112, 14.84918976, 9.738945536, 5.726476909, 2.624852992, 13.51375034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], {2}: [13.50033066, 14.8307742, 9.70118656, 5.684576628, 2.58299472, 13.52696526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], {3}: [13.52765162, 14.82351718, 9.672626892, 5.647654198, 2.543619594, 13.55439061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], {4}: [13.58827128, 14.83347428, 9.649797722, 5.606813922, 2.495815028, 13.6151976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], {5}: [13.69441438, 14.87705215, 9.646087383, 5.573529722, 2.44906107, 13.72162721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]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))

# ----
desk_glare_area = Number(Tree({0}: [1.048791363, 1.152000042, 1.152000042], {1}: [1.048791363, 1.152000042, 1.152000042], {2}: [1.048791363, 1.152000042, 1.152000042], {3}: [1.048791363, 1.152000042, 1.152000042], {4}: [1.048791363, 1.152000042, 1.152000042], {5}: [1.048791363, 1.152000042, 1.152000042]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))
cos_facade_sun = Number(dprod)
window_area = Number(mplane.Area)
desk_area = Number(area_2.Area)
division_7 = Division(A=desk_glare_area, B=desk_area)  # -> simplify(Result)
division_8 = Division(A=view_area, B=window_area)
multiplication_7 = Multiplication(A=solar_gains_area, B=dprod)  # -> simplify(Result)
panel_9 = Panel("C:\Users\Victor Charpentier\Documents\GitHub\SuntoolGH\dev\data_fit\")
panel_10 = Panel("C:\Users\victor\Documents\GitHub\SuntoolGH\dev\data_fit\")
matlab_exe_sp4 = FilePath("C:\Program Files\MATLAB\R2016b\bin\matlab.exe")

grid_3 = Grid(grid.Grid)
path = FilePath(panel_9)
# Create Matlab analysis files
c_script_7 = CSharpScript(
    solarGain=multiplication_7,
    View=division_8,
    deskGlare=division_7,
    seasonCoefs=seasoncoefgrid.ListOfWeightedCoefficients,
    perm=seasoncoefgrid.CoefficientHeatingCooling,
    normalizationMin=Slider(0, range=0..20),
    normalizationMax=Slider(1, range=0..20),
    normalizationONOFF=Toggle(False),
    act=grid_3,
    workdir=path,
    start=Button(),
    Reference="C:\USERS\VICTOR CHARPENTIER\APPDATA\ROAMING\GRASSHOPPER\LIBRARIES\IvyCore.dll")  # -> out; inputs solarGain: tree of Double, View: tree of Double, deskGlare: tree of Double, seasonCoefs: tree of String, perm: list of Double, normalizationMin: Double, normalizationMax: Double, normalizationONOFF: Boolean, workdir: String, start: Boolean
# ---------- c_script_7: C# ----------
    var tree_output1 = (DataTree<double>) solarGain;
    var tree_output2 = (DataTree<double>) View;
    var tree_output3 = (DataTree<double>) deskGlare;
    var tree_output4 = (DataTree<string>) seasonCoefs;
    var listkron = (List<double>) perm;
    var minNorm = (double) normalizationMin;
    var maxNorm = (double) normalizationMax;
    var statNorm = (bool) normalizationONOFF;
    var workingDir = (string) workdir;
    var gact = (Grid) act;

    var run = (bool) start;

    if (!run){return;}

    int nb = tree_output1.BranchCount;
    var ncoef = tree_output4.BranchCount;

    var filePath1 = workingDir + "\\gh-" + "solarGain" + ".csv";
    var filePath2 = workingDir + "\\gh-" + "view" + ".csv";
    var filePath3 = workingDir + "\\gh-" + "deskGlare" + ".csv";
    var filePath4 = workingDir + "\\gh-" + "actuation" + ".csv";
    var filePath5 = workingDir + "\\gh-" + "seasonalCoefficients" + ".csv";
    var filePath6 = workingDir + "\\gh-" + "permKron" + ".csv";

    System.Text.StringBuilder csv1 = new System.Text.StringBuilder();
    System.Text.StringBuilder csv2 = new System.Text.StringBuilder();
    System.Text.StringBuilder csv3 = new System.Text.StringBuilder();
    System.Text.StringBuilder csv4 = new System.Text.StringBuilder();
    System.Text.StringBuilder csv5 = new System.Text.StringBuilder();
    System.Text.StringBuilder csv6 = new System.Text.StringBuilder();


    //Normalization of trees
    if (statNorm)
    {
      NormalizeDatatree(tree_output1, minNorm, maxNorm);
      NormalizeDatatree(tree_output2, minNorm, maxNorm);
      NormalizeDatatree(tree_output3, minNorm, maxNorm);
    }

    //write actuation file------------------------------------------------------------------------------
    for (int j = 0;j < gact.NodeCount;j++)
    {
      var newline = string.Format("{0},{1}", gact.Nodes[j][0].ToString(), gact.Nodes[j][1].ToString());
      csv4.AppendLine(newline);
    }

    //write seasonal coefficients file-------------------------------------------------------------------
    for (int i = 0;i < ncoef;i++)
    {
      for (int j = 0;j < tree_output4.Branch(i).Count;j++)
      {
        var newline = string.Format("{0}", tree_output4.Branch(i)[j].ToString());
        csv5.AppendLine(newline);
      }
    }

    //write geometric param file------------------------------------------------------------------------
    for (int j = 0;j < listkron.Count;j++)
    {
      var newline = string.Format("{0}", listkron[j]);
      csv6.AppendLine(newline);
    }

    //write shade, view & glare csv files---------------------------------------------------------------
    for (int i = 0;i < nb;i++)
    {

      //populate shade files
      string newline1 = "";
      for (int j = 0;j < tree_output1.Branch(i).Count;j++)
      {
        if (j + 1 < tree_output1.Branch(i).Count)
        {
          newline1 += tree_output1.Branch(i)[j].ToString() + ",";
        }
        else
        {
          newline1 += tree_output1.Branch(i)[j].ToString();
        }
      }
      csv1.AppendLine(newline1);

      //populate view files
      string newline2 = "";
      for (int j = 0;j < tree_output1.Branch(i).Count;j++)
      {
        if (j + 1 < tree_output1.Branch(i).Count)
        {
          newline2 += tree_output2.Branch(i)[0].ToString() + ",";
        }
        else
        {
          newline2 += tree_output2.Branch(i)[0].ToString();
        }
      }
      csv2.AppendLine(newline2);

      //populate glare files
      string newline3 = "";
      for (int j = 0;j < tree_output3.Branch(i).Count;j++)
      {
        if (j + 1 < tree_output3.Branch(i).Count)
        {
          newline3 += tree_output3.Branch(i)[j].ToString() + ",";
        }
        else
        {
          newline3 += tree_output3.Branch(i)[j].ToString();
        }
      }
      csv3.AppendLine(newline3);
    }

    System.IO.File.WriteAllText(filePath1, csv1.ToString());
    System.IO.File.WriteAllText(filePath2, csv2.ToString());
    System.IO.File.WriteAllText(filePath3, csv3.ToString());
    System.IO.File.WriteAllText(filePath4, csv4.ToString());
    System.IO.File.WriteAllText(filePath5, csv5.ToString());
    System.IO.File.WriteAllText(filePath6, csv6.ToString());


    //GH OUTPUT COMMENTS
    Print("OUTPUT DIR : " + workingDir);
    Print("PROCESS EXIT");
# ---------- c_script_7: C# additional code ----------
  private static DataTree<double> NormalizeDatatree(DataTree < double > tree, double min, double max)
  {
    double treemax = tree.AllData().Max();
    double treemin = tree.AllData().Min();
    double range = treemax - treemin;

    for (int i = 0;i < tree.BranchCount;i++)
    {
      var currentBrancha = new double[tree.Branch(i).Count];
      tree.Branch(i).CopyTo(currentBrancha);
      tree.Branch(i).Clear();
      tree.Branch(i).AddRange(NormalizeList(ArrayToList(currentBrancha), treemin, treemax, min, max));
    }

    return tree;
  }


  private static List<double> NormalizeList(List<double> data, double glmin, double glmax, double min, double max)
  {
    double dataMax = glmax;
    double dataMin = glmin;
    double range = dataMax - dataMin;

    return data
      .Select(d => (d - dataMin) / range)
      .Select(n => (double) ((1 - n) * min + n * max))
      .ToList();
  }

  private static List<double> ArrayToList(double[] data)
  {
    List<double> datalist = new List<double>(data.Length);
    for (int i = 0;i < data.Length;i++)
    {
      datalist.Add(data[i]);
    }
    return datalist;
  }
# ---------- end c_script_7 ----------
panel_11 = Panel(c_script_7)

matlab_exe_work = FilePath("C:\Program Files\MATLAB\R2016b\bin\matlab.exe")
# Launch Matlab analysis
workingdir = FilePath(path)
concat = Concatenate(FragmentA=workingdir, FragmentB="optimization.m")
lanch = Button()
panel_12 = Panel(workingdir)
c_script_8 = CSharpScript(path_to_m=concat, path_to_exe=matlab_exe_work, launch=lanch)  # -> out, A; inputs path_to_exe: String, launch: Boolean
# ---------- c_script_8: C# ----------
    string pathtoexe = (string) path_to_exe;
    string pathtofile = (string) path_to_m;

    string dir = System.IO.Path.GetDirectoryName(path_to_m.ToString());
    string filename = System.IO.Path.GetFileName(path_to_m.ToString());


    if (launch)
    {
      System.Diagnostics.Process p = new System.Diagnostics.Process();

      p.StartInfo.FileName = pathtoexe;
      p.StartInfo.WorkingDirectory = dir + "\\";
      p.StartInfo.Arguments = "/wait /nodisplay /nojvm /nosplash /nodesktop /r \"try, run('" + pathtofile + "\"'),catch,exit,end,exit\"";
      p.StartInfo.Verb = "runas";

      p.Start();
      p.WaitForExit();


    }
    //GH OUTPUT COMMENTS
    Print("MATLAB EXE : " + path_to_exe);
    Print("SCRIPT DIR : " + dir);
    Print("SCRIPT FILE : " + filename);
    Print("PROCESS EXIT");
# ---------- end c_script_8 ----------
panel_13 = Panel(c_script_8.out)

workingdir_2 = FilePath(path)
concat_2 = Concatenate(FragmentA=workingdir_2, FragmentB="bounds.csv")
window_area_2 = Number(mplane.Area)
num_3 = Number([Slider(0, range=0..1), window_area_2])
num_4 = Number([Slider(0, range=0..1), Slider(1, range=0..10)])
c_script_9 = CSharpScript()  # -> out, A; inputs x: Double; same code as c_script_6
mesh_7 = Mesh(mesh_6)
desk = Mesh(tri_7.Mesh)
vec_8 = Vector(facen.Normals)
toggle = BooleanToggle(True)
panel_14 = Panel(c_script_9.A)
refine_8 = Refine(Mesh=mesh_7, Level=Slider(4, range=0..10))
medges_8 = MeshEdges(Mesh=refine_8)  # -> NakedEdges, InteriorEdges, NonManifoldEdges
d1_directglare_summer = ValueList({"0", "1", "2", "3"}, selected="0")
d0_view_summer = ValueList({"0", "1", "2", "3", "4", "5"}, selected="4")

grid_4 = Grid(grid_2.Grid)
slider = GridSlider(grid=grid_4, D0=d0_view_summer, D1=d1_directglare_summer)  # -> Info, ActivePoint, ActiveCell
node_index = NodeIndexFromAddress(Grid=grid_4, Address=slider.ActivePoint)
grid_node = GridNode(Grid=grid_4, NodeIndex=node_index)
panel_15 = Panel(grid_node)
# Visualize data
node_prop = NodeProperties(Node=grid_node)  # -> NodeIndex, Coordinates, NormalizedCoordinates, AddressTuple
panel_16 = Panel(node_prop.NodeIndex)

workingdir_3 = FilePath(path)
concat_3 = Concatenate(FragmentA=workingdir_3, FragmentB="outMatlab.csv")
toggle_2 = BooleanToggle(True)
grid_5 = Grid(grid.Grid)
c_script_10 = CSharpScript(
    path=concat_3,
    gAct=grid_5,
    run=toggle_2,
    Reference="C:\Users\Victor Charpentier\AppData\Roaming\Grasshopper\Libraries\IvyCore.dll")  # -> out, A; inputs path: String
# ---------- c_script_10: C# ----------
    var filePath = (string) path;
    var gridAct = (IvyCore.Parametric.Grid) gAct;
    var runIt = (bool) run;

    if (!runIt){return;}

    var reader = new StreamReader(filePath);
    var field = new DataTree<string>();

    var ndof = gridAct.Dim;


    while (!reader.EndOfStream)
    {
      var line = reader.ReadLine();
      var values = line.Split(',');
      var ncomb = values.Length / ndof;

      for (int i = 0;i < ncomb;i++)
      {
        field.Add(string.Format("{0},{1}", values[i * ndof].ToString(), values[i * ndof + 1].ToString()), new GH_Path(i));
      }

    }

    A = field;
# ---------- end c_script_10 ----------
viewer = ParamViewer(c_script_10.A)
item_8 = ListItem(List=viewer, Index=node_prop.NodeIndex, Wrap=True)
branch = TreeBranch(Tree=c_script_10.A, Path=item_8, MaintainPaths=True)
window_height = Number(addition)
window_normal = Vector(facen.Normals)
crv = Curve(move.Geometry)
split = TextSplit(Text=branch, Separators=",")
item_9 = ListItem(List=split, Index=0, Wrap=True)  # -> flatten(Item)
item_10 = ListItem(List=split, Index=1, Wrap=True)  # -> flatten(Item)
top_rolling_shade = CSharpScript(
    act1=item_9,
    act2=item_10,
    hwindow=window_height,
    N=window_normal,
    tedge=crv,
    Reference="C:\USERS\VICTOR CHARPENTIER\APPDATA\ROAMING\GRASSHOPPER\LIBRARIES\IvyCore.dll")  # -> out, V, S; inputs act1: list of Double, act2: list of Double, hwindow: Double, N: Vector3d, tedge: Curve
# ---------- top_rolling_shade: C# ----------
    var normal = (Vector3d) N;
    var hwin = (double) hwindow;
    var Act1 = (List<double>) act1;
    var Act2 = (List<double>) act2;
    var top = (Curve) tedge;

    var surf = new List<GH_Surface>();

    var nn = Act1.Count;
    var vec = new List<Vector3d>();
    var origin = new Point3d(0.0, 0.0, 0.0);
    var rotaxis = Vector3d.CrossProduct(normal, new Vector3d(0.0, 0.0, -1.0));

    for (int i = 0;i < nn;i++)
    {
      var ag = -Math.PI * Act1[i] / 180;
      var ext = Act2[i];

      var current_vec = new Vector3d(0.0, 0.0, -1.0);

      current_vec.Transform(Transform.Rotation(ag, rotaxis, origin));
      current_vec = ext * (hwin) * current_vec;

      var current_surf = Rhino.Geometry.Extrusion.CreateExtrusion(top, current_vec);

      vec.Add(current_vec);
      surf.Add(new Grasshopper.Kernel.Types.GH_Surface(current_surf));

    }

    V = vec;
    S = surf;
# ---------- end top_rolling_shade ----------
srf = Surface(top_rolling_shade.S)

c_script_11 = CSharpScript(
    path=concat_2,
    Ncriteria="3",
    run=toggle_2,
    Reference="C:\Users\Victor Charpentier\AppData\Roaming\Grasshopper\Libraries\IvyCore.dll")  # -> out, A; inputs path: String, Ncriteria: Int32
# ---------- c_script_11: C# ----------
    var filePath = (string) path;
    var ncrit = (int) Ncriteria;
    var runIt = (bool) run;

    if (!runIt){return;}

    var reader = new StreamReader(filePath);
    var field = new DataTree<string>();



    while (!reader.EndOfStream)
    {
      var line = reader.ReadLine();
      var values = line.Split(',');
      var ncomb = values.Length / 2;

      Print(values.Length.ToString());

      for (int i = 0;i < ncomb;i++)
      {
        field.Add(string.Format("{0},{1}", values[i * 2].ToString(), values[i * 2 + 1].ToString()), new GH_Path(i));
      }

    }

    A = field;
# ---------- end c_script_11 ----------
viewer_2 = ParamViewer(c_script_11.A)

number_slider_10 = Slider(1, range=0..2385)
item_11 = ListItem(List=num_2, Index=number_slider_10, Wrap=True)  # -> simplify(Item)
item_12 = ListItem(List=vec_5, Index=number_slider_10, Wrap=True)  # -> simplify(Item)
item_13 = ListItem(List=srf, Index=number_slider_10, Wrap=True)
vdis_2 = VectorDisplay(Anchor=facen.Centers, Vector=item_12)
c_script_12 = CSharpScript(x=item_11)  # -> out, A; inputs x: Double; same code as c_script_6
panel_17 = Panel(c_script_12.A)

item_14 = ListItem(List=viewer_2, Index=number_slider_10, Wrap=True)
branch_2 = TreeBranch(Tree=c_script_11.A, Path=item_14, MaintainPaths=True)
item_15 = ListItem(List=branch_2, Index="2", Wrap=True)
item_16 = ListItem(List=branch_2, Index="0", Wrap=True)
item_17 = ListItem(List=branch_2, Index="1", Wrap=True)
split_2 = TextSplit(Text=item_16, Separators=",")
split_3 = TextSplit(Text=item_17, Separators=",")
split_4 = TextSplit(Text=item_15, Separators=",")
item_18 = ListItem(List=item_10, Index=number_slider_10, Wrap=True)
item_19 = ListItem(List=item_9, Index=number_slider_10, Wrap=True)
panel_18 = Panel(item_19)
panel_19 = Panel(item_18)
refine_9 = Refine(Mesh=item_13, Level=Slider(3, range=0..10))
shadeassess = ShadeAssessment(WindowPanelMesh=refine_8, ShadeModuleMesh=refine_9, ProjectionVector=item_12, LaunchTheAnalysis=toggle)  # -> MeshOfExposedWindowsSurface, AreaOfExposed, CommentOnOperationType, DebugMeshcutter, DebugHull
shadeassess_2 = ShadeAssessment(WindowPanelMesh=refine_8, ShadeModuleMesh=refine_9, ProjectionVector=vec_8, LaunchTheAnalysis=toggle)  # -> MeshOfExposedWindowsSurface, AreaOfExposed, CommentOnOperationType, DebugMeshcutter, DebugHull
mesh_8 = Mesh(shadeassess.MeshOfExposedWindowsSurface)
glareassess = GlareOnWallPanel(WallPanel=desk, SourceOutline=mesh_8, ProjectionDirectionVector=item_12, LaunchTheAnalysis=toggle)  # -> MeshOfGlareOnTheWallPanel, AreaOfGlareOnTheWallPanel, CommentOnOperationType, DebugMeshcutter
mesh_9 = Mesh(glareassess.MeshOfGlareOnTheWallPanel)
mesh_10 = Mesh(shadeassess_2.MeshOfExposedWindowsSurface)

# ----
# Shade
# View
# Glare in room
# Glare on Desk
multiplication_8 = Multiplication(A=vec_5, B=-1)
wall_left = Mesh(tri_5.Mesh)
back_wall = Mesh(tri_4.Mesh)
floor = Mesh(tri_2.Mesh)
wall_right = Mesh(tri_3.Mesh)
vec_9 = Vector(multiplication_8)
desk_2 = Mesh(tri_7.Mesh)
mesh_11 = Mesh(mesh_6)
mesh_12 = Mesh(mesh_2)
vec_10 = Vector(multiplication_8)
vec_11 = Vector(facen.Normals)
shadeassess_3 = ShadeAssessment(WindowPanelMesh=mesh_11, ShadeModuleMesh=mesh_12, ProjectionVector=vec_10, LaunchTheAnalysis=Toggle(False))  # -> MeshOfExposedWindowsSurface, AreaOfExposed, CommentOnOperationType, DebugMeshcutter, DebugHull
source = Mesh(shadeassess_3.MeshOfExposedWindowsSurface)
shadeassess_4 = ShadeAssessment(WindowPanelMesh=mesh_11, ShadeModuleMesh=mesh_12, ProjectionVector=vec_11, LaunchTheAnalysis=Toggle(True))  # -> MeshOfExposedWindowsSurface, AreaOfExposed, CommentOnOperationType, DebugMeshcutter, DebugHull
mesh_13 = Mesh(shadeassess_3.MeshOfExposedWindowsSurface)
mesh_14 = Mesh(shadeassess_4.MeshOfExposedWindowsSurface)
num_5 = Number(shadeassess_3.AreaOfExposed)
c_script_13 = CSharpScript(x=num_5)  # -> out, A; inputs x: tree of Double
# ---------- c_script_13: C# ----------
    var t = (DataTree<double>) x;
    bool output = false;

    if (t.BranchCount >= 1) {output = true;}

    A = output;
# ---------- end c_script_13 ----------
c_script_14 = CSharpScript(x=num_5)  # -> out, A; inputs x: tree of Double; same code as c_script_13
glareassess_2 = GlareOnWallPanel(WallPanel=desk_2, SourceOutline=source, ProjectionDirectionVector=vec_9, LaunchTheAnalysis=c_script_14.A)  # -> MeshOfGlareOnTheWallPanel, AreaOfGlareOnTheWallPanel, CommentOnOperationType, DebugMeshcutter
num_6 = Number(shadeassess_4.AreaOfExposed)

# ---- group: wall 1
glareassess_3 = GlareOnWallPanel(WallPanel=wall_right, SourceOutline=source, ProjectionDirectionVector=vec_9, LaunchTheAnalysis=c_script_13.A)  # -> MeshOfGlareOnTheWallPanel, AreaOfGlareOnTheWallPanel, CommentOnOperationType, DebugMeshcutter; disabled

# ----
mesh_15 = Mesh(glareassess_2.MeshOfGlareOnTheWallPanel)
num_7 = Number(glareassess_2.AreaOfGlareOnTheWallPanel)

c_script_15 = CSharpScript(x=glareassess_3.AreaOfGlareOnTheWallPanel)  # -> out, A; inputs x: tree of Double; same code as c_script_13

# ---- group: Wall 2
glareassess_4 = GlareOnWallPanel(WallPanel=wall_left, SourceOutline=source, ProjectionDirectionVector=vec_9, LaunchTheAnalysis=c_script_15.A)  # -> MeshOfGlareOnTheWallPanel, AreaOfGlareOnTheWallPanel, CommentOnOperationType, DebugMeshcutter; disabled

# ----
c_script_16 = CSharpScript(x=glareassess_4.AreaOfGlareOnTheWallPanel)  # -> out, A; inputs x: tree of Double; same code as c_script_13

# ---- group: Floor
glareassess_5 = GlareOnWallPanel(WallPanel=floor, SourceOutline=source, ProjectionDirectionVector=vec_9, LaunchTheAnalysis=c_script_16.A)  # -> MeshOfGlareOnTheWallPanel, AreaOfGlareOnTheWallPanel, CommentOnOperationType, DebugMeshcutter; disabled

# ----
c_script_17 = CSharpScript(x=glareassess_5.AreaOfGlareOnTheWallPanel)  # -> out, A; inputs x: tree of Double; same code as c_script_13

# ---- group: back wall
glareassess_6 = GlareOnWallPanel(WallPanel=back_wall, SourceOutline=source, ProjectionDirectionVector=vec_9, LaunchTheAnalysis=c_script_17.A)  # -> MeshOfGlareOnTheWallPanel, AreaOfGlareOnTheWallPanel, CommentOnOperationType, DebugMeshcutter; disabled

# ----
addition_6 = Addition(
    A=glareassess_3.AreaOfGlareOnTheWallPanel,
    B=glareassess_4.AreaOfGlareOnTheWallPanel,
    C=glareassess_5.AreaOfGlareOnTheWallPanel,
    D=glareassess_6.AreaOfGlareOnTheWallPanel)  # disabled
num_8 = Number(addition_6)  # disabled

number_slider_11 = Slider(0, range=0..2442)
number_slider_12 = Slider(22, range=0..39)
item_20 = ListItem(List=mesh_14, Index=number_slider_11, Wrap=True)
# Debug
c_script_18 = CSharpScript(x=mesh_13)  # -> out, A, B, C, D; inputs x: tree of Mesh
# ---------- c_script_18: C# ----------
    var msh = (DataTree<Mesh>) x;
    var nb = x.BranchCount;

    var invalidReportBool = new DataTree<bool>();
    var invalidReportString = new DataTree<string>();
    var countInvalid = 0;
    var itemInvalid = new List<string>();
    

    for (int i = 0;i < nb;i++)
    {
      var shadePath = new GH_Path(i);
      for (int j = 0;j < x.Branch(i).Count;j++)
      {
        if (!x.Branch(i)[j].IsValid)
        {
          invalidReportBool.Add(false, shadePath);
          invalidReportString.Add("mesh " + i.ToString() + " is invalid for the sun vector  " + j.ToString(), shadePath);
          countInvalid += 1;
          itemInvalid.Add("mesh "+i.ToString()+", vsun "+j.ToString());
        }
        else
        {
          invalidReportBool.Add(true, shadePath);
          invalidReportString.Add("valid mesh " + i.ToString() + ", vsun " + j.ToString(), shadePath);
        }
      }

    }

    A = invalidReportBool;
    B = invalidReportString;
    C = countInvalid;
    D = itemInvalid;
# ---------- end c_script_18 ----------
item_21 = ListItem(List=vec_5, Index=number_slider_11, Wrap=True)
viewer_3 = ParamViewer(mesh_14)
item_22 = ListItem(List=viewer_3, Index=number_slider_12, Wrap=True)
branch_3 = TreeBranch(Tree=mesh_14, Path=item_22, MaintainPaths=True)
branch_4 = TreeBranch(Tree=glareassess_4.MeshOfGlareOnTheWallPanel, Path=item_22, MaintainPaths=True)
branch_5 = TreeBranch(Tree=glareassess_5.MeshOfGlareOnTheWallPanel, Path=item_22, MaintainPaths=True)
branch_6 = TreeBranch(Tree=glareassess_6.MeshOfGlareOnTheWallPanel, Path=item_22, MaintainPaths=True)
panel_21 = Panel(c_script_18.C)
item_23 = ListItem(List=mesh_2, Index=number_slider_12, Wrap=True)
item_24 = ListItem(List=branch_3, Index=number_slider_11, Wrap=True)
projecta = ProjectAlong(Geometry=item_23, Plane=rotate.Geometry, Direction=item_21)  # -> Geometry, Transform
item_25 = ListItem(List=branch_4, Index=number_slider_11, Wrap=True)
item_26 = ListItem(List=branch_5, Index=number_slider_11, Wrap=True)
medges_9 = MeshEdges(Mesh=item_20)  # -> NakedEdges, InteriorEdges, NonManifoldEdges
item_27 = ListItem(List=branch_6, Index=number_slider_11, Wrap=True)
vdis_3 = VectorDisplay(Anchor=facen.Centers, Vector=item_21)
preview_5 = CustomPreview(Geometry=item_23, Shader=ColourSwatch(SwatchColor=RGBA(0, 63, 117, 114)))
preview_6 = CustomPreview(Geometry=[item_24, item_25, item_26, item_27], Shader=ColourSwatch(SwatchColor=RGBA(41, 41, 41, 107)))

medges_10 = MeshEdges(Mesh=item_24)  # -> NakedEdges, InteriorEdges, NonManifoldEdges
preview_7 = CustomPreview(
    Geometry=[medges_10.NakedEdges, medges_10.InteriorEdges],
    Shader={ambient=RGB(0, 0, 0), diffuse=RGB(255, 105, 180), emission=RGB(76, 32, 54), shine=0.5, specular=RGB(255, 255, 255), transparency=0})

workingdir_4 = FilePath(path)
concat_4 = Concatenate(FragmentA=workingdir_4, FragmentB="optValCriteria.csv")
c_script_19 = CSharpScript(
    path=concat_4,
    Ncriteria="3",
    run=toggle_2,
    Reference="C:\Users\Victor Charpentier\AppData\Roaming\Grasshopper\Libraries\IvyCore.dll")  # -> out, A; inputs path: String, Ncriteria: Int32
# ---------- c_script_19: C# ----------
    var filePath = (string) path;
    var ncrit = (int) Ncriteria;
    var runIt = (bool) run;

    if (!runIt){return;}

    var reader = new StreamReader(filePath);
    var field = new DataTree<string>();



    while (!reader.EndOfStream)
    {
      var line = reader.ReadLine();
      var values = line.Split(',');
      var ncomb = values.Length / ncrit;

      Print(values.Length.ToString());

      for (int i = 0;i < ncomb;i++)
      {
        field.Add(string.Format("{0},{1},{2}", values[i * ncrit].ToString(), values[i * ncrit + 1].ToString(), values[i * ncrit + 2].ToString()), new GH_Path(i));
      }

    }

    A = field;
# ---------- end c_script_19 ----------
branch_7 = TreeBranch(Tree=c_script_19.A, Path=item_8, MaintainPaths=True)
split_5 = TextSplit(Text=branch_7, Separators=",")
item_28 = ListItem(List=split_5, Index=0, Wrap=True)  # -> flatten(Item)
item_29 = ListItem(List=split_5, Index=2, Wrap=True)  # -> flatten(Item)
item_30 = ListItem(List=split_5, Index=1, Wrap=True)  # -> flatten(Item)

c_script_20 = CSharpScript(x=item_28, minmax=split_2, bounds=num_3)  # -> out, A; inputs x: list of Double, minmax: list of Double, bounds: list of Double
# ---------- c_script_20: C# ----------
    var raw = (List<double>) x;
    var mm = (List<double>) minmax;
    var bd = (List<double>) bounds;


    var maxRaw = mm[1];
    var minRaw = mm[0];

    var norm = new List<double>();

    for (int i = 0;i < raw.Count;i++)
    {
      var current_norm = (bd[1] - bd[0]) * (raw[i] - minRaw) / (maxRaw - minRaw) + bd[0];
      norm.Add(current_norm);
    }

    A = norm;
# ---------- end c_script_20 ----------
c_script_21 = CSharpScript(x=item_30, minmax=split_3, bounds=num_3)  # -> out, A; inputs x: list of Double, minmax: list of Double, bounds: list of Double; same code as c_script_20
c_script_22 = CSharpScript(x=item_29, minmax=split_4, bounds=num_4)  # -> out, A; inputs x: list of Double, minmax: list of Double, bounds: list of Double
# ---------- c_script_22: C# ----------
    var raw = (List<double>) x;
    var mm = (List<double>) minmax;
    var bd = (List<double>) bounds;
 

    var maxRaw = mm[1];
    var minRaw = mm[0];

    var norm = new List<double>();

    for (int i = 0;i < raw.Count;i++)
    {
      var current_norm = (bd[1] - bd[0]) * (raw[i] - minRaw) / (maxRaw - minRaw) + bd[0];
      norm.Add(current_norm);
    }

    A = norm;
# ---------- end c_script_22 ----------

item_31 = ListItem(List=c_script_20.A, Index=number_slider_10, Wrap=True)  # -> simplify(Item)
item_32 = ListItem(List=c_script_21.A, Index=number_slider_10, Wrap=True)  # -> simplify(Item)
item_33 = ListItem(List=c_script_22.A, Index=number_slider_10, Wrap=True)  # -> simplify(Item)

panel_22 = Panel(item_30)
panel_23 = Panel(c_script_21.A)

cos_facade_sun_2 = Number(dprod)
window_area_3 = Number(mplane.Area)
desk_area_2 = Number(area_2.Area)
item_34 = ListItem(List=cos_facade_sun_2, Index=number_slider_10, Wrap=True)
panel_24 = Panel(item_31)
panel_25 = Panel(item_32)
panel_26 = Panel(item_33)
multiplication_9 = Multiplication(A=shadeassess.AreaOfExposed, B=item_34)  # -> simplify(Result)
division_9 = Division(A=glareassess.AreaOfGlareOnTheWallPanel, B=desk_area_2)  # -> simplify(Result)
division_10 = Division(A=shadeassess_2.AreaOfExposed, B=window_area_3)
panel_27 = Panel(multiplication_9)
panel_28 = Panel(division_10)
panel_29 = Panel(division_9)
expression_2 = Expression(x=panel_27, y=panel_24, Expression="100*(y-x)/x")
expression_3 = Expression(x=panel_28, y=panel_25, Expression="100*(y-x)/x")
expression_4 = Expression(x=panel_29, y=panel_26, Expression="100*(y-x)/x")
percentage_of_difference = Panel(expression_2)

subtraction_2 = Subtraction(A=panel_24, B=panel_27)
subtraction_3 = Subtraction(A=panel_25, B=panel_28)
subtraction_4 = Subtraction(A=panel_26, B=panel_29)
percentage_of_difference_2 = Panel(expression_3)
percentage_of_difference_3 = Panel(expression_4)
difference = Panel(subtraction_3)
difference_2 = Panel(subtraction_2)
difference_3 = Panel(subtraction_4)
