# Grasshopper definition room_simpleShade_reader.gh (Grasshopper 0.9.76)
# plug-ins: Kangaroo Components, IvyGh, SunTools

number_slider = Slider(4, range=0..10)
number_slider_2 = Slider(2.2, range=0..10)
division = Division(A=number_slider_2, B=-2)
division_2 = Division(A=number_slider_2, B=2)
division_3 = Division(A=number_slider, B=-2)
division_4 = Division(A=number_slider, B=2)
pi = Pi(Factor=2)
rad = Radians(Degrees=Slider(105, range=90..270))
yz = YZPlane(Origin=Point(0, 0, 0))
subtraction = Subtraction(A=pi, B=rad)
dom = ConstructDomain(DomainStart=division, DomainEnd=division_2)
dom_2 = ConstructDomain(DomainStart=division_3, DomainEnd=division_4)
rotate = Rotate(Geometry=yz, Angle=subtraction, Plane=PlaneXY(0, 0, 0))  # -> Geometry, Transform
number_slider_3 = Slider(1, range=0..1)
rectangle = Rectangle(Plane=rotate.Geometry, XSize=dom_2, YSize=dom, Radius=0)  # -> Rectangle, Length
mplane = MeshPlane(Boundary=rectangle.Rectangle, WidthCount=number_slider_3, HeightCount=number_slider_3)  # -> Mesh, Area
facen = FaceNormals(Mesh=mplane.Mesh)  # -> Centers, Normals
refine = Refine(Mesh=mplane.Mesh, Level=Slider(3, range=0..10))

# ---- group: ROOM
number_slider_4 = Slider(0.5, range=0..1)
normal_window = Vector(facen.Normals)
mesh = Mesh(mplane.Mesh)
medges = MeshEdges(Mesh=mesh)  # -> NakedEdges, InteriorEdges, NonManifoldEdges
unit = UnitVector(Vector=normal_window)
multiplication = Multiplication(A=number_slider_4, B=-1)
# Room geometry
item = ListItem(List=medges.NakedEdges, Index="1", Wrap=True)
multiplication_2 = Multiplication(A=unit, B=Slider(0, range=-1..0))
Z = UnitZ(Factor=multiplication)
multiplication_3 = Multiplication(A=unit, B=Slider(-5, range=-10..-1))
addition = Addition(A=multiplication_2, B=Z)
move = Move(Geometry=item, Motion=addition)  # -> Geometry, Transform
multiplication_4 = Multiplication(A=number_slider_4, B=2)
end = EndPoints(Curve=move.Geometry)  # -> Start, End
addition_2 = Addition(A=number_slider_2, B=multiplication_4)
move_2 = Move(Geometry=end.Start, Motion=multiplication_3)  # -> Geometry, Transform
move_3 = Move(Geometry=end.End, Motion=multiplication_3)  # -> Geometry, Transform
Z_2 = UnitZ(Factor=addition_2)
pt = Point(end.Start)
move_4 = Move(Geometry=pt, Motion=Z_2)  # -> Geometry, Transform
pt_2 = Point(move_2.Geometry)
move_5 = Move(Geometry=pt_2, Motion=Z_2)  # -> Geometry, Transform
pt_3 = Point(end.End)
move_6 = Move(Geometry=pt_3, Motion=Z_2)  # -> Geometry, Transform
pt_4 = Point(move_3.Geometry)
move_7 = Move(Geometry=pt_4, Motion=Z_2)  # -> Geometry, Transform
c_script = CSharpScript(A=pt, B=pt_2, C=pt_4, D=pt_3)  # -> out, mesh, edges, plane; inputs A: Point3d, B: Point3d, C: Point3d, D: Point3d
# ---------- c_script: C# ----------
    var p1 = (Point3d) A;
    var p2 = (Point3d) B;
    var p3 = (Point3d) C;
    var p4 = (Point3d) D;
    List < Point3d > vert = new List<Point3d>(){p1,p2,p3,p4};

    var f1 = new Rhino.Geometry.MeshFace(0, 1, 2, 3);
    var m1 = new Rhino.Geometry.Mesh();
    var pl1 = new Rhino.Geometry.Plane(p1, p2, p4);

    m1.Vertices.AddVertices(vert);
    m1.Faces.AddFace(f1);

    var e1 = new List<Polyline>(m1.GetNakedEdges());

    mesh = m1;
    plane = pl1;
    edges = e1;
# ---------- end c_script ----------
c_script_2 = CSharpScript(A=pt, B=pt_2, C=move_5.Geometry, D=move_4.Geometry)  # -> out, mesh, edges, plane; inputs A: Point3d, B: Point3d, C: Point3d, D: Point3d; same code as c_script
c_script_3 = CSharpScript(A=pt_2, B=pt_4, C=move_7.Geometry, D=move_5.Geometry)  # -> out, mesh, edges, plane; inputs A: Point3d, B: Point3d, C: Point3d, D: Point3d; same code as c_script
c_script_4 = CSharpScript(A=pt_3, B=pt_4, C=move_7.Geometry, D=move_6.Geometry)  # -> out, mesh, edges, plane; inputs A: Point3d, B: Point3d, C: Point3d, D: Point3d; same code as c_script
number_slider_5 = Slider(4, range=0..10)
mjoin = MeshJoin(Meshes=[c_script.mesh, c_script_2.mesh, c_script_3.mesh, c_script_4.mesh])
refine_2 = Refine(Mesh=c_script_4.mesh, Level=number_slider_5)
refine_3 = Refine(Mesh=c_script.mesh, Level=number_slider_5)
refine_4 = Refine(Mesh=c_script_2.mesh, Level=number_slider_5)
refine_5 = Refine(Mesh=c_script_3.mesh, Level=number_slider_5)
medges_2 = MeshEdges(Mesh=mjoin)  # -> NakedEdges, InteriorEdges, NonManifoldEdges
tri = Triangulate(Mesh=refine_3)  # -> Mesh, Count
tri_2 = Triangulate(Mesh=refine_4)  # -> Mesh, Count
tri_3 = Triangulate(Mesh=refine_5)  # -> Mesh, Count
tri_4 = Triangulate(Mesh=refine_2)  # -> Mesh, Count
preview = CustomPreview(
    Geometry=[medges.NakedEdges, medges_2.NakedEdges, medges_2.InteriorEdges],
    Shader=ColourSwatch(SwatchColor=RGBA(0, 0, 0, 41)))

# ----
rad_2 = Radians(Degrees=Slider(3, range=0..10))
# Window geometry
number_slider_6 = Slider(6, range=1..3000)

# ---- group: direct radiation data
num = Number([0, 0, 0, 0, 0, 0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])

# ----
series = Series(Start=Slider(1128, range=0..3578), Step=1, Count=number_slider_6)

# ----
# Sun Vectors
X = UnitX(Factor=1)
azi = Number([126.3264092, 137.3313031, 149.9081719, 164.0725822, 179.3051332, 194.5902344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])
ele = Number([5.239618324, 13.76930373, 20.56615289, 25.05155863, 26.71385892, 25.32899458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])
num_2 = Number([8, 9, 10, 11, 12, 13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])
sunsifting = SiftSunOrientations(
    North=X,
    SunAzimuth=azi,
    SunAltitude=ele,
    AssociatedSunHours=num_2,
    FaçadePanelToEvaluate=mplane.Mesh,
    AngleToleranceInRad=rad_2)  # -> ResultingSiftedSunAzimuthAngles, ResultingSiftedSunAltitudeAngles, ResultingSiftedHours, ResultingSuftedSunVectors
item_2 = ListItem(List=sunsifting.ResultingSuftedSunVectors, Index=series, Wrap=True)  # -> simplify(Item)

item_3 = ListItem(List=sunsifting.ResultingSiftedHours, Index=series, Wrap=True)  # -> simplify(Item)

vec = Vector(normal_window)
unit_2 = UnitVector(Vector=vec)
# Desk
area = Area(Geometry=c_script.mesh)  # -> Area, Centroid
Z_3 = UnitZ(Factor=Slider(0.8, range=0..1))
xprod = CrossProduct(VectorA=vec, VectorB=Z_3, Unitize=True)  # -> Vector, Length
vec_2 = Vector(xprod.Vector)
multiplication_5 = Multiplication(A=unit_2, B="1")
multiplication_6 = Multiplication(A=vec_2, B="-0.5")
addition_3 = Addition(A=multiplication_5, B=multiplication_6)
scale = Scale(Geometry=c_script.mesh, Center=area.Centroid, Factor=Slider(0.27, range=0.001..1))  # -> Geometry, Transform
addition_4 = Addition(A=Z_3, B=addition_3)
move_8 = Move(Geometry=scale.Geometry, Motion=addition_4)  # -> Geometry, Transform

vdis = VectorDisplay(Anchor=facen.Centers, Vector=item_2)
vec_3 = Vector(sunsifting.ResultingSuftedSunVectors)
num_3 = Number(sunsifting.ResultingSiftedHours)
tri_5 = Triangulate(Mesh=refine)  # -> Mesh, Count
item_4 = ListItem(List=num_3, Index=0, Wrap=True)
c_script_5 = CSharpScript(x=item_4)  # -> out, A; inputs x: Double
# ---------- c_script_5: C# ----------
    var hour = (double) x;

    var day = Math.Floor(hour / 24);

    var monthLengthArray = new int[12]{31,29,31,30,31,30,31,31,30,31,30,31};
    string[] monthNames = {"January","February","March","April","May","June","July","August","September","October","November","December"};

    var monthIndex = 0;
    for (int i = 0;i < 12;i++)
    {
      if (day > monthLengthArray.Take(i).Sum() - 1)
      {
        monthIndex = i;
      }
    }

    var currentMonth = monthNames[monthIndex];
    var currentDay = day - monthLengthArray.Take(monthIndex).Sum() + 1;
    var currentHour = hour - day * 24;

    string currentDayFull = currentMonth + " " + currentDay.ToString() + " " + currentHour.ToString() + ":00";

    A = currentDayFull;
# ---------- end c_script_5 ----------
preview_2 = CustomPreview(Geometry=mplane.Mesh, Shader=ColourSwatch(SwatchColor=RGBA(140, 209, 255, 142)))
mesh_2 = Mesh(tri_5.Mesh)
panel = Panel(num_3)
medges_3 = MeshEdges(Mesh=mesh_2)  # -> NakedEdges, InteriorEdges, NonManifoldEdges
panel_2 = Panel(c_script_5.A)
xy = XYPlane(Origin=area.Centroid)
area_2 = Area(Geometry=move_8.Geometry)  # -> Area, Centroid
move_9 = Move(Geometry=xy, Motion=addition_4)  # -> Geometry, Transform
refine_6 = Refine(Mesh=move_8.Geometry, Level=Slider(3, range=0..10))
tri_6 = Triangulate(Mesh=refine_6)  # -> Mesh, Count
swatch = ColourSwatch(SwatchColor=RGBA(130, 121, 17, 188))
medges_4 = MeshEdges(Mesh=tri_6.Mesh)  # -> NakedEdges, InteriorEdges, NonManifoldEdges

number_slider_7 = Slider(8, range=0..10)
number_slider_8 = Slider(8, range=0..10)
number_slider_9 = Slider(0.01, range=0..0.01)
division_5 = Division(A=Slider(70, range=0..90), B=number_slider_7)
division_6 = Division(A=Slider(1, range=0..90), B=number_slider_8)
# Simple Shade geometry
panel_3 = Panel("0")
series_2 = Series(Start=Slider(0, range=0..90), Step=division_5, Count=expr("x+1", number_slider_7))
series_3 = Series(Start=Slider(0, range=0..90), Step=division_6, Count=expr("x+1", number_slider_8))
panel_4 = Panel("""agl
ext""")
replace = ReplaceItems(List=series_3, Item=number_slider_9, Indices=panel_3, Wrap=False)
replace_2 = ReplaceItems(List=series_2, Item=number_slider_9, Indices=panel_3, Wrap=False)
txt = Text(panel_4)
entwine = Entwine(Branch00=replace_2, Branch01=replace, FlattenInputs=True)
grid = ConstructGrid(InputRange=entwine, Labels=txt)  # -> GridInformations, Grid
vec_4 = Vector(facen.Normals)
medges_5 = MeshEdges(Mesh=mplane.Mesh)  # -> NakedEdges, InteriorEdges, NonManifoldEdges
panel_5 = Panel(grid.GridInformations)
item_5 = ListItem(List=medges_5.NakedEdges, Index=Slider(2, range=0..10), Wrap=True)
divide = DivideCurve(Curve=item_5, Count="2", Kinks=False)  # -> Points, Tangents, Parameters
item_6 = ListItem(List=divide.Points, Index="1", Wrap=True)
Z_4 = UnitZ(Factor=1)
addition_5 = Addition(A=number_slider_2, B="0.10")
c_script_6 = CSharpScript(
    input_grid=grid.Grid,
    hwindow=addition_5,
    N=vec_4,
    Reference="C:\Users\Victor Charpentier\AppData\Roaming\Grasshopper\Libraries\IvyCore.dll")  # -> out, V; inputs hwindow: Double, N: Vector3d
# ---------- c_script_6: C# ----------
    var normal = (Vector3d) N;
    var hwin = (double) hwindow;
    var gact = (Grid) input_grid;



    var nn = gact.NodeCount;
    var vec = new List<Vector3d>();
    //var actuationstate = new double[nn][];
    var origin = new Point3d(0.0, 0.0, 0.0);
    var rotaxis = Vector3d.CrossProduct(normal, new Vector3d(0.0, 0.0, -1.0));

    for (int i = 0;i < nn;i++)
    {
      var ag = -Math.PI * gact.Nodes[i][0] / 180;
      var ext = gact.Nodes[i][1];

      var current_vec = new Vector3d(0.0, 0.0, -1.0);

      current_vec.Transform(Transform.Rotation(ag, rotaxis, origin));
      current_vec = ext * (hwin) * current_vec;
      vec.Add(current_vec);

    }

    V = vec;
# ---------- end c_script_6 ----------
vec_5 = Vector(facen.Normals)
scale_2 = Scale(Geometry=item_5, Center=item_6, Factor="1.05")  # -> Geometry, Transform
expression = Expression(x=Z_4, y=vec_5, a="0.10", b="0.03", Expression="a*x+b*y")
move_10 = Move(Geometry=scale_2.Geometry, Motion=expression)  # -> Geometry, Transform
extr = Extrude(Base=move_10.Geometry, Direction=c_script_6.V)
custom_mesh_settings = SettingsCustom(
    StitchSeams=True,
    SimplePlanes=False,
    Refine=True,
    MinCount=16,
    MaxCount=400,
    AspectRatio=20,
    MaxDistance=0,
    MaxAngle=20,
    MinEdge=0,
    MaxEdge=Slider(0.2, range=0..1))
mesh_3 = MeshBrep(Brep=extr, Settings=custom_mesh_settings)
tri_7 = Triangulate(Mesh=mesh_3)  # -> Mesh, Count
item_7 = ListItem(List=tri_7.Mesh, Index=Slider(47, range=0..80), Wrap=True)
mesh_4 = Mesh(tri_7.Mesh)

preview_3 = CustomPreview(Geometry=area_2.Centroid, Shader=swatch)
preview_4 = CustomPreview(Geometry=medges_4.NakedEdges, Shader=swatch)
medges_6 = MeshEdges(Mesh=item_7)  # -> NakedEdges, InteriorEdges, NonManifoldEdges
panel_6 = Panel("C:\Users\Victor Charpentier\Documents\GitHub\SuntoolGH\dev\data_fit\")
panel_7 = Panel("C:\Users\victor\Documents\GitHub\SuntoolGH\dev\data_fit\")
series_4 = Series(Start=Slider(0, range=0..1), Step=Slider(0.15, range=0..0.5), Count=Slider(2, range=0..11))
series_5 = Series(Start=Slider(0, range=0..1), Step=Slider(0.1, range=0..0.2), Count=Slider(10, range=0..11))
panel_8 = Panel("""view_summer
directGlare_summer""")
panel_9 = Panel(series_4)
panel_10 = Panel(series_5)
# Seasonal coeficient
entwine_2 = Entwine(Branch00=panel_10, Branch01=panel_9, FlattenInputs=True)
path = FilePath(panel_6)
grid_2 = ConstructGrid(InputRange=entwine_2, Labels=panel_8)  # -> GridInformations, Grid
heating_period_start = Panel("6576")
heating_period_end = Panel("3096")
txt_2 = Text(["outMatlabc0.csv", "outMatlabc1.csv", "outMatlabc2.csv", "outMatlabc3.csv"])
constraintparam = ConstraintParam(
    SunHours=num_3,
    StartOfWinterPeriod=heating_period_start,
    EndOfWinterPeriod=heating_period_end,
    CoolingCoefficientGrid=grid_2.Grid)  # -> ListOfWeightedCoefficients, GlobalCoefGrid, CoefficientHeatingCooling
txt_3 = Text(["optValCriteriac0.csv", "optValCriteriac1.csv", "optValCriteriac2.csv", "optValCriteriac3.csv"])
number_slider_10 = Slider(0, range=0..1)
vec_6 = Vector(facen.Normals)
vec_7 = Vector(vec_3)
window_area = Number(mplane.Area)
dprod = DotProduct(VectorA=vec_7, VectorB=vec_6, Unitize=invert(False))
cos_facade_sun = Number(dprod)
equals = Equality(FirstNumber=constraintparam.CoefficientHeatingCooling, SecondNumber="1")  # -> Equality, Inequality
number_slider_11 = Slider(3, range=0..3)
item_8 = ListItem(List=txt_2, Index=number_slider_11, Wrap=True)
item_9 = ListItem(List=txt_3, Index=number_slider_11, Wrap=True)
mesh_5 = Mesh(mesh_2)
desk = Mesh(tri_6.Mesh)
vec_8 = Vector(facen.Normals)
toggle = BooleanToggle(True)
refine_7 = Refine(Mesh=mesh_5, Level=Slider(4, range=0..10))
number_slider_12 = Slider(1134, range=0..2385)
medges_7 = MeshEdges(Mesh=refine_7)  # -> NakedEdges, InteriorEdges, NonManifoldEdges
d1_directglare_summer = ValueList({"0", "1"}, selected="0")
d0_view_summer = ValueList({"0", "1", "2", "3", "4", "5", "6", "7", "8", "9"}, selected="5")

grid_3 = Grid(grid_2.Grid)
slider = GridSlider(grid=grid_3, D0=d0_view_summer, D1=d1_directglare_summer)  # -> Info, ActivePoint, ActiveCell
node_index = NodeIndexFromAddress(Grid=grid_3, Address=slider.ActivePoint)
grid_node = GridNode(Grid=grid_3, NodeIndex=node_index)
panel_11 = Panel(grid_node)
# Visualize data
node_prop = NodeProperties(Node=grid_node)  # -> NodeIndex, Coordinates, NormalizedCoordinates, AddressTuple
panel_12 = Panel(node_prop.NodeIndex)

panel_13 = Panel("outMatlab.csv")
workingdir = FilePath(path)
concat = Concatenate(FragmentA=workingdir, FragmentB=item_8)
toggle_2 = BooleanToggle(True)
grid_4 = Grid(grid.Grid)
c_script_7 = CSharpScript(
    path=concat,
    gAct=grid_4,
    run=toggle_2,
    Reference="C:\Users\Victor Charpentier\AppData\Roaming\Grasshopper\Libraries\IvyCore.dll")  # -> out, A; inputs path: String
# ---------- c_script_7: C# ----------
    var filePath = (string) path;
    var gridAct = (IvyCore.Parametric.Grid) gAct;
    var runIt = (bool) run;

    if (!runIt){return;}

    var reader = new StreamReader(filePath);
    var field = new DataTree<string>();

    var ndof = gridAct.Dim;


    while (!reader.EndOfStream)
    {
      var line = reader.ReadLine();
      var values = line.Split(',');
      var ncomb = values.Length / ndof;

      for (int i = 0;i < ncomb;i++)
      {
        field.Add(string.Format("{0},{1}", values[i * ndof].ToString(), values[i * ndof + 1].ToString()), new GH_Path(i));
      }

    }

    A = field;
# ---------- end c_script_7 ----------
viewer = ParamViewer(c_script_7.A)
item_10 = ListItem(List=viewer, Index=node_prop.NodeIndex, Wrap=True)
branch = TreeBranch(Tree=c_script_7.A, Path=item_10, MaintainPaths=True)
window_height = Number(addition_5)
window_normal = Vector(facen.Normals)
crv = Curve(move_10.Geometry)
split = TextSplit(Text=branch, Separators=",")
item_11 = ListItem(List=split, Index=0, Wrap=True)  # -> flatten(Item)
item_12 = ListItem(List=split, Index=1, Wrap=True)  # -> flatten(Item)
top_rolling_shade = CSharpScript(
    act1=item_11,
    act2=item_12,
    hwindow=window_height,
    N=window_normal,
    tedge=crv,
    Reference="C:\USERS\VICTOR CHARPENTIER\APPDATA\ROAMING\GRASSHOPPER\LIBRARIES\IvyCore.dll")  # -> out, V, S; inputs act1: list of Double, act2: list of Double, hwindow: Double, N: Vector3d, tedge: Curve
# ---------- top_rolling_shade: C# ----------
    var normal = (Vector3d) N;
    var hwin = (double) hwindow;
    var Act1 = (List<double>) act1;
    var Act2 = (List<double>) act2;
    var top = (Curve) tedge;

    var surf = new List<GH_Surface>();

    var nn = Act1.Count;
    var vec = new List<Vector3d>();
    var origin = new Point3d(0.0, 0.0, 0.0);
    var rotaxis = Vector3d.CrossProduct(normal, new Vector3d(0.0, 0.0, -1.0));

    for (int i = 0;i < nn;i++)
    {
      var ag = -Math.PI * Act1[i] / 180;
      var ext = Act2[i];

      var current_vec = new Vector3d(0.0, 0.0, -1.0);

      current_vec.Transform(Transform.Rotation(ag, rotaxis, origin));
      current_vec = ext * (hwin) * current_vec;

      var current_surf = Rhino.Geometry.Extrusion.CreateExtrusion(top, current_vec);

      vec.Add(current_vec);
      surf.Add(new Grasshopper.Kernel.Types.GH_Surface(current_surf));

    }

    V = vec;
    S = surf;
# ---------- end top_rolling_shade ----------
srf = Surface(top_rolling_shade.S)

panel_14 = Panel("optValCriteria.csv")
workingdir_2 = FilePath(path)
concat_2 = Concatenate(FragmentA=workingdir_2, FragmentB=item_9)
c_script_8 = CSharpScript(
    path=concat_2,
    Ncriteria="3",
    run=toggle_2,
    Reference="C:\Users\Victor Charpentier\AppData\Roaming\Grasshopper\Libraries\IvyCore.dll")  # -> out, A; inputs path: String, Ncriteria: Int32
# ---------- c_script_8: C# ----------
    var filePath = (string) path;
    var ncrit = (int) Ncriteria;
    var runIt = (bool) run;

    if (!runIt){return;}

    var reader = new StreamReader(filePath);
    var field = new DataTree<string>();



    while (!reader.EndOfStream)
    {
      var line = reader.ReadLine();
      var values = line.Split(',');
      var ncomb = values.Length / ncrit;

      Print(values.Length.ToString());

      for (int i = 0;i < ncomb;i++)
      {
        field.Add(string.Format("{0},{1},{2}", values[i * ncrit].ToString(), values[i * ncrit + 1].ToString(), values[i * ncrit + 2].ToString()), new GH_Path(i));
      }

    }

    A = field;
# ---------- end c_script_8 ----------
branch_2 = TreeBranch(Tree=c_script_8.A, Path=item_10, MaintainPaths=True)
split_2 = TextSplit(Text=branch_2, Separators=",")
item_13 = ListItem(List=split_2, Index=0, Wrap=True)  # -> flatten(Item)
item_14 = ListItem(List=split_2, Index=2, Wrap=True)  # -> flatten(Item)
item_15 = ListItem(List=split_2, Index=1, Wrap=True)  # -> flatten(Item)
item_16 = ListItem(List=item_13, Index=number_slider_12, Wrap=True)  # -> simplify(Item)
item_17 = ListItem(List=item_15, Index=number_slider_12, Wrap=True)  # -> simplify(Item)
item_18 = ListItem(List=item_14, Index=number_slider_12, Wrap=True)  # -> simplify(Item)

division_7 = Division(A=item_13, B=cos_facade_sun)
c_script_9 = CSharpScript(x=division_7, y=window_area, z=number_slider_10)  # -> out, A; inputs x: list of Double, y: Double, z: Double
# ---------- c_script_9: C# ----------
    var lst = (List<double>) x;
    var max = (double) y;
    var min = (double) z;

    var outlst = new List<double>();

    var maxlst = 1.0;
    var minlst = 0.0;

    maxlst = lst.Max();
    minlst = lst.Min();

    var coef1 = (max - min) / (maxlst - minlst);
    Print(coef1.ToString());
    // /*
    for (int i = 0;i < lst.Count;i++)
    {
      double current_outlst = coef1 * (lst[i] - minlst) + min;
      outlst.Add(current_outlst);
    }
    // */
    A = outlst;
    Print("max of the input is " + maxlst.ToString() + " , min of the input is " + minlst.ToString());
# ---------- end c_script_9 ----------
panel_15 = Panel(item_13)
panel_16 = Panel(item_15)
panel_17 = Panel(item_14)
c_script_10 = CSharpScript(x=item_15, y=Slider(1, range=0..1), z=number_slider_10)  # -> out, A; inputs x: list of Double, y: Double, z: Double
# ---------- c_script_10: C# ----------
    var lst = (List<double>) x;
    var max = (double) y;
    var min = (double) z;

    var outlst = new List<double>();

    var maxlst = 1.0;
    var minlst = 0.0;

    //maxlst = lst.Max();
    //minlst = lst.Min();

    var coef1 = (max - min) / (maxlst - minlst);
    Print(coef1.ToString());
    // /*
    for (int i = 0;i < lst.Count;i++)
    {
      double current_outlst = coef1 * (lst[i] - minlst) + min;
      outlst.Add(current_outlst);
    }
    // */
    A = outlst;
    Print("max of the input is " + maxlst.ToString() + " , min of the input is " + minlst.ToString());
# ---------- end c_script_10 ----------
c_script_11 = CSharpScript(x=item_14, y=Slider(1, range=0..1), z=number_slider_10)  # -> out, A; inputs x: list of Double, y: Double, z: Double; same code as c_script_10
multiplication_7 = Multiplication(A=c_script_9.A, B=cos_facade_sun)
panel_18 = Panel(c_script_9.A)
panel_19 = Panel(c_script_10.out)
panel_20 = Panel(c_script_11.out)
item_19 = ListItem(List=item_12, Index=number_slider_12, Wrap=True)
item_20 = ListItem(List=item_11, Index=number_slider_12, Wrap=True)
dispatch = Dispatch(List=multiplication_7, DispatchPattern=equals.Equality)  # -> ListA, ListB
dispatch_2 = Dispatch(List=c_script_10.A, DispatchPattern=equals.Equality)  # -> ListA, ListB
panel_21 = Panel(c_script_9.out)
dispatch_3 = Dispatch(List=item_14, DispatchPattern=equals.Equality)  # -> ListA, ListB
panel_22 = Panel(item_20)
panel_23 = Panel(item_19)
avr = Average(Input=dispatch_2.ListA)
avr_2 = Average(Input=dispatch_2.ListB)
num_4 = Number(dispatch_3.ListB)
num_5 = Number(dispatch_3.ListA)
ma = MassAddition(Input=dispatch.ListA)  # -> Result, PartialResults
ma_2 = MassAddition(Input=dispatch.ListB)  # -> Result, PartialResults
avr_3 = Average(Input=num_5)
avr_4 = Average(Input=num_4)
panel_25 = Panel(avr_2)
panel_26 = Panel(avr)

item_21 = ListItem(List=num_3, Index=number_slider_12, Wrap=True)  # -> simplify(Item)
item_22 = ListItem(List=vec_3, Index=number_slider_12, Wrap=True)  # -> simplify(Item)
item_23 = ListItem(List=srf, Index=number_slider_12, Wrap=True)
c_script_12 = CSharpScript(x=item_21)  # -> out, A; inputs x: Double; same code as c_script_5
vdis_2 = VectorDisplay(Anchor=facen.Centers, Vector=item_22)
panel_27 = Panel(c_script_12.A)

kwh = Panel(ma.Result)
kwh_2 = Panel(ma_2.Result)
panel_28 = Panel(avr_4)
panel_29 = Panel(avr_3)
preview_5 = CustomPreview(Geometry=item_23, Shader=ColourSwatch(SwatchColor=RGBA(173, 173, 173, 182)))
division_8 = Division(A=kwh_2, B=window_area)
division_9 = Division(A=kwh, B=window_area)
refine_8 = Refine(Mesh=item_23, Level=Slider(3, range=0..10))
kwh_3 = Panel(division_9)
kwh_4 = Panel(division_8)
shadeassess = ShadeAssessment(WindowPanelMesh=refine_7, ShadeModuleMesh=refine_8, ProjectionVector=item_22, LaunchTheAnalysis=toggle)  # -> MeshOfExposedWindowsSurface, AreaOfExposed, CommentOnOperationType, DebugMeshcutter, DebugHull
shadeassess_2 = ShadeAssessment(WindowPanelMesh=refine_7, ShadeModuleMesh=refine_8, ProjectionVector=vec_8, LaunchTheAnalysis=toggle)  # -> MeshOfExposedWindowsSurface, AreaOfExposed, CommentOnOperationType, DebugMeshcutter, DebugHull
mesh_6 = Mesh(shadeassess.MeshOfExposedWindowsSurface)
glareassess = GlareOnWallPanel(WallPanel=desk, SourceOutline=mesh_6, ProjectionDirectionVector=item_22, LaunchTheAnalysis=toggle)  # -> MeshOfGlareOnTheWallPanel, AreaOfGlareOnTheWallPanel, CommentOnOperationType, DebugMeshcutter
mesh_7 = Mesh(glareassess.MeshOfGlareOnTheWallPanel)
mesh_8 = Mesh(shadeassess_2.MeshOfExposedWindowsSurface)

cos_facade_sun_2 = Number(dprod)
window_area_2 = Number(mplane.Area)
desk_area = Number(area_2.Area)
item_24 = ListItem(List=cos_facade_sun_2, Index=number_slider_12, Wrap=True)
panel_30 = Panel(item_16)
panel_31 = Panel(item_17)
panel_32 = Panel(item_18)
multiplication_8 = Multiplication(A=shadeassess.AreaOfExposed, B=item_24)  # -> simplify(Result)
division_10 = Division(A=glareassess.AreaOfGlareOnTheWallPanel, B=desk_area)  # -> simplify(Result)
division_11 = Division(A=shadeassess_2.AreaOfExposed, B=window_area_2)
panel_33 = Panel(multiplication_8)
panel_34 = Panel(division_11)
panel_35 = Panel(division_10)
expression_2 = Expression(x=panel_33, y=panel_30, Expression="100*(y-x)/x")
expression_3 = Expression(x=panel_34, y=panel_31, Expression="100*(y-x)/x")
expression_4 = Expression(x=panel_35, y=panel_32, Expression="100*(y-x)/x")

preview_6 = CustomPreview(Geometry=mesh_7, Shader=ColourSwatch(SwatchColor=RGB(255, 0, 204)))
subtraction_2 = Subtraction(A=panel_30, B=panel_33)
subtraction_3 = Subtraction(A=panel_31, B=panel_34)
subtraction_4 = Subtraction(A=panel_32, B=panel_35)
percentage_of_difference = Panel(expression_4)
difference = Panel(subtraction_3)
difference_2 = Panel(subtraction_2)
percentage_of_difference_2 = Panel(expression_3)
percentage_of_difference_3 = Panel(expression_2)
difference_3 = Panel(subtraction_4)
projecta = ProjectAlong(Geometry=mesh_6, Plane=move_9.Geometry, Direction=item_22)  # -> Geometry, Transform
