# Grasshopper definition room_venetianShade_optimization.gh (Grasshopper 0.9.76)
# plug-ins: Kangaroo Components, IvyGh, SunTools

# ---- group: actuation
panel = Panel("""agl
ext""")
dom = ConstructDomain(DomainStart=Slider(0, range=0..90), DomainEnd=Slider(88, range=0..90))
dom_2 = ConstructDomain(DomainStart=Slider(0, range=0..1), DomainEnd=Slider(1, range=0..1))
txt = Text(panel)
random = Random(Range=dom, Number=Slider(2, range=0..10), Seed=2)
random_2 = Random(Range=dom_2, Number=Slider(2, range=0..10), Seed=2)
entwine = Entwine(Branch00=random, Branch01=random_2, FlattenInputs=True)
grid = ConstructGrid(InputRange=entwine, Labels=txt)  # -> GridInformations, Grid
panel_2 = Panel(grid.GridInformations)

# ----
number_slider = Slider(4, range=0..10)
number_slider_2 = Slider(2.2, range=0..10)
division = Division(A=number_slider_2, B=-2)
division_2 = Division(A=number_slider_2, B=2)
division_3 = Division(A=number_slider, B=-2)
division_4 = Division(A=number_slider, B=2)
pi = Pi(Factor=2)
rad = Radians(Degrees=Slider(105, range=90..270))
yz = YZPlane(Origin=Point(0, 0, 0))
subtraction = Subtraction(A=pi, B=rad)
dom_3 = ConstructDomain(DomainStart=division, DomainEnd=division_2)
dom_4 = ConstructDomain(DomainStart=division_3, DomainEnd=division_4)
rotate = Rotate(Geometry=yz, Angle=subtraction, Plane=PlaneXY(0, 0, 0))  # -> Geometry, Transform
number_slider_3 = Slider(1, range=0..1)
rectangle = Rectangle(Plane=rotate.Geometry, XSize=dom_4, YSize=dom_3, Radius=0)  # -> Rectangle, Length
mplane = MeshPlane(Boundary=rectangle.Rectangle, WidthCount=number_slider_3, HeightCount=number_slider_3)  # -> Mesh, Area
facen = FaceNormals(Mesh=mplane.Mesh)  # -> Centers, Normals
refine = Refine(Mesh=mplane.Mesh, Level=Slider(4, range=0..10))
mesh = Mesh(refine)

# ---- group: ROOM
number_slider_4 = Slider(0.5, range=0..1)
normal_window = Vector(facen.Normals)
mesh_2 = Mesh(mplane.Mesh)
medges = MeshEdges(Mesh=mesh_2)  # -> NakedEdges, InteriorEdges, NonManifoldEdges
# Venetian Shade geometry
number_slider_5 = Slider(-5, range=-10..-1)
unit = UnitVector(Vector=normal_window)
multiplication = Multiplication(A=number_slider_4, B=-1)
# Room geometry
item = ListItem(List=medges.NakedEdges, Index="1", Wrap=True)
multiplication_2 = Multiplication(A=unit, B=Slider(0, range=-1..0))
Z = UnitZ(Factor=multiplication)
multiplication_3 = Multiplication(A=unit, B=number_slider_5)
addition = Addition(A=multiplication_2, B=Z)
move = Move(Geometry=item, Motion=addition)  # -> Geometry, Transform
multiplication_4 = Multiplication(A=number_slider_4, B=2)
end = EndPoints(Curve=move.Geometry)  # -> Start, End
addition_2 = Addition(A=number_slider_2, B=multiplication_4)
move_2 = Move(Geometry=end.Start, Motion=multiplication_3)  # -> Geometry, Transform
move_3 = Move(Geometry=end.End, Motion=multiplication_3)  # -> Geometry, Transform
Z_2 = UnitZ(Factor=addition_2)
pt = Point(end.Start)
move_4 = Move(Geometry=pt, Motion=Z_2)  # -> Geometry, Transform
pt_2 = Point(move_2.Geometry)
move_5 = Move(Geometry=pt_2, Motion=Z_2)  # -> Geometry, Transform
pt_3 = Point(end.End)
move_6 = Move(Geometry=pt_3, Motion=Z_2)  # -> Geometry, Transform
pt_4 = Point(move_3.Geometry)
move_7 = Move(Geometry=pt_4, Motion=Z_2)  # -> Geometry, Transform
c_script = CSharpScript(A=pt, B=pt_2, C=pt_4, D=pt_3)  # -> out, mesh, edges, plane; inputs A: Point3d, B: Point3d, C: Point3d, D: Point3d
# ---------- c_script: C# ----------
    var p1 = (Point3d) A;
    var p2 = (Point3d) B;
    var p3 = (Point3d) C;
    var p4 = (Point3d) D;
    List < Point3d > vert = new List<Point3d>(){p1,p2,p3,p4};

    var f1 = new Rhino.Geometry.MeshFace(0, 1, 2, 3);
    var m1 = new Rhino.Geometry.Mesh();
    var pl1 = new Rhino.Geometry.Plane(p1, p2, p4);

    m1.Vertices.AddVertices(vert);
    m1.Faces.AddFace(f1);

    var e1 = new List<Polyline>(m1.GetNakedEdges());

    mesh = m1;
    plane = pl1;
    edges = e1;
# ---------- end c_script ----------
c_script_2 = CSharpScript(A=pt, B=pt_2, C=move_5.Geometry, D=move_4.Geometry)  # -> out, mesh, edges, plane; inputs A: Point3d, B: Point3d, C: Point3d, D: Point3d; same code as c_script
c_script_3 = CSharpScript(A=pt_2, B=pt_4, C=move_7.Geometry, D=move_5.Geometry)  # -> out, mesh, edges, plane; inputs A: Point3d, B: Point3d, C: Point3d, D: Point3d; same code as c_script
c_script_4 = CSharpScript(A=pt_3, B=pt_4, C=move_7.Geometry, D=move_6.Geometry)  # -> out, mesh, edges, plane; inputs A: Point3d, B: Point3d, C: Point3d, D: Point3d; same code as c_script
number_slider_6 = Slider(3, range=0..10)
refine_2 = Refine(Mesh=c_script_4.mesh, Level=number_slider_6)
refine_3 = Refine(Mesh=c_script.mesh, Level=number_slider_6)
refine_4 = Refine(Mesh=c_script_2.mesh, Level=number_slider_6)
refine_5 = Refine(Mesh=c_script_3.mesh, Level=number_slider_6)
mjoin = MeshJoin(Meshes=[c_script.mesh, c_script_2.mesh, c_script_3.mesh, c_script_4.mesh])

# ---- group: Facade offset
Z_3 = UnitZ(Factor=1)
panel_3 = Panel("0.15")
vec = Vector(facen.Normals)
expression = Expression(x=Z_3, y=vec, a=panel_3, b="0.10", Expression="a*x+b*y")

# ---- group: Top Edge
medges_2 = MeshEdges(Mesh=mplane.Mesh)  # -> NakedEdges, InteriorEdges, NonManifoldEdges
item_2 = ListItem(List=medges_2.NakedEdges, Index=Slider(2, range=0..10), Wrap=True)
divide = DivideCurve(Curve=item_2, Count="2", Kinks=False)  # -> Points, Tangents, Parameters
item_3 = ListItem(List=divide.Points, Index="1", Wrap=True)
scale = Scale(Geometry=item_2, Center=item_3, Factor="1.05")  # -> Geometry, Transform
move_8 = Move(Geometry=scale.Geometry, Motion=expression)  # -> Geometry, Transform

# ----
rad_2 = Radians(Degrees=Slider(3, range=0..10))
number_slider_7 = Slider(1969, range=0..3578)
digit_scroller = DigitScroller(Scroller_Digits=12, Scroller_Radix=9, Scroller_Value=476)
digit_scroller_2 = DigitScroller(Scroller_Digits=12, Scroller_Radix=9, Scroller_Value=3469)
number_slider_8 = Slider(1533, range=0..3578)
# Window geometry
number_slider_9 = Slider(1024, range=0..3578)
c_script_5 = CSharpScript()  # -> out, A; inputs x: list of Double; disabled
# ---------- c_script_5: C# ----------
    var inList = (List<double>) x;
    string outString = null;

    for (int i = 0;i < inList.Count;i++)
    {
      if (i< inList.Count - 1)
      {
        outString += x[i].ToString() + ",";
      }
      else
      {
         outString += x[i].ToString();
      }
    }

    A = outString;
# ---------- end c_script_5 ----------
series = Series(Start=number_slider_9, Step=1, Count=Slider(1, range=1..3000))

# ----
# Sun Vectors
X = UnitX(Factor=1)
azi = Number([126.3264092, 137.3313031, 149.9081719, 164.0725822, 179.3051332, 194.5902344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])
ele = Number([5.239618324, 13.76930373, 20.56615289, 25.05155863, 26.71385892, 25.32899458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])
num = Number([8, 9, 10, 11, 12, 13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])
sunsifting = SiftSunOrientations(
    North=X,
    SunAzimuth=azi,
    SunAltitude=ele,
    AssociatedSunHours=num,
    FaçadePanelToEvaluate=mplane.Mesh,
    AngleToleranceInRad=rad_2)  # -> ResultingSiftedSunAzimuthAngles, ResultingSiftedSunAltitudeAngles, ResultingSiftedHours, ResultingSuftedSunVectors
item_4 = ListItem(List=sunsifting.ResultingSuftedSunVectors, Index=series, Wrap=True)  # -> simplify(Item)

item_5 = ListItem(List=sunsifting.ResultingSiftedHours, Index=series, Wrap=True)  # -> simplify(Item)
num_2 = Number(sunsifting.ResultingSiftedHours)
vec_2 = Vector(sunsifting.ResultingSuftedSunVectors)
vec_3 = Vector(move_8.Geometry)
end_2 = EndPoints(Curve=move_8.Geometry)  # -> Start, End

# ---- group: geometry variables
dom_5 = ConstructDomain(DomainStart=Slider(0.05, range=0..0.2), DomainEnd=Slider(0.1, range=0..0.2))
panel_4 = Panel("""width
curvature""")
dom_6 = ConstructDomain(DomainStart=Slider(0.001, range=0.001..20), DomainEnd=Slider(20, range=0..20))
txt_2 = Text(panel_4)
random_3 = Random(Range=dom_5, Number=Slider(2, range=0..10), Seed=2)
random_4 = Random(Range=dom_6, Number=Slider(2, range=0..10), Seed=2)
entwine_2 = Entwine(Branch00=random_3, Branch01=random_4, FlattenInputs=True)
grid_2 = ConstructGrid(InputRange=entwine_2, Labels=txt_2)  # -> GridInformations, Grid
panel_5 = Panel(grid_2.GridInformations)
vec_4 = Vector(facen.Normals)
pt_5 = Point(end_2.Start)
c__curved_slat = CSharpScript(
    inputGrid=grid_2.Grid,
    ctrPoint=pt_5,
    N=vec_4,
    Reference="C:\USERS\ADMIN\APPDATA\ROAMING\GRASSHOPPER\LIBRARIES\IvyCore.dll")  # -> out, arcs, pt1, pt2; inputs ctrPoint: Point3d, N: Vector3d
# ---------- c__curved_slat: C# ----------
    var gvar = (IvyCore.MultiDimGrid.Grid) inputGrid;
    var cp = (Point3d) ctrPoint;
    var nv = (Vector3d) N;

    var profile = new List<Arc>();
    var point1 = new List<Point3d>();
    var point2 = new List<Point3d>();

    for (int i = 0;i < gvar.NodeCount;i++)
    {
      var widthSlat = gvar.Nodes[i][0];
      var radSlat = 1/(gvar.Nodes[i][1]);
      var theta = 2 * Math.Asin(0.5 * widthSlat / radSlat);
      var c0 = radSlat * (Math.Cos(0.5 * theta) - 1);
      var c1 = 0.5 * widthSlat / radSlat;


      var v1 = Vector3d.Add(Vector3d.Multiply(nv, 0.5 * widthSlat), Vector3d.Multiply(new Vector3d(0.0, 0.0, 1.0), c0));
      var v2 = Vector3d.Multiply(nv, -0.5 * widthSlat) + Vector3d.Multiply(new Vector3d(0.0, 0.0, 1.0), radSlat * (Math.Cos(0.5 * theta) - 1));
      var p1 = new Point3d(cp);
      var p2 = new Point3d(cp);

      var t1 = Transform.Translation(v1);
      var t2 = Transform.Translation(v2);


      p1.Transform(t1);
      p2.Transform(t2);

      point1.Add(p1);
      point2.Add(p2);


      Print(c1.ToString());

      profile.Add(new Arc(p1, cp, p2));

    }

    arcs = profile;
    pt1 = point1;
    pt2 = point2;
# ---------- end c__curved_slat ----------

# ----
panel_6 = Panel(num_2)
vdis = VectorDisplay(Anchor=facen.Centers, Vector=item_4)
item_6 = ListItem(List=c__curved_slat.arcs, Index=0, Wrap=True)
crv = Curve(c__curved_slat.arcs)
g1xg2 = CartesianProduct(FirstGrid=grid_2.Grid, SecondGrid=grid.Grid)  # -> Info, TheCartesianProductG1xG2
extr = Extrude(Base=crv, Direction=vec_3)
mesh_3 = MeshBrep(
    Brep=extr,
    Settings={GridMaxCount=0, GridMinCount=16, JaggedSeams=False, MaxEdgeLength=0, MinEdgeLength=0.0001, MinTolerance=0, Refine=True, RefineAngle=0, RelativeTolerance=0.65, SimplePlanes=True, Tolerance=0})

# ---- group: Room visualize
medges_3 = MeshEdges(Mesh=mjoin)  # -> NakedEdges, InteriorEdges, NonManifoldEdges
preview = CustomPreview(
    Geometry=[medges.NakedEdges, medges_3.NakedEdges, medges_3.InteriorEdges],
    Shader=ColourSwatch(SwatchColor=RGBA(0, 0, 0, 41)))

# ----
refine_6 = Refine(Mesh=mesh_3, Level=Slider(0, range=0..10))
medges_4 = MeshEdges(Mesh=refine_6)  # -> NakedEdges, InteriorEdges, NonManifoldEdges
c_script_6 = CSharpScript(
    act_grid=grid.Grid,
    form_grid=grid_2.Grid,
    hwindow=number_slider_2,
    vertOffset=panel_3,
    slatMesh=refine_6,
    rotAxis=vec_3,
    rotCenter=pt_5,
    Reference="C:\Users\admin\AppData\Roaming\Grasshopper\Libraries\IvyCore.dll")  # -> out, venitShade; inputs hwindow: Double, vertOffset: Double, slatMesh: list of Mesh, rotAxis: Vector3d; disabled
# ---------- c_script_6: C# ----------
    var sltmshs = (List<Mesh>) slatMesh;
    var hwin = (double) hwindow;
    var gact = (IvyCore.MultiDimGrid.Grid) act_grid;
    var gform = (IvyCore.MultiDimGrid.Grid) form_grid;
    var vo = (double) vertOffset;
    var raxs = (Vector3d) rotAxis;
    var rctr = (Point3d) rotCenter;

    raxs.Unitize();

    var veniMesh = new DataTree<Mesh>();

    var nn = gact.NodeCount; //number of nodes
    var zaxis = Vector3d.Multiply(Vector3d.ZAxis, -1);




    for (int i = 0;i < sltmshs.Count;i++)
    {
      var ns = Math.Ceiling(hwin / gform.Nodes[i][0]);
      var initTrans = vo / ns;
      var p1 = new GH_Path(i);

      Print(ns.ToString());


      for (int j = 0;j < nn;j++)
      {

        var transRotation = Transform.Rotation(Math.PI * gact.Nodes[j][0] / 180, raxs, rctr);

        var currentMesh = new Mesh();
        currentMesh.CopyFrom(sltmshs[i]);

        currentMesh.Transform(transRotation);

        /*
        for (int k = 0;k < ns;k++)
        {
          var transTranslation = Transform.Translation(Vector3d.Multiply(zaxis, initTrans + (k + 1) * gact.Nodes[j][1] * hwin / ns));
          var currentTrans = new Mesh();
          currentTrans.CopyFrom(currentMesh);
          currentTrans.Transform(transTranslation);
          currentMesh.Append(currentTrans);
        }*/
        veniMesh.Add(currentMesh, p1);
      }
    }



    venitShade = veniMesh;
# ---------- end c_script_6 ----------
c_script_7 = CSharpScript(
    act_grid=grid.Grid,
    form_grid=grid_2.Grid,
    hwindow=number_slider_2,
    vertOffset=panel_3,
    slatMesh=refine_6,
    rotAxis=vec_3,
    rotCenter=pt_5,
    Reference="C:\Users\admin\AppData\Roaming\Grasshopper\Libraries\IvyCore.dll")  # -> out, venitShade; inputs hwindow: Double, vertOffset: Double, slatMesh: list of Mesh, rotAxis: Vector3d
# ---------- c_script_7: C# ----------
    var sltmshs = (List<Mesh>) slatMesh;
    var hwin = (double) hwindow;
    var gact = (IvyCore.MultiDimGrid.Grid) act_grid;
    var gform = (IvyCore.MultiDimGrid.Grid) form_grid;
    var vo = (double) vertOffset;
    var raxs = (Vector3d) rotAxis;
    var rctr = (Point3d) rotCenter;

    raxs.Unitize();

    var veniMesh = new DataTree<Mesh>();

    var nn = gact.NodeCount; //number of nodes
    var zaxis = Vector3d.Multiply(Vector3d.ZAxis, -1);

    Print(sltmshs[3].Faces[0].A.ToString() + " node count: " + sltmshs[3].Vertices.Count.ToString());


    for (int i = 0;i < sltmshs.Count;i++)
    {
      var ns = Math.Ceiling(hwin / gform.Nodes[i][0]);
      var initTrans = vo / ns;
      var p1 = new GH_Path(i);

      Print(ns.ToString());


      for (int j = 0;j < nn;j++)
      {

        var transRotation = Transform.Rotation(Math.PI * gact.Nodes[j][0] / 180, raxs, rctr);
        var currentMesh = new Mesh();
        currentMesh.CopyFrom(sltmshs[i]);
        currentMesh.Transform(transRotation);

        var verticesArray = currentMesh.Vertices.ToArray();

        for (int k = 0; k < ns;k++)
        {
          var transDist = initTrans + (k + 1) * gact.Nodes[j][1] * hwin / ns;

        }

        veniMesh.Add(currentMesh, p1);
      }
    }



    venitShade = veniMesh;
# ---------- end c_script_7 ----------

# ----
# Seasonal coeficient
c_script_8 = CSharpScript(
    SD_sum=Slider(1, range=0..10),
    VW_sum=Slider(2, range=0..10),
    GL_sum=Slider(1, range=0..10),
    SD_win=Slider(1, range=0..10),
    VW_win=Slider(3, range=0..10),
    GL_win=Slider(1, range=0..10))  # -> out, winterCoef, summerCoef; inputs SD_sum: Double, VW_sum: Double, GL_sum: Double, SD_win: Double, VW_win: Double, GL_win: Double
# ---------- c_script_8: C# ----------
    var shade_sum = (double) SD_sum;
    var view_sum = (double) VW_sum;
    var glare_sum = (double) GL_sum;
    var shade_win = (double) SD_win;
    var view_win = (double) VW_win;
    var glare_win = (double) GL_win;

    double sum_summer = shade_sum + view_sum + glare_sum;
    double sum_winter = shade_win + view_win + glare_win;

    shade_sum = shade_sum / sum_summer;
    view_sum = view_sum / sum_summer;
    glare_sum = glare_sum / sum_summer;

    shade_win = shade_win / sum_winter;
    view_win = view_win / sum_winter;
    glare_win = glare_win / sum_winter;


    string sumC = shade_sum.ToString() + ",-" + view_sum.ToString() + "," + glare_sum.ToString();
    string winC = "-" + shade_win.ToString() + ",-" + view_win.ToString() + "," + glare_win.ToString();

    winterCoef = winC;
    summerCoef = sumC;
# ---------- end c_script_8 ----------
panel_7 = Panel(c_script_8.winterCoef)
panel_8 = Panel(c_script_8.summerCoef)
winter_period_start = Panel("8472")
winter_period_end = Panel("1872")
seasoncoef = SeasonalParsingAndWeighing(
    SunHours=num_2,
    StartOfWinterPeriod=winter_period_start,
    EndOfWinterPeriod=winter_period_end,
    WinterWeightString=panel_7,
    SummerWeightString=panel_8)

multiplication_5 = Multiplication(A=vec_2, B=-1)
mesh_4 = MeshBrep(Settings={GridMaxCount=0, GridMinCount=16, JaggedSeams=False, MaxEdgeLength=0, MinEdgeLength=0.0001, MinTolerance=0, Refine=True, RefineAngle=0, RelativeTolerance=0.65, SimplePlanes=True, Tolerance=0})
panel_9 = Panel(c_script_7.out)
refine_7 = Refine(Mesh=mesh_4, Level=Slider(3, range=0..10))
item_7 = ListItem(Index="24", Wrap=True)
mesh_5 = Mesh()
c_script_9 = CSharpScript()  # -> out, A; inputs x: tree of Mesh
# ---------- c_script_9: C# ----------
    var tt = (DataTree<Mesh>) x;

    var com = new DataTree<String>();


    for (int i = 0;i < tt.BranchCount;i++)
    {
      var p1 = new GH_Path(i);

      for  (int j = 0;j < tt.Branch(i).Count;j++)
      {
        if (!tt.Branch(i)[j].IsValid) com.Add("mesh " + j.ToString() + " of branch " + i.ToString() + " is not valid");
      }
    }
    
    A = com;
# ---------- end c_script_9 ----------
panel_10 = Panel(c_script_9.A)
matlab_exe_sp4 = FilePath("C:\Program Files\MATLAB\R2016b\bin\matlab.exe")
number_slider_10 = Slider(0, range=0..6)  # disabled

# ----
# Shade
# View
# Glare
wall_left = Mesh(refine_2)
floor = Mesh(refine_3)
back_wall = Mesh(refine_5)
vec_5 = Vector(multiplication_5)
wall_right = Mesh(refine_4)
mesh_6 = Mesh(mesh)
mesh_7 = Mesh(mesh_5)
vec_6 = Vector(multiplication_5)
vec_7 = Vector(facen.Normals)
shadeassess = ShadeAssessment(WindowPanelMesh=mesh_6, ShadeModuleMesh=mesh_7, ProjectionVector=vec_6, LaunchTheAnalysis=Toggle(False))  # -> MeshOfExposedWindowsSurface, AreaOfExposed, CommentOnOperationType, DebugMeshcutter, DebugHull
source = Mesh(shadeassess.MeshOfExposedWindowsSurface)
shadeassess_2 = ShadeAssessment(WindowPanelMesh=mesh_6, ShadeModuleMesh=mesh_7, ProjectionVector=vec_7, LaunchTheAnalysis=Toggle(False))  # -> MeshOfExposedWindowsSurface, AreaOfExposed, CommentOnOperationType, DebugMeshcutter, DebugHull
mesh_8 = Mesh(shadeassess.MeshOfExposedWindowsSurface)
num_3 = Number(shadeassess.AreaOfExposed)
mesh_9 = Mesh(shadeassess_2.MeshOfExposedWindowsSurface)
num_4 = Number(shadeassess_2.AreaOfExposed)

c_script_10 = CSharpScript(x=num_3)  # -> out, A; inputs x: tree of Double
# ---------- c_script_10: C# ----------
    var t = (DataTree<double>) x;
    bool output = false;

    if (t.BranchCount >= 1) {output = true;}

    A = output;
# ---------- end c_script_10 ----------

# ---- group: wall 1
glareassess = GlareOnWallPanel(WallPanel=wall_right, SourceOutline=source, ProjectionDirectionVector=vec_5, LaunchTheAnalysis=c_script_10.A)  # -> MeshOfGlareOnTheWallPanel, AreaOfGlareOnTheWallPanel, CommentOnOperationType, DebugMeshcutter

# ----
c_script_11 = CSharpScript(x=glareassess.AreaOfGlareOnTheWallPanel)  # -> out, A; inputs x: tree of Double; same code as c_script_10

# ---- group: Wall 2
glareassess_2 = GlareOnWallPanel(WallPanel=wall_left, SourceOutline=source, ProjectionDirectionVector=vec_5, LaunchTheAnalysis=c_script_11.A)  # -> MeshOfGlareOnTheWallPanel, AreaOfGlareOnTheWallPanel, CommentOnOperationType, DebugMeshcutter

# ----
c_script_12 = CSharpScript(x=glareassess_2.AreaOfGlareOnTheWallPanel)  # -> out, A; inputs x: tree of Double; same code as c_script_10

# ---- group: Floor
glareassess_3 = GlareOnWallPanel(WallPanel=floor, SourceOutline=source, ProjectionDirectionVector=vec_5, LaunchTheAnalysis=c_script_12.A)  # -> MeshOfGlareOnTheWallPanel, AreaOfGlareOnTheWallPanel, CommentOnOperationType, DebugMeshcutter

# ----
c_script_13 = CSharpScript(x=glareassess_3.AreaOfGlareOnTheWallPanel)  # -> out, A; inputs x: tree of Double; same code as c_script_10

# ---- group: back wall
glareassess_4 = GlareOnWallPanel(WallPanel=back_wall, SourceOutline=source, ProjectionDirectionVector=vec_5, LaunchTheAnalysis=c_script_13.A)  # -> MeshOfGlareOnTheWallPanel, AreaOfGlareOnTheWallPanel, CommentOnOperationType, DebugMeshcutter

# ----
addition_3 = Addition(
    A=glareassess.AreaOfGlareOnTheWallPanel,
    B=glareassess_2.AreaOfGlareOnTheWallPanel,
    C=glareassess_3.AreaOfGlareOnTheWallPanel,
    D=glareassess_4.AreaOfGlareOnTheWallPanel)
num_5 = Number(addition_3)

number_slider_11 = Slider(1, range=0..10)  # disabled
number_slider_12 = Slider(2245, range=0..2442)  # disabled
item_8 = ListItem(List=mesh_8, Index=number_slider_12, Wrap=True)  # disabled
# Debug
item_9 = ListItem(List=vec_2, Index=number_slider_12, Wrap=True)  # disabled
viewer = ParamViewer(glareassess.MeshOfGlareOnTheWallPanel)  # disabled
item_10 = ListItem(List=viewer, Index=number_slider_11, Wrap=True)  # disabled
branch = TreeBranch(Tree=glareassess.MeshOfGlareOnTheWallPanel, Path=item_10, MaintainPaths=True)  # disabled
branch_2 = TreeBranch(Tree=glareassess_2.MeshOfGlareOnTheWallPanel, Path=item_10, MaintainPaths=True)  # disabled
branch_3 = TreeBranch(Tree=glareassess_3.MeshOfGlareOnTheWallPanel, Path=item_10, MaintainPaths=True)  # disabled
branch_4 = TreeBranch(Tree=glareassess_4.MeshOfGlareOnTheWallPanel, Path=item_10, MaintainPaths=True)  # disabled
item_11 = ListItem(List=branch, Index=number_slider_12, Wrap=True)  # disabled
projecta = ProjectAlong(Geometry=item_8, Plane=rotate.Geometry, Direction=item_9)  # -> Geometry, Transform; disabled
item_12 = ListItem(List=branch_2, Index=number_slider_12, Wrap=True)  # disabled
item_13 = ListItem(List=branch_3, Index=number_slider_12, Wrap=True)  # disabled
medges_5 = MeshEdges(Mesh=item_8)  # -> NakedEdges, InteriorEdges, NonManifoldEdges; disabled
item_14 = ListItem(List=branch_4, Index=number_slider_12, Wrap=True)  # disabled
vdis_2 = VectorDisplay(Anchor=facen.Centers, Vector=item_9)  # disabled
item_15 = ListItem(List=glareassess.DebugMeshcutter, Index=number_slider_12, Wrap=True)  # disabled

# ----
# Create Matlab analysis files
number_slider_13 = Slider(0, range=0..20)
path = FilePath("C:\Documents\GitHub\SunToolGH\dev\data_fit\")
grid_3 = Grid(grid.Grid)
c_script_14 = CSharpScript(
    Shade=num_3,
    View=num_4,
    Glare=num_5,
    seasonCoefs=seasoncoef,
    normalizationMin=number_slider_13,
    normalizationMax=Slider(1, range=0..20),
    act=grid_3,
    workdir=path,
    Reference="C:\USERS\ADMIN\APPDATA\ROAMING\GRASSHOPPER\LIBRARIES\IvyCore.dll")  # -> out; inputs Shade: tree of Double, View: tree of Double, Glare: tree of Double, seasonCoefs: list of String, normalizationMin: Double, normalizationMax: Double, workdir: String
# ---------- c_script_14: C# ----------
    var tree_output1 = (DataTree<double>) Shade;
    var tree_output2 = (DataTree<double>) View;
    var tree_output3 = (DataTree<double>) Glare;
    var list_output1 = (List<string>) seasonCoefs;
    var minNorm = (double) normalizationMin;
    var maxNorm = (double) normalizationMax;
    var workingDir = (string) workdir;
    var gact = (IvyCore.MultiDimGrid.Grid) act;




    int nb = tree_output1.BranchCount;

    var filePath1 = workingDir + "\\gh-" + "shade" + ".csv";
    var filePath2 = workingDir + "\\gh-" + "view" + ".csv";
    var filePath3 = workingDir + "\\gh-" + "glare" + ".csv";
    var filePath4 = workingDir + "\\gh-" + "actuation" + ".csv";
    var filePath5 = workingDir + "\\gh-" + "seasonalCoefficients" + ".csv";

    System.Text.StringBuilder csv1 = new System.Text.StringBuilder();
    System.Text.StringBuilder csv2 = new System.Text.StringBuilder();
    System.Text.StringBuilder csv3 = new System.Text.StringBuilder();
    System.Text.StringBuilder csv4 = new System.Text.StringBuilder();
    System.Text.StringBuilder csv5 = new System.Text.StringBuilder();


    //Normalization of trees
    NormalizeDatatree(tree_output1, minNorm, maxNorm);
    NormalizeDatatree(tree_output2, minNorm, maxNorm);
    NormalizeDatatree(tree_output3, minNorm, maxNorm);


    //write actuation file

    for (int j = 0;j < gact.NodeCount;j++)
    {
      var newline = string.Format("{0},{1}", gact.Nodes[j][0].ToString(), gact.Nodes[j][1].ToString());
      csv4.AppendLine(newline);
    }
    System.IO.File.WriteAllText(filePath4, csv4.ToString());

    //write actuation file

    for (int j = 0;j < list_output1.Count;j++)
    {
      var newline = string.Format("{0}", list_output1[j]);
      csv5.AppendLine(newline);
    }
    System.IO.File.WriteAllText(filePath5, csv5.ToString());


    //write shade, view & glare csv files
    for (int i = 0;i < nb;i++)
    {

      //populate shade files
      string newline1 = "";
      for (int j = 0;j < tree_output1.Branch(i).Count;j++)
      {
        if (j + 1 < tree_output1.Branch(i).Count)
        {
          newline1 += tree_output1.Branch(i)[j].ToString() + ",";
        }
        else
        {
          newline1 += tree_output1.Branch(i)[j].ToString();
        }
      }
      csv1.AppendLine(newline1);

      //populate view files
      string newline2 = "";
      for (int j = 0;j < tree_output1.Branch(i).Count;j++)
      {
        if (j + 1 < tree_output1.Branch(i).Count)
        {
          newline2 += tree_output2.Branch(i)[0].ToString() + ",";
        }
        else
        {
          newline2 += tree_output2.Branch(i)[0].ToString();
        }
      }
      csv2.AppendLine(newline2);

      //populate glare files
      string newline3 = "";
      for (int j = 0;j < tree_output3.Branch(i).Count;j++)
      {
        if (j + 1 < tree_output3.Branch(i).Count)
        {
          newline3 += tree_output3.Branch(i)[j].ToString() + ",";
        }
        else
        {
          newline3 += tree_output3.Branch(i)[j].ToString();
        }
      }
      csv3.AppendLine(newline3);

    }

    System.IO.File.WriteAllText(filePath1, csv1.ToString());
    System.IO.File.WriteAllText(filePath2, csv2.ToString());
    System.IO.File.WriteAllText(filePath3, csv3.ToString());


    //GH OUTPUT COMMENTS
    Print("OUTPUT DIR : " + workingDir);
    Print("PROCESS EXIT");
# ---------- c_script_14: C# additional code ----------
  private static DataTree<double> NormalizeDatatree(DataTree < double > tree, double min, double max)
  {
    double treemax = tree.AllData().Max();
    double treemin = tree.AllData().Min();
    double range = treemax - treemin;

    for (int i = 0;i < tree.BranchCount;i++)
    {
      var currentBrancha = new double[tree.Branch(i).Count];
      tree.Branch(i).CopyTo(currentBrancha);
      tree.Branch(i).Clear();
      tree.Branch(i).AddRange(NormalizeList(ArrayToList(currentBrancha), treemin, treemax, min, max));
    }

    return tree;
  }


  private static List<double> NormalizeList(List<double> data, double glmin, double glmax, double min, double max)
  {
    double dataMax = glmax;
    double dataMin = glmin;
    double range = dataMax - dataMin;

    return data
      .Select(d => (d - dataMin) / range)
      .Select(n => (double) ((1 - n) * min + n * max))
      .ToList();
  }

  private static List<double> ArrayToList(double[] data)
  {
    List<double> datalist = new List<double>(data.Length);
    for (int i = 0;i < data.Length;i++)
    {
      datalist.Add(data[i]);
    }
    return datalist;
  }
# ---------- end c_script_14 ----------
panel_11 = Panel(c_script_14)

panel_12 = Panel("outMatlab.csv")  # disabled
workingdir = FilePath(path)  # disabled
timer = Timer(TimerInterval=10000, Target=concat)  # disabled
concat = Concatenate(FragmentA=workingdir, FragmentB=panel_12)  # disabled
# Visualize data
panel_13 = Panel(concat)  # disabled
c_script_15 = CSharpScript(x=concat)  # -> out, A, B; inputs x: String; disabled
# ---------- c_script_15: C# ----------
    var filePath = (string) x;
    var reader = new StreamReader(filePath);

    List<string> listA = new List<string>();
    List<string> listB = new List<string>();

    while (!reader.EndOfStream)
    {
      var line = reader.ReadLine();
      var values = line.Split(',');

      listA.Add(values[0]);
      listB.Add(values[1]);
    }

    A = listA;
    B = listB;
# ---------- end c_script_15 ----------
num_6 = Number([4.8784e-06, 1.0894e-05, 4.5657e-05, 3.5625, 7.2872, 5.2224])  # disabled
num_7 = Number([1, 1, 1, 1, 1, 1])  # disabled
window_height = Number(number_slider_2)  # disabled
crv_2 = Curve(item_2)  # disabled
window_normal = Vector(facen.Normals)  # disabled
extension_of_rolling_shade = Panel(c_script_15.B)  # disabled
angle_of_shade = Panel(c_script_15.A)  # disabled
top_rolling_shade = CSharpScript(
    act1=c_script_15.A,
    act2=c_script_15.B,
    hwindow=window_height,
    N=window_normal,
    tedge=crv_2,
    Reference="C:\USERS\ADMIN\APPDATA\ROAMING\GRASSHOPPER\LIBRARIES\IvyCore.dll")  # -> out, V, S; inputs act1: list of Double, act2: list of Double, hwindow: Double, N: Vector3d, tedge: Curve; disabled
# ---------- top_rolling_shade: C# ----------
    var normal = (Vector3d) N;
    var hwin = (double) hwindow;
    var Act1 = (List<double>) act1;
    var Act2 = (List<double>) act2;
    var top = (Curve) tedge;

    var surf = new List<GH_Surface>();

    var nn = Act1.Count;
    var vec = new List<Vector3d>();
    var origin = new Point3d(0.0, 0.0, 0.0);
    var rotaxis = Vector3d.CrossProduct(normal, new Vector3d(0.0, 0.0, -1.0));

    for (int i = 0;i < nn;i++)
    {
      var ag = -Math.PI * Act1[i] / 180;
      var ext = Act2[i];

      var current_vec = new Vector3d(0.0, 0.0, -1.0);

      current_vec.Transform(Transform.Rotation(ag, rotaxis, origin));
      current_vec = ext * (hwin) * current_vec;

      var current_surf = Rhino.Geometry.Extrusion.CreateExtrusion(top, current_vec);

      vec.Add(current_vec);
      surf.Add(new Grasshopper.Kernel.Types.GH_Surface(current_surf));

    }

    V = vec;
    S = surf;
# ---------- end top_rolling_shade ----------
srf = Surface(top_rolling_shade.S)  # disabled

matlab_exe_work = FilePath("C:\Program Files\MATLAB\R2016a\bin\matlab.exe")
# Launch Matlab analysis
workingdir_2 = FilePath(path)
concat_2 = Concatenate(FragmentA=workingdir_2, FragmentB="optimization.m")
lanch = Button()
panel_14 = Panel(workingdir_2)
c_script_16 = CSharpScript(path_to_m=concat_2, path_to_exe=matlab_exe_sp4, launch=lanch)  # -> out, A; inputs path_to_exe: String, launch: Boolean
# ---------- c_script_16: C# ----------
    string pathtoexe = (string) path_to_exe;
    string pathtofile = (string) path_to_m;

    string dir = System.IO.Path.GetDirectoryName(path_to_m.ToString());
    string filename = System.IO.Path.GetFileName(path_to_m.ToString());


    if (launch)
    {
      System.Diagnostics.Process p = new System.Diagnostics.Process();

      p.StartInfo.FileName = pathtoexe;
      p.StartInfo.WorkingDirectory = dir + "\\";
      p.StartInfo.Arguments = "/wait /nodisplay /nojvm /nosplash /nodesktop /r \"try, run('" + pathtofile + "\"'),catch,exit,end,exit\"";
      p.StartInfo.Verb = "runas";

      p.Start();
      p.WaitForExit();


    }
    //GH OUTPUT COMMENTS
    Print("MATLAB EXE : " + path_to_exe);
    Print("SCRIPT DIR : " + dir);
    Print("SCRIPT FILE : " + filename);
    Print("PROCESS EXIT");
# ---------- end c_script_16 ----------
panel_15 = Panel(c_script_16.out)

panel_16 = Panel(srf)  # disabled
item_16 = ListItem(List=srf, Index=0, Wrap=True)  # disabled
