# Grasshopper definition debug_aux.gh (Grasshopper 0.9.76)
# plug-ins: SunTools

panel = Panel("""0
0.5""")
number_slider = Slider(1, range=0..2)
dom = ConstructDomain(DomainStart=Slider(-2, range=-2..10), DomainEnd=Slider(2, range=-2..10))
pt = ConstructPoint(XCoordinate=Slider(-0.2289, range=-2..10), YCoordinate=panel, ZCoordinate=0)
dom_2 = ConstructDomain(DomainStart=expr("-x", number_slider), DomainEnd=number_slider)
rectangle = Rectangle(Plane=PlaneXY(0, 0, 0), XSize=dom, YSize=dom, Radius=0)  # -> Rectangle, Length
xy = XYPlane(Origin=pt)
rad = Radians(Degrees=Slider(77, range=0..100))
rectangle_2 = Rectangle(Plane=xy, XSize=dom_2, YSize=dom_2, Radius=0)  # -> Rectangle, Length
cir = Circle(Plane=xy, Radius=number_slider)
rotate = Rotate(Geometry=rectangle_2.Rectangle, Angle=rad, Plane=xy)  # -> Geometry, Transform
crv = Curve(rotate.Geometry)
crv_2 = Curve(rectangle.Rectangle)
xy_2 = XYPlane(Origin=Point(0, 0, 0))
item = ListItem(List=crv, Index=Slider(0, range=0..1), Wrap=True)
runion = RegionUnion(Curves=crv, Plane=xy_2)
rdiff = RegionDifference(CurvesA=crv_2, CurvesB=crv)
mesh = MeshBrep(
    Brep=crv,
    Settings={GridMaxCount=0, GridMinCount=16, JaggedSeams=False, MaxEdgeLength=0, MinEdgeLength=0.0001, MinTolerance=0, Refine=True, RefineAngle=0, RelativeTolerance=0.65, SimplePlanes=True, Tolerance=0})  # disabled
mesh_2 = MeshBrep(
    Brep=crv_2,
    Settings={GridMaxCount=0, GridMinCount=16, JaggedSeams=False, MaxEdgeLength=0, MinEdgeLength=0.0001, MinTolerance=0, Refine=True, RefineAngle=0, RelativeTolerance=0.65, SimplePlanes=True, Tolerance=0})  # disabled
rinter = RegionInter(CurvesA=crv, CurveB=crv_2, Plane=xy_2)  # -> ResultingIntersection, AreaOfResultingRegion, CommentOnIntersectionType
regiondiff = BooleanDifferenceOfCoPlanarCurves(Curve1=crv_2, Curve2=crv, Plane=xy_2)  # -> DifferenceRegionC1MinusC2, AreaOfResultingRegion, CommentOnDifferenceType
mdif = MeshDifference(MeshesA=mesh, MeshesB=mesh_2)  # disabled
item_2 = ListItem(List=regiondiff.DifferenceRegionC1MinusC2, Index=Slider(0, range=0..1), Wrap=True)  # disabled
boundary = BoundarySurfaces(Edges=regiondiff.DifferenceRegionC1MinusC2)
preview = CustomPreview(Geometry=regiondiff.DifferenceRegionC1MinusC2, Shader=ColourSwatch(SwatchColor=RGB(255, 0, 179)))
boundary_2 = BoundarySurfaces(Edges=[crv, crv_2])
panel_2 = Panel(regiondiff.AreaOfResultingRegion)
panel_3 = Panel(regiondiff.CommentOnDifferenceType)
edges = BrepEdges(Brep=boundary_2)  # -> Naked, Interior, NonManifold
crv_3 = Curve(edges.Naked)
