# Grasshopper definition debug_convexhull.gh (Grasshopper 0.9.76)

pop2d = Populate2D(Region={Plane=PlaneXY(0, 0, 0), Size=Domain2(u=0..20, v=0..10)}, Count=Slider(100, range=0..100), Seed=1)
number_slider = Slider(10, range=0..10)
del = DelaunayMesh(Points=pop2d, Plane=PlaneXY(0, 0, 0))
pt = ConstructPoint(XCoordinate=number_slider, YCoordinate=number_slider, ZCoordinate=0)
xy = XYPlane(Origin=pt)
xy_2 = XYPlane(Origin=Point(0, 0, 0))
c_script = CSharpScript(x=del, y=xy_2, z=xy, Reference="C:\Users\admin\AppData\Roaming\Grasshopper\Libraries\MIConvexHull.dll")  # -> out, A, B, C, D, E; inputs x: Mesh, y: Plane, z: Plane
# ---------- c_script: C# ----------
    var msh = (Mesh) x;
    var pl1 = (Plane) y;
    var pl2 = (Plane) z;

    var mshPts = msh.Vertices.ToPoint3dArray();

    A = mshPts;

    ///////////////////////////////////////////////////////////////////////////////////////
    var vertices = new Vertex[msh.Vertices.Count];

    for (int i = 0;i < msh.Vertices.Count;i++)
    {
      vertices[i] = new Vertex(mshPts[i].X, mshPts[i].Y);
    }

    B = vertices;
    ////////////////////////////////////////////////////////////////////////////////////////

    var convexHull = ConvexHull.Create(vertices);

    C = convexHull.Points;

    ///////////////////////////////////////////////////////////////////////////////////////
    double[][] hullPoints = convexHull.Points.Select(p => p.Position).ToArray();
    var ptsLst = DoubleArraytoPts3dList(hullPoints);

    D = ptsLst;

    var basisCHG = new Transform();
    basisCHG = Transform.ChangeBasis(pl1, pl2);

    msh.Transform(basisCHG);
    E = msh.Vertices;
# ---------- c_script: C# additional code ----------
  /// <summary>
  /// A vertex is a simple class that stores the postion of a point, node or vertex.
  /// </summary>
  public class Vertex : IVertex
  {
    /// <summary>
    /// Initializes a new instance of the <see cref="Vertex"/> class.
    /// </summary>
    /// <param name="x">The x position.</param>
    /// <param name="y">The y position.</param>
    /// <param name="z">The z position.</param>
    public Vertex(double x, double y)
    {
      Position = new double[2] { x, y };
    }

    public double[] Position { get; set; }
  }

  public List<Point3d> DoubleArraytoPts3dList(Double[][] vrtxList)
  {
    var LstPts3D = new List<Point3d>();
    for (int i = 0; i < vrtxList.Length; i++)
    {
      LstPts3D.Add(new Point3d(vrtxList[i][0], vrtxList[i][1], 0));
    }
    return LstPts3D;
  }
# ---------- end c_script ----------
panel = Panel(c_script.out)
panel_2 = Panel(c_script.A)
panel_3 = Panel(c_script.B)
panel_4 = Panel(c_script.C)
panel_5 = Panel(c_script.E)
pt_2 = Point(c_script.D)
pline = PolyLine(Vertices=pt_2, Closed=Toggle(True))
c_script_2 = CSharpScript(x=del, y=xy_2, z=xy, Reference="C:\Users\admin\AppData\Roaming\Grasshopper\Libraries\MIConvexHull.dll")  # -> out, A, B, C, D, E; inputs x: Mesh, y: Plane, z: Plane
# ---------- c_script_2: C# ----------
    var msh = (Mesh) x;
    var pl1 = (Plane) y;
    var pl2 = (Plane) z;

    var mshPts = msh.Vertices.ToPoint3dArray();

    A = mshPts;

    ///////////////////////////////////////////////////////////////////////////////////////
    var vertices = new Vertex[msh.Vertices.Count];

    for (int i = 0;i < msh.Vertices.Count;i++)
    {
      vertices[i] = new Vertex(mshPts[i]);
    }

    B = vertices;
    ////////////////////////////////////////////////////////////////////////////////////////

    var convexHull = ConvexHull.Create<Vertex>(vertices);
# ---------- c_script_2: C# additional code ----------
  /// <summary>
  /// A vertex is a simple class that stores the postion of a point, node or vertex.
  /// </summary>
  public class Vertex : IVertex
  {
    /// <summary>
    /// Initializes a new instance of the <see cref="Vertex"/> class.
    /// </summary>
    /// <param name="x">The x position.</param>
    /// <param name="y">The y position.</param>
    /// <param name="z">The z position.</param>
    public Vertex(double x, double y, double z)
    {
      Position = new double[3] { x, y, z };
    }
    public Vertex(Point3d point)
    {
      Position = new double[3] { point.X, point.Y, point.Z };
    }


    public double[] Position { get; set; }
  }

  /// <summary>
  /// A vertex is a simple class that stores the postion of a point, node or vertex.
  /// </summary>
  public class Face : ConvexFace<Vertex, Face>
  {

  }

  public List<Point3d> DoubleArraytoPts3dList(Double[][] vrtxList)
  {
    var LstPts3D = new List<Point3d>();
    for (int i = 0; i < vrtxList.Length; i++)
    {
      LstPts3D.Add(new Point3d(vrtxList[i][0], vrtxList[i][1], 0));
    }
    return LstPts3D;
  }
# ---------- end c_script_2 ----------
panel_6 = Panel(c_script_2.out)
panel_7 = Panel(c_script_2.A)
panel_8 = Panel(c_script_2.B)
