# Grasshopper definition debug_convexhull.gh (Grasshopper 0.9.76)

pop2d = Populate2D(Region={Plane=PlaneXY(0, 0, 0), Size=Domain2(u=0..20, v=0..10)}, Count=Slider(100, range=0..100), Seed=1)
number_slider = Slider(10, range=0..10)
del = DelaunayMesh(Points=pop2d, Plane=PlaneXY(0, 0, 0))
pt = ConstructPoint(XCoordinate=number_slider, YCoordinate=number_slider, ZCoordinate=0)
xy = XYPlane(Origin=pt)
xy_2 = XYPlane(Origin=Point(0, 0, 0))
c_script = CSharpScript(x=del, y=xy_2, z=xy, Reference="C:\Users\victor\AppData\Roaming\Grasshopper\Libraries\MIConvexHull.dll")  # -> out, A, B, C, D, E; inputs x: Mesh, y: Plane, z: Plane
# ---------- c_script: C# ----------
    var msh = (Mesh) x;
    var pl1 = (Plane) y;
    var pl2 = (Plane) z;

    var mshPts = msh.Vertices.ToPoint3dArray();

    A = mshPts;

    ///////////////////////////////////////////////////////////////////////////////////////
    var vertices = new Vertex[msh.Vertices.Count];

    for (int i = 0;i < msh.Vertices.Count;i++)
    {
      vertices[i] = new Vertex(mshPts[i].X, mshPts[i].Y);
    }

    B = vertices;
    ////////////////////////////////////////////////////////////////////////////////////////

    var convexHull = ConvexHull.Create(vertices);

    C = convexHull.Points;

    ///////////////////////////////////////////////////////////////////////////////////////
    double[][] hullPoints = convexHull.Points.Select(p => p.Position).ToArray();
    var ptsLst = DoubleArraytoPts3dList(hullPoints);

    D = ptsLst;

    var basisCHG = new Transform();
    basisCHG = Transform.ChangeBasis(pl1, pl2);

    msh.Transform(basisCHG);
    E = msh.Vertices;
# ---------- c_script: C# additional code ----------
  /// <summary>
  /// A vertex is a simple class that stores the postion of a point, node or vertex.
  /// </summary>
  public class Vertex : IVertex
  {
    /// <summary>
    /// Initializes a new instance of the <see cref="Vertex"/> class.
    /// </summary>
    /// <param name="x">The x position.</param>
    /// <param name="y">The y position.</param>
    /// <param name="z">The z position.</param>
    public Vertex(double x, double y)
    {
      Position = new double[2] { x, y };
    }

    public double[] Position { get; set; }
  }

  public List<Point3d> DoubleArraytoPts3dList(Double[][] vrtxList)
  {
    var LstPts3D = new List<Point3d>();
    for (int i = 0; i < vrtxList.Length; i++)
    {
      LstPts3D.Add(new Point3d(vrtxList[i][0], vrtxList[i][1], 0));
    }
    return LstPts3D;
  }
# ---------- end c_script ----------
panel = Panel(c_script.out)
panel_2 = Panel(c_script.A)
panel_3 = Panel(c_script.B)
panel_4 = Panel(c_script.C)
panel_5 = Panel(c_script.E)
pt_2 = Point(c_script.D)
vec = VectorXYZ(XComponent=Slider(1, range=-10..10), YComponent=Slider(1, range=-10..10), ZComponent=Slider(1, range=-10..10))  # -> Vector, Length
pline = PolyLine(Vertices=pt_2, Closed=Toggle(True))
pl = PlaneNormal(Origin=Point(0, 0, 0), ZAxis=vec.Vector)
rectangle = Rectangle(Plane=pl, XSize=Domain(-1, 1), YSize=Domain(-2, 2), Radius=0)  # -> Rectangle, Length
pop2d_2 = Populate2D(Region=rectangle.Rectangle, Count=Slider(20, range=0..100), Seed=1)
c_script_2 = CSharpScript(x=del, y=xy_2, z=xy, Reference="C:\USERS\VICTOR\APPDATA\ROAMING\GRASSHOPPER\LIBRARIES\MIConvexHull.dll")  # -> out, A, B, C, D, E; inputs x: Mesh, y: Plane, z: Plane
# ---------- c_script_2: C# ----------
    var msh = (Mesh) x;
    var pl1 = (Plane) y;
    var pl2 = (Plane) z;

    var mshPts = msh.Vertices.ToPoint3dArray();

    A = mshPts;

    ///////////////////////////////////////////////////////////////////////////////////////
    var vertices = new Vertex[msh.Vertices.Count];

    for (int i = 0;i < msh.Vertices.Count;i++)
    {
      vertices[i] = new Vertex(mshPts[i]);
    }

    B = vertices;
    ////////////////////////////////////////////////////////////////////////////////////////

    //var convexHull = ConvexHull.Create<Vertex>(vertices);
# ---------- c_script_2: C# additional code ----------
  /// <summary>
  /// A vertex is a simple class that stores the postion of a point, node or vertex.
  /// </summary>
  public class Vertex : IVertex
  {
    /// <summary>
    /// Initializes a new instance of the <see cref="Vertex"/> class.
    /// </summary>
    /// <param name="x">The x position.</param>
    /// <param name="y">The y position.</param>
    /// <param name="z">The z position.</param>
    public Vertex(double x, double y, double z)
    {
      Position = new double[3] { x, y, z };
    }
    public Vertex(Point3d point)
    {
      Position = new double[3] { point.X, point.Y, point.Z };
    }


    public double[] Position { get; set; }
  }

  /// <summary>
  /// A vertex is a simple class that stores the postion of a point, node or vertex.
  /// </summary>
  public class Face : ConvexFace<Vertex, Face>
  {

  }

  public List<Point3d> DoubleArraytoPts3dList(Double[][] vrtxList)
  {
    var LstPts3D = new List<Point3d>();
    for (int i = 0; i < vrtxList.Length; i++)
    {
      LstPts3D.Add(new Point3d(vrtxList[i][0], vrtxList[i][1], 0));
    }
    return LstPts3D;
  }
# ---------- end c_script_2 ----------
del_2 = DelaunayMesh(Points=pop2d_2, Plane=PlaneXY(0, 0, 0))
demesh = DeconstructMesh(Mesh=del_2)  # -> Vertices, Faces, Colours, Normals
vec_2 = VectorXYZ(XComponent=Slider(1, range=-10..10), YComponent=Slider(1, range=-10..10), ZComponent=Slider(1, range=-10..10))  # -> Vector, Length
c_script_3 = CSharpScript(x=del_2, y=xy_2, z=pl, Reference="C:\USERS\VICTOR\APPDATA\ROAMING\GRASSHOPPER\LIBRARIES\MIConvexHull.dll")  # -> out, A, B, C, D, E; inputs x: Mesh, y: Plane, z: Plane
# ---------- c_script_3: C# ----------
    var msh = (Mesh) x;
    var pl1 = (Plane) y;
    var pl2 = (Plane) z;


    var BChg = Transform.ChangeBasis(pl1, pl2);
    var BChgBack = Transform.ChangeBasis(pl2, pl1);

    msh.Transform(BChg);
    A = msh.Vertices;

    var mshPts = msh.Vertices.ToPoint3dArray();



    ///////////////////////////////////////////////////////////////////////////////////////
    var vertices = new Vertex2D[msh.Vertices.Count];

    for (int i = 0;i < msh.Vertices.Count;i++)
    {
      vertices[i] = new Vertex2D(mshPts[i].X, mshPts[i].Y);
    }

    B = vertices;
    ////////////////////////////////////////////////////////////////////////////////////////

    var convexHull = ConvexHull.Create<Vertex2D>(vertices);

    C = convexHull;



    var hullPts = DoubleArraytoPts3dList(convexHull.Points.Select(p => p.Position).ToArray());

    D = hullPts;

    //Print(hullPts[0].Transform(BChgBack).GetType().ToString());


    var hullPtsWorld = new Point3d[hullPts.Count];
    hullPts.CopyTo(hullPtsWorld);
    Print(hullPtsWorld[0].ToString());
    for (int i = 0;i < hullPts.Count;i++)
    {
      hullPtsWorld[i].Transform(BChgBack);
    }
    Print(hullPtsWorld[0].ToString());
    E = hullPtsWorld;
# ---------- c_script_3: C# additional code ----------
  /// <summary>
  /// A vertex is a simple class that stores the postion of a point, node or vertex.
  /// </summary>
  public class Vertex : IVertex
  {
    /// <summary>
    /// Initializes a new instance of the <see cref="Vertex"/> class.
    /// </summary>
    /// <param name="x">The x position.</param>
    /// <param name="y">The y position.</param>
    /// <param name="z">The z position.</param>
    public Vertex(double x, double y, double z)
    {
      Position = new double[3] { x, y, z };
    }
    public Vertex(Point3d point)
    {
      Position = new double[3] { point.X, point.Y, point.Z };
    }


    public double[] Position { get; set; }
  }

  /// <summary>
  /// A vertex is a simple class that stores the postion of a point, node or vertex.
  /// </summary>
  public class Face : ConvexFace<Vertex, Face>
  {

  }

  public class Vertex2D : IVertex
  {
    /// <summary>
    /// Initializes a new instance of the <see cref="Vertex"/> class.
    /// </summary>
    /// <param name="x">The x position.</param>
    /// <param name="y">The y position.</param>
    /// <param name="z">The z position.</param>
    public Vertex2D(double x, double y)
    {
      Position = new double[2] { x, y };
    }

    public double[] Position { get; set; }



  }

  public List<Point3d> DoubleArraytoPts3dList(Double[][] vrtxList)
  {
    var LstPts3D = new List<Point3d>();
    for (int i = 0; i < vrtxList.Length; i++)
    {
      LstPts3D.Add(new Point3d(vrtxList[i][0], vrtxList[i][1], 0));
    }
    return LstPts3D;
  }
# ---------- end c_script_3 ----------
project = Project(Geometry=demesh.Vertices, Plane=pl)  # -> Geometry, Transform
c_script_4 = CSharpScript(
    x=del_2,
    u=project.Geometry,
    y=pl,
    z="1e-3",
    Reference="C:\USERS\VICTOR\APPDATA\ROAMING\GRASSHOPPER\LIBRARIES\MIConvexHull.dll")  # -> out, A, B, C; inputs x: Mesh, u: list of Point3d, y: Plane, z: Double
# ---------- c_script_4: C# ----------
    var msh = (Mesh) x;
    var pl = (Plane) y;
    var tol = (double) z;
    var pts = (List<Point3d>) u;


    var mshPts = msh.Vertices.ToPoint3dArray();
    var planarize = Transform.PlanarProjection(pl);

    ///////////////////////////////////////////////////////////////////////////////////////
    var vertices = new double[msh.Vertices.Count][];
    for (int i = 0; i < msh.Vertices.Count; i++)
    {
      vertices[i] = new[] { pts[i].X, pts[i].Y, pts[i].Z };
      //vertices[i] = new[] { mshPts[i].X, mshPts[i].Y, mshPts[i].Z };
    }

    var convexHull = ConvexHull.Create(vertices, tol);
    var hullPts = DoubleArraytoPts3DList(convexHull.Points.Select(p => p.Position).ToArray());


    A = mshPts;
    B = hullPts;
    C = new Polyline(hullPts);
# ---------- c_script_4: C# additional code ----------
  public List<Point3d> DoubleArraytoPts3DList(Double[][] vrtxArray)
  {
    var lstPts3D = new List<Point3d>();
    if (vrtxArray[0].Length == 2)
    {
      lstPts3D.AddRange(vrtxArray.Select(t => new Point3d(t[0], t[1], 0)));
      return lstPts3D;
    }
    else
    {
      lstPts3D.AddRange(vrtxArray.Select(t => new Point3d(t[0], t[1], t[2])));
      return lstPts3D;
    }
  }
# ---------- end c_script_4 ----------
c_script_5 = CSharpScript(x=del_2, y=xy_2, z=pl, Reference="C:\USERS\VICTOR\APPDATA\ROAMING\GRASSHOPPER\LIBRARIES\MIConvexHull.dll")  # -> out, A, B, C, D, E; inputs x: Point3d, y: Plane, z: Plane
# ---------- c_script_5: C# ----------
    var msh = (Mesh) x;
    var pl1 = (Plane) y;
    var pl2 = (Plane) z;


    var BChg = Transform.ChangeBasis(pl1, pl2);
    var BChgBack = Transform.ChangeBasis(pl2, pl1);

    msh.Transform(BChg);
    A = msh.Vertices;

    var mshPts = msh.Vertices.ToPoint3dArray();



    ///////////////////////////////////////////////////////////////////////////////////////
    var vertices = new Vertex2D[msh.Vertices.Count];

    for (int i = 0;i < msh.Vertices.Count;i++)
    {
      vertices[i] = new Vertex2D(mshPts[i].X, mshPts[i].Y);
    }

    B = vertices;
    ////////////////////////////////////////////////////////////////////////////////////////

    var convexHull = ConvexHull.Create<Vertex2D>(vertices);

    C = convexHull;



    var hullPts = DoubleArraytoPts3dList(convexHull.Points.Select(p => p.Position).ToArray());

    D = hullPts;

    //Print(hullPts[0].Transform(BChgBack).GetType().ToString());


    var hullPtsWorld = new List<Point3d>();
    for (int i = 0;i < hullPts.Count;i++)
    {
      hullPts[i].Transform(BChgBack);
      hullPtsWorld.Add(hullPts[i]);
    }

    hullPts[0].Transform(BChgBack);

    E = hullPts[0];
# ---------- c_script_5: C# additional code ----------
  /// <summary>
  /// A vertex is a simple class that stores the postion of a point, node or vertex.
  /// </summary>
  public class Vertex : IVertex
  {
    /// <summary>
    /// Initializes a new instance of the <see cref="Vertex"/> class.
    /// </summary>
    /// <param name="x">The x position.</param>
    /// <param name="y">The y position.</param>
    /// <param name="z">The z position.</param>
    public Vertex(double x, double y, double z)
    {
      Position = new double[3] { x, y, z };
    }
    public Vertex(Point3d point)
    {
      Position = new double[3] { point.X, point.Y, point.Z };
    }


    public double[] Position { get; set; }
  }

  /// <summary>
  /// A vertex is a simple class that stores the postion of a point, node or vertex.
  /// </summary>
  public class Face : ConvexFace<Vertex, Face>
  {

  }

  public class Vertex2D : IVertex
  {
    /// <summary>
    /// Initializes a new instance of the <see cref="Vertex"/> class.
    /// </summary>
    /// <param name="x">The x position.</param>
    /// <param name="y">The y position.</param>
    /// <param name="z">The z position.</param>
    public Vertex2D(double x, double y)
    {
      Position = new double[2] { x, y };
    }

    public double[] Position { get; set; }



  }

  public List<Point3d> DoubleArraytoPts3dList(Double[][] vrtxList)
  {
    var LstPts3D = new List<Point3d>();
    for (int i = 0; i < vrtxList.Length; i++)
    {
      LstPts3D.Add(new Point3d(vrtxList[i][0], vrtxList[i][1], 0));
    }
    return LstPts3D;
  }
# ---------- end c_script_5 ----------
demesh_2 = DeconstructMesh(Mesh=del_2)  # -> Vertices, Faces, Colours, Normals
panel_6 = Panel(c_script_2.out)
panel_7 = Panel(c_script_2.A)
panel_8 = Panel(c_script_2.B)
pt_3 = Point(c_script_4.A)
pt_4 = Point(c_script_4.B)
crv = Curve(c_script_4.C)
panel_9 = Panel(c_script_3.A)
panel_10 = Panel(c_script_3.B)
project_2 = Project(Geometry=pt_3, Plane=pl)  # -> Geometry, Transform
dist = Distance(PointA=pt_3, PointB=project_2.Geometry)
panel_11 = Panel(c_script_3.C)
panel_12 = Panel(c_script_3.D)
panel_13 = Panel(dist)
pt_5 = Point(c_script_3.D)
panel_14 = Panel(c_script_3.E)
Y = UnitY(Factor=Slider(7, range=0..10))
pt_6 = Point(c_script_3.E)
move = Move(Geometry=pt_6, Motion=Y)  # -> Geometry, Transform
move_2 = Move(Geometry=demesh_2.Vertices, Motion=Y)  # -> Geometry, Transform
pline_2 = PolyLine(Vertices=move.Geometry, Closed=Toggle(True))
panel_15 = Panel(c_script_3.out)
