# Grasshopper definition debug_glareAssess.gh (Grasshopper 0.9.76)
# plug-ins: SunTools

panel = Panel("""-0.30
0.20""")
panel_2 = Panel("""1
-1.3""")
pt = ConstructPoint(XCoordinate=panel, YCoordinate=0, ZCoordinate=panel_2)
pt_2 = ConstructPoint(XCoordinate="3", YCoordinate="3", ZCoordinate=0)
dom = ConstructDomain(DomainStart=Slider(10, range=-10..10), DomainEnd=Slider(-2.5, range=-10..10))
dom_2 = ConstructDomain(DomainStart=Slider(-4.42, range=-10..10), DomainEnd=Slider(2.43, range=-10..10))
yz = YZPlane(Origin=pt_2)
xz = XZPlane(Origin=pt)
dom_3 = ConstructDomain(DomainStart=Slider(-2.3, range=-10..10), DomainEnd=Slider(2.2, range=-10..10))
rectangle = Rectangle(Plane=yz, XSize=dom, YSize=dom_2, Radius=0)  # -> Rectangle, Length
xz_2 = XZPlane(Origin=Point(0, 0, 0))
cir = Circle(Plane=xz, Radius=Slider(0.47, range=0..1))
dom_4 = ConstructDomain(DomainStart=Slider(3.14, range=-10..10), DomainEnd=Slider(2.52, range=-10..10))
rectangle_2 = Rectangle(Plane=xz_2, XSize=dom_3, YSize=dom_3, Radius=0)  # -> Rectangle, Length
boundary = BoundarySurfaces(Edges=rectangle.Rectangle)
rectangle_3 = Rectangle(Plane=xz_2, XSize=dom_3, YSize=dom_4, Radius=0)  # -> Rectangle, Length
crv = Curve([rectangle_2.Rectangle, cir])
crv_2 = Curve(rectangle_3.Rectangle)
boundary_2 = BoundarySurfaces(Edges=crv)
vec = VectorXYZ(XComponent=Slider(6.2, range=-10..10), YComponent=Slider(6.16, range=-10..10), ZComponent=Slider(-1.15, range=-10..10))  # -> Vector, Length
boundary_3 = BoundarySurfaces(Edges=crv_2)
mesh = MeshBrep(
    Brep=boundary_2,
    Settings={GridMaxCount=0, GridMinCount=16, JaggedSeams=False, MaxEdgeLength=0, MinEdgeLength=0.0001, MinTolerance=0, Refine=True, RefineAngle=0, RelativeTolerance=0.65, SimplePlanes=True, Tolerance=0})
unit = UnitVector(Vector=vec.Vector)
mesh_2 = MeshBrep(
    Brep=boundary,
    Settings={GridMaxCount=0, GridMinCount=16, JaggedSeams=False, MaxEdgeLength=0, MinEdgeLength=0.0001, MinTolerance=0, Refine=True, RefineAngle=0, RelativeTolerance=0.65, SimplePlanes=True, Tolerance=0})
mesh_3 = MeshBrep(
    Brep=boundary_3,
    Settings={GridMaxCount=0, GridMinCount=16, JaggedSeams=False, MaxEdgeLength=0, MinEdgeLength=0.0001, MinTolerance=0, Refine=True, RefineAngle=0, RelativeTolerance=0.65, SimplePlanes=True, Tolerance=0})
vdis = VectorDisplay(Anchor=pt, Vector=unit)
mjoin = MeshJoin(Meshes=[mesh, mesh_3])
mesh_4 = Mesh(mjoin)
glareassess = GlareOnWallPanel(WallPanel=mesh_2, SourceOutline=mesh_4, ProjectionDirectionVector=unit, LaunchTheAnalysis=Toggle(True))  # -> OutlineOfGlare, AreaOfExposed, CommentOnOperationType, ProjectedMeshOfGlareForDebugging, MeshCutter
projecta = ProjectAlong(Geometry=mesh_4, Plane=yz, Direction=unit)  # -> Geometry, Transform
mesh_5 = Mesh(glareassess.OutlineOfGlare)
preview = CustomPreview(Geometry=mesh_4, Shader=ColourSwatch(SwatchColor=RGBA(255, 255, 255, 89)))
panel_3 = Panel(glareassess.AreaOfExposed)
panel_4 = Panel(glareassess.CommentOnOperationType)
mesh_6 = Mesh(glareassess.MeshCutter)
c_script = CSharpScript(x=mesh_5)  # -> out; inputs x: Mesh
# ---------- c_script: C# ----------
    var meshtest = (Mesh) x;
    
    Print(meshtest.DisjointMeshCount.ToString());
# ---------- end c_script ----------
preview_2 = CustomPreview(
    Geometry=mesh_5,
    Shader={ambient=RGB(0, 0, 0), diffuse=RGB(255, 105, 180), emission=RGB(76, 32, 54), shine=0.5, specular=RGB(255, 255, 255), transparency=0})
panel_5 = Panel(c_script)
