# Grasshopper definition debug_multi.gh (Grasshopper 0.9.76)

panel = Panel("""-2
3
-1""")
panel_2 = Panel("""-3
1
3""")
dom = ConstructDomain(DomainStart=Slider(-5, range=-5..5), DomainEnd=Slider(5, range=-5..5))
pt = ConstructPoint(XCoordinate=panel_2, YCoordinate=panel, ZCoordinate=0)
rectangle = Rectangle(Plane=PlaneXY(0, 0, 0), XSize=dom, YSize=dom, Radius=0)  # -> Rectangle, Length
cir = Circle(Plane=pt, Radius=Slider(1, range=0..1))
dom_2 = ConstructDomain(DomainStart=Slider(-10, range=-10..10), DomainEnd=Slider(10, range=-10..10))
dom_3 = ConstructDomain(DomainStart=Slider(-10, range=-10..10), DomainEnd=Slider(10, range=-10..10))
crv = Curve(rectangle.Rectangle)
crv_2 = Curve(cir)
crv_3 = Curve(<curve referenced from the Rhino model>)
crv_4 = Curve(<curve referenced from the Rhino model>)
rectangle_2 = Rectangle(Plane=PlaneXY(0, 0, 0), XSize=dom_2, YSize=dom_3, Radius=0)  # -> Rectangle, Length
crv_5 = Curve([crv, crv_2])
crv_6 = Curve(crv_5)
crv_7 = Curve(rectangle_2.Rectangle)
boundary = BoundarySurfaces(Edges=crv_5)
brep = Brep(crv_7)
mesh = MeshBrep(
    Brep=boundary,
    Settings={GridMaxCount=0, GridMinCount=16, JaggedSeams=False, MaxEdgeLength=0, MinEdgeLength=0.0001, MinTolerance=0, Refine=True, RefineAngle=0, RelativeTolerance=0.65, SimplePlanes=True, Tolerance=0})
c_script = CSharpScript(crvs=crv_6)  # -> out, A, B; inputs crvs: list of Curve
# ---------- c_script: C# ----------
    var crv = (List<Curve>) crvs;
    

    Brep[] temp_brep = Brep.CreatePlanarBreps(crv);



    A = temp_brep;
    B = AreaMassProperties.Compute(temp_brep).Area;
# ---------- end c_script ----------
xy = XYPlane(Origin=Point(0, 0, 0))
edges = BrepEdges(Brep=boundary)  # -> Naked, Interior, NonManifold
area = Area(Geometry=mesh)  # -> Area, Centroid
medges = MeshEdges(Mesh=mesh)  # -> NakedEdges, InteriorEdges, NonManifoldEdges
preview = CustomPreview(Geometry=boundary, Shader=ColourSwatch(SwatchColor=RGBA(255, 255, 255, 99)))
c_script_2 = CSharpScript(x=c_script.A, y=crv_7, z=xy)  # -> out, A, B, C; inputs x: Brep, y: Curve, z: Plane
# ---------- c_script_2: C# ----------
    var b1 = (Brep) x;
    var b2 = (Curve) y;
    var pl = (Plane) z;


    var bb1 = b1.GetBoundingBox(true);
    var bb2 = b2.GetBoundingBox(true);

    Print(bb2.Contains(bb1).ToString());

    if (!bb2.Contains(bb1))
    {

      var temp = b1.Split(Brep.CreatePlanarBreps(b2)[0], 0.001);

      var lsrf = new List<Brep>();

      for (int i = 0;i < temp.Length;i++)
      {
        var currentEdge = Curve.JoinCurves(temp[i].DuplicateNakedEdgeCurves(true, false));

        if (currentEdge.Length != 1){return;}

        var centroidBrep = AreaMassProperties.Compute(temp[i]).Centroid;

        PointContainment s2 = b2.Contains(centroidBrep, pl);
        switch (s2)
        {
          case PointContainment.Unset:
            Print("case1");
            //lsrf.Add(null);
            break;
          case PointContainment.Inside:
            Print("case2");
            lsrf.Add(temp[i]);
            break;
          case PointContainment.Outside:
            Print("case3");
            break;
          case PointContainment.Coincident:
            Print("case4");
            //lsrf.Add(null);
            break;
        }
      }

      A = temp;
      B = lsrf;
      //C = AreaMassProperties.Compute(lsrf).Area;
    }
    else
    {
      var temp = b1;
      var lsrf = b1;

      A = temp;
      B = lsrf;
      //C = AreaMassProperties.Compute(lsrf).Area;

    }
# ---------- end c_script_2 ----------
brep_2 = Brep(c_script.A)
c_script_3 = CSharpScript(x=c_script.A, y=crv_7, z=xy)  # -> out, A, B, C; inputs x: Brep, y: Curve, z: Plane
# ---------- c_script_3: C# ----------
    var b1 = (Brep) x;
    var b2 = (Curve) y;
    var pl = (Plane) z;


    var bb1 = b1.GetBoundingBox(true);
    var bb2 = b2.GetBoundingBox(true);
    
    

    Print(bb2.Contains(bb1).ToString());

    if (!bb2.Contains(bb1))
    {
      var un = BoundingBox.Union(bb1, bb2);
      var test = un.IsValid;
      var edge = new Polyline(un.GetCorners());

      Print(un.IsValid.ToString());

      A = un;
      B = test;
      C = edge;
    }
    else
    {
      var un = bb2;
      var test = false;
      var edge = new Polyline(un.GetCorners());

      A = un;
      B = test;
      C = edge;

    }
# ---------- end c_script_3 ----------
c_script_4 = CSharpScript(x=c_script.A, y=crv_7, z=xy)  # -> out, box1, box2, eb1, eb2; inputs x: Brep, y: Curve, z: Plane
# ---------- c_script_4: C# ----------
    var b1 = (Brep) x;
    var b2 = (Curve) y;
    var pl = (Plane) z;


    var bb1 = b1.GetBoundingBox(true);
    var bb2 = b2.GetBoundingBox(true);

    var e1 = new Polyline(bb1.GetCorners());
    var e2 = new Polyline(bb2.GetCorners());

    RegionContainment status = Curve.PlanarClosedCurveRelationship(e2.ToNurbsCurve(), e1.ToNurbsCurve(), pl, 0.001);
    Print(status.ToString());
    switch (status)
    {
      case RegionContainment.Disjoint:
        Print("Disjoint");
        break;

      case RegionContainment.MutualIntersection:
        Print("Mutual Intersection");
        break;

      case RegionContainment.AInsideB:
        Print("x inside y");
        break;

      case RegionContainment.BInsideA:
        Print("y inside x");
        break;
    }

    box1 = bb1;
    box2 = bb2;
    eb1 = e1;
    eb2 = e2;
# ---------- end c_script_4 ----------
panel_3 = Panel(area.Area)
c_script_5 = CSharpScript(x=crv_3, y=crv_4, z=xy)  # -> out, box1, box2, eb1, eb2; inputs x: Curve, y: Curve, z: Plane
# ---------- c_script_5: C# ----------
    var b1 = (Curve) x;
    var b2 = (Curve) y;
    var pl = (Plane) z;


    var bb1 = b1.GetBoundingBox(true);
    var bb2 = b2.GetBoundingBox(true);

    var e1 = new Polyline(bb1.GetCorners());
    var e2 = new Polyline(bb2.GetCorners());

    RegionContainment status = Curve.PlanarClosedCurveRelationship(e2.ToNurbsCurve(), e1.ToNurbsCurve(), pl, 0.01);
    Print(status.ToString());
    switch (status)
    {
      case RegionContainment.Disjoint:
        Print("Disjoint");
        break;

      case RegionContainment.MutualIntersection:
        Print("Mutual Intersection");
        break;

      case RegionContainment.AInsideB:
        Print("x inside y");
        break;

      case RegionContainment.BInsideA:
        Print("y inside x");
        break;
    }

    box1 = bb1;
    box2 = bb2;
    eb1 = e1;
    eb2 = e2;
# ---------- end c_script_5 ----------
box = Box(c_script_4.box2)
box_2 = Box(c_script_4.box1)
crv_8 = Curve(c_script_4.eb1)
crv_9 = Curve(c_script_4.eb2)
box_3 = Box(c_script_5.box2)
box_4 = Box(c_script_5.box1)
crv_10 = Curve(c_script_5.eb1)
crv_11 = Curve(c_script_5.eb2)
panel_4 = Panel(c_script_2.out)
brep_3 = Brep(c_script_2.B)
panel_5 = Panel(c_script_4.out)
panel_6 = Panel(edges.Naked)
panel_7 = Panel(c_script_5.out)
panel_8 = Panel(c_script_3.A)
panel_9 = Panel(c_script_3.B)
crv_12 = Curve(c_script_3.C)
box_5 = Box(c_script_3.A)
area_2 = Area(Geometry=c_script_2.A)  # -> Area, Centroid
