# Grasshopper definition room_simpleShade_optimization.gh (Grasshopper 0.9.76)
# plug-ins: Kangaroo Components, IvyGh, SunTools

number_slider = Slider(4, range=0..10)
number_slider_2 = Slider(2.2, range=0..10)
division = Division(A=number_slider_2, B=-2)
division_2 = Division(A=number_slider_2, B=2)
division_3 = Division(A=number_slider, B=-2)
division_4 = Division(A=number_slider, B=2)
pi = Pi(Factor=2)
rad = Radians(Degrees=Slider(105, range=90..270))
yz = YZPlane(Origin=Point(0, 0, 0))
subtraction = Subtraction(A=pi, B=rad)
dom = ConstructDomain(DomainStart=division, DomainEnd=division_2)
dom_2 = ConstructDomain(DomainStart=division_3, DomainEnd=division_4)
rotate = Rotate(Geometry=yz, Angle=subtraction, Plane=PlaneXY(0, 0, 0))  # -> Geometry, Transform
number_slider_3 = Slider(1, range=0..1)
rectangle = Rectangle(Plane=rotate.Geometry, XSize=dom_2, YSize=dom, Radius=0)  # -> Rectangle, Length
mplane = MeshPlane(Boundary=rectangle.Rectangle, WidthCount=number_slider_3, HeightCount=number_slider_3)  # -> Mesh, Area
facen = FaceNormals(Mesh=mplane.Mesh)  # -> Centers, Normals

# ---- group: ROOM
number_slider_4 = Slider(0.5, range=0..1)
normal_window = Vector(facen.Normals)
mesh = Mesh(mplane.Mesh)
medges = MeshEdges(Mesh=mesh)  # -> NakedEdges, InteriorEdges, NonManifoldEdges
unit = UnitVector(Vector=normal_window)
multiplication = Multiplication(A=number_slider_4, B=-1)
# Room geometry
item = ListItem(List=medges.NakedEdges, Index="1", Wrap=True)
multiplication_2 = Multiplication(A=unit, B=Slider(0, range=-1..0))
Z = UnitZ(Factor=multiplication)
multiplication_3 = Multiplication(A=unit, B=Slider(-5, range=-10..-1))
addition = Addition(A=multiplication_2, B=Z)
move = Move(Geometry=item, Motion=addition)  # -> Geometry, Transform
multiplication_4 = Multiplication(A=number_slider_4, B=2)
end = EndPoints(Curve=move.Geometry)  # -> Start, End
addition_2 = Addition(A=number_slider_2, B=multiplication_4)
move_2 = Move(Geometry=end.Start, Motion=multiplication_3)  # -> Geometry, Transform
move_3 = Move(Geometry=end.End, Motion=multiplication_3)  # -> Geometry, Transform
Z_2 = UnitZ(Factor=addition_2)
pt = Point(end.Start)
move_4 = Move(Geometry=pt, Motion=Z_2)  # -> Geometry, Transform
pt_2 = Point(move_2.Geometry)
move_5 = Move(Geometry=pt_2, Motion=Z_2)  # -> Geometry, Transform
pt_3 = Point(end.End)
move_6 = Move(Geometry=pt_3, Motion=Z_2)  # -> Geometry, Transform
pt_4 = Point(move_3.Geometry)
move_7 = Move(Geometry=pt_4, Motion=Z_2)  # -> Geometry, Transform
c_script = CSharpScript(A=pt, B=pt_2, C=pt_4, D=pt_3)  # -> out, mesh, edges, plane; inputs A: Point3d, B: Point3d, C: Point3d, D: Point3d
# ---------- c_script: C# ----------
    var p1 = (Point3d) A;
    var p2 = (Point3d) B;
    var p3 = (Point3d) C;
    var p4 = (Point3d) D;
    List < Point3d > vert = new List<Point3d>(){p1,p2,p3,p4};

    var f1 = new Rhino.Geometry.MeshFace(0, 1, 2, 3);
    var m1 = new Rhino.Geometry.Mesh();
    var pl1 = new Rhino.Geometry.Plane(p1, p2, p4);

    m1.Vertices.AddVertices(vert);
    m1.Faces.AddFace(f1);

    var e1 = new List<Polyline>(m1.GetNakedEdges());

    mesh = m1;
    plane = pl1;
    edges = e1;
# ---------- end c_script ----------
c_script_2 = CSharpScript(A=pt, B=pt_2, C=move_5.Geometry, D=move_4.Geometry)  # -> out, mesh, edges, plane; inputs A: Point3d, B: Point3d, C: Point3d, D: Point3d; same code as c_script
c_script_3 = CSharpScript(A=pt_2, B=pt_4, C=move_7.Geometry, D=move_5.Geometry)  # -> out, mesh, edges, plane; inputs A: Point3d, B: Point3d, C: Point3d, D: Point3d; same code as c_script
c_script_4 = CSharpScript(A=pt_3, B=pt_4, C=move_7.Geometry, D=move_6.Geometry)  # -> out, mesh, edges, plane; inputs A: Point3d, B: Point3d, C: Point3d, D: Point3d; same code as c_script
number_slider_5 = Slider(3, range=0..10)
refine = Refine(Mesh=c_script_4.mesh, Level=number_slider_5)
refine_2 = Refine(Mesh=c_script.mesh, Level=number_slider_5)
refine_3 = Refine(Mesh=c_script_2.mesh, Level=number_slider_5)
refine_4 = Refine(Mesh=c_script_3.mesh, Level=number_slider_5)
mjoin = MeshJoin(Meshes=[c_script.mesh, c_script_2.mesh, c_script_3.mesh, c_script_4.mesh])

# ----
rad_2 = Radians(Degrees=Slider(3, range=0..10))
number_slider_6 = Slider(1969, range=0..3578)
digit_scroller = DigitScroller(Scroller_Digits=12, Scroller_Radix=9, Scroller_Value=476)
digit_scroller_2 = DigitScroller(Scroller_Digits=12, Scroller_Radix=9, Scroller_Value=3469)
number_slider_7 = Slider(1533, range=0..3578)
# Window geometry
number_slider_8 = Slider(1024, range=0..3578)
c_script_5 = CSharpScript()  # -> out, A; inputs x: list of Double; disabled
# ---------- c_script_5: C# ----------
    var inList = (List<double>) x;
    string outString = null;

    for (int i = 0;i < inList.Count;i++)
    {
      if (i< inList.Count - 1)
      {
        outString += x[i].ToString() + ",";
      }
      else
      {
         outString += x[i].ToString();
      }
    }

    A = outString;
# ---------- end c_script_5 ----------
series = Series(Start=number_slider_8, Step=1, Count=Slider(1, range=1..3000))

# ----
# Sun Vectors
X = UnitX(Factor=1)
azi = Number([126.3264092, 137.3313031, 149.9081719, 164.0725822, 179.3051332, 194.5902344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])
ele = Number([5.239618324, 13.76930373, 20.56615289, 25.05155863, 26.71385892, 25.32899458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])
num = Number([8, 9, 10, 11, 12, 13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])
sunsifting = SiftSunOrientations(
    North=X,
    SunAzimuth=azi,
    SunAltitude=ele,
    AssociatedSunHours=num,
    FaçadePanelToEvaluate=mplane.Mesh,
    AngleToleranceInRad=rad_2)  # -> ResultingSiftedSunAzimuthAngles, ResultingSiftedSunAltitudeAngles, ResultingSiftedHours, ResultingSuftedSunVectors
item_2 = ListItem(List=sunsifting.ResultingSuftedSunVectors, Index=series, Wrap=True)  # -> simplify(Item)

item_3 = ListItem(List=sunsifting.ResultingSiftedHours, Index=series, Wrap=True)  # -> simplify(Item)
num_2 = Number(sunsifting.ResultingSiftedHours)
vec = Vector(sunsifting.ResultingSuftedSunVectors)
panel = Panel(num_2)
refine_5 = Refine(Mesh=mplane.Mesh, Level=Slider(4, range=0..10))
vdis = VectorDisplay(Anchor=facen.Centers, Vector=item_2)
mesh_2 = Mesh(refine_5)

# ----
# Seasonal coeficient
c_script_6 = CSharpScript(
    SD_sum=Slider(1, range=0..10),
    VW_sum=Slider(2, range=0..10),
    GL_sum=Slider(1, range=0..10),
    SD_win=Slider(1, range=0..10),
    VW_win=Slider(3, range=0..10),
    GL_win=Slider(1, range=0..10))  # -> out, winterCoef, summerCoef; inputs SD_sum: Double, VW_sum: Double, GL_sum: Double, SD_win: Double, VW_win: Double, GL_win: Double
# ---------- c_script_6: C# ----------
    var shade_sum = (double) SD_sum;
    var view_sum = (double) VW_sum;
    var glare_sum = (double) GL_sum;
    var shade_win = (double) SD_win;
    var view_win = (double) VW_win;
    var glare_win = (double) GL_win;

    double sum_summer = shade_sum + view_sum + glare_sum;
    double sum_winter = shade_win + view_win + glare_win;

    shade_sum = shade_sum / sum_summer;
    view_sum = view_sum / sum_summer;
    glare_sum = glare_sum / sum_summer;

    shade_win = shade_win / sum_winter;
    view_win = view_win / sum_winter;
    glare_win = glare_win / sum_winter;


    string sumC = shade_sum.ToString() + ",-" + view_sum.ToString() + "," + glare_sum.ToString();
    string winC = "-" + shade_win.ToString() + ",-" + view_win.ToString() + "," + glare_win.ToString();

    winterCoef = winC;
    summerCoef = sumC;
# ---------- end c_script_6 ----------
panel_2 = Panel(c_script_6.winterCoef)
panel_3 = Panel(c_script_6.summerCoef)
winter_period_start = Panel("8472")
winter_period_end = Panel("1872")
seasoncoef = SeasonalParsingAndWeighing(
    SunHours=num_2,
    StartOfWinterPeriod=winter_period_start,
    EndOfWinterPeriod=winter_period_end,
    WinterWeightString=panel_2,
    SummerWeightString=panel_3)

multiplication_5 = Multiplication(A=vec, B=-1)
c_script_7 = CSharpScript()  # -> out, A; inputs x: tree of Mesh
# ---------- c_script_7: C# ----------
    var tt = (DataTree<Mesh>) x;

    var com = new DataTree<String>();


    for (int i = 0;i < tt.BranchCount;i++)
    {
      var p1 = new GH_Path(i);

      for  (int j = 0;j < tt.Branch(i).Count;j++)
      {
        if (!tt.Branch(i)[j].IsValid) com.Add("mesh " + j.ToString() + " of branch " + i.ToString() + " is not valid");
      }
    }
    
    A = com;
# ---------- end c_script_7 ----------
panel_4 = Panel(c_script_7.A)
panel_5 = Panel("admin")  # disabled
panel_6 = Panel("Victor")  # disabled
panel_7 = Panel("C:\Users\")  # disabled
panel_8 = Panel("\Desktop\data_fitv2\")  # disabled
concat = Concatenate(FragmentA=panel_7, FragmentB=panel_5)  # disabled
concat_2 = Concatenate(FragmentA=concat, FragmentB=panel_8)  # disabled
panel_9 = Panel(concat_2)  # disabled
matlab_exe_sp4 = FilePath("C:\Program Files\MATLAB\R2016b\bin\matlab.exe")  # disabled
number_slider_9 = Slider(0, range=0..6)  # disabled

# ----
# Shade geometry
dom_3 = ConstructDomain(DomainStart=Slider(0, range=0..90), DomainEnd=Slider(70, range=0..90))
dom_4 = ConstructDomain(DomainStart=Slider(0, range=0..1), DomainEnd=Slider(1, range=0..1))
panel_10 = Panel("""agl
ext""")
random = Random(Range=dom_3, Number=Slider(10, range=0..10), Seed=2)
random_2 = Random(Range=dom_4, Number=Slider(4, range=0..10), Seed=2)
txt = Text(panel_10)
entwine = Entwine(Branch00=random, Branch01=random_2, FlattenInputs=True)
grid = ConstructGrid(InputRange=entwine, Labels=txt)  # -> GridInformations, Grid
medges_2 = MeshEdges(Mesh=mplane.Mesh)  # -> NakedEdges, InteriorEdges, NonManifoldEdges
panel_11 = Panel(grid.GridInformations)
item_4 = ListItem(List=medges_2.NakedEdges, Index=Slider(2, range=0..10), Wrap=True)
divide = DivideCurve(Curve=item_4, Count="2", Kinks=False)  # -> Points, Tangents, Parameters
item_5 = ListItem(List=divide.Points, Index="1", Wrap=True)
Z_3 = UnitZ(Factor=1)
vec_2 = Vector(facen.Normals)
scale = Scale(Geometry=item_4, Center=item_5, Factor="1.05")  # -> Geometry, Transform
expression = Expression(x=Z_3, y=vec_2, a="0.10", b="0.03", Expression="a*x+b*y")
move_8 = Move(Geometry=scale.Geometry, Motion=expression)  # -> Geometry, Transform

addition_3 = Addition(A=number_slider_2, B="0.10")

c_script_8 = CSharpScript(
    input_grid=grid.Grid,
    hwindow=addition_3,
    N=facen.Normals,
    Reference="C:\Users\victor\AppData\Roaming\Grasshopper\Libraries\IvyCore.dll")  # -> out, V; inputs hwindow: Double, N: Vector3d
# ---------- c_script_8: C# ----------
    var normal = (Vector3d) N;
    var hwin = (double) hwindow;
    var gact = (IvyCore.MultiDimGrid.Grid) input_grid;


    var nn = gact.NodeCount;
    var vec = new List<Vector3d>();
    //var actuationstate = new double[nn][];
    var origin = new Point3d(0.0, 0.0, 0.0);
    var rotaxis = Vector3d.CrossProduct(normal, new Vector3d(0.0, 0.0, -1.0));

    for (int i = 0;i < nn;i++)
    {
      var ag = -Math.PI * gact.Nodes[i][0] / 180;
      var ext = gact.Nodes[i][1];

      var current_vec = new Vector3d(0.0, 0.0, -1.0);

      current_vec.Transform(Transform.Rotation(ag, rotaxis, origin));
      current_vec = ext * (hwin) * current_vec;
      vec.Add(current_vec);

    }

    V = vec;
# ---------- end c_script_8 ----------
extr = Extrude(Base=move_8.Geometry, Direction=c_script_8.V)
mesh_3 = MeshBrep(
    Brep=extr,
    Settings={GridMaxCount=0, GridMinCount=16, JaggedSeams=False, MaxEdgeLength=0, MinEdgeLength=0.0001, MinTolerance=0, Refine=True, RefineAngle=0, RelativeTolerance=0.65, SimplePlanes=True, Tolerance=0})
refine_6 = Refine(Mesh=mesh_3, Level=Slider(3, range=0..10))
item_6 = ListItem(List=refine_6, Index="24", Wrap=True)
mesh_4 = Mesh(item_6)

# ----
# Create Matlab analysis files
number_slider_10 = Slider(0, range=0..20)  # disabled
number_slider_11 = Slider(1, range=0..20)  # disabled
path = FilePath(panel_9)  # disabled
grid_2 = Grid(grid.Grid)  # disabled
c_script_9 = CSharpScript(
    seasonCoefs=seasoncoef,
    normalizationMin=number_slider_10,
    normalizationMax=number_slider_11,
    act=grid_2,
    workdir=path,
    Reference="C:\USERS\VICTOR\APPDATA\ROAMING\GRASSHOPPER\LIBRARIES\IvyCore.dll")  # -> out; inputs Shade: tree of Double, View: tree of Double, Glare: tree of Double, seasonCoefs: list of String, normalizationMin: Double, normalizationMax: Double, workdir: String; disabled
# ---------- c_script_9: C# ----------
    var tree_output1 = (DataTree<double>) Shade;
    var tree_output2 = (DataTree<double>) View;
    var tree_output3 = (DataTree<double>) Glare;
    var list_output1 = (List<string>) seasonCoefs;
    var minNorm = (double) normalizationMin;
    var maxNorm = (double) normalizationMax;
    var workingDir = (string) workdir;
    var gact = (IvyCore.MultiDimGrid.Grid) act;




    int nb = tree_output1.BranchCount;

    var filePath1 = workingDir + "\\gh-" + "shade" + ".csv";
    var filePath2 = workingDir + "\\gh-" + "view" + ".csv";
    var filePath3 = workingDir + "\\gh-" + "glare" + ".csv";
    var filePath4 = workingDir + "\\gh-" + "actuation" + ".csv";
    var filePath5 = workingDir + "\\gh-" + "seasonalCoefficients" + ".csv";

    System.Text.StringBuilder csv1 = new System.Text.StringBuilder();
    System.Text.StringBuilder csv2 = new System.Text.StringBuilder();
    System.Text.StringBuilder csv3 = new System.Text.StringBuilder();
    System.Text.StringBuilder csv4 = new System.Text.StringBuilder();
    System.Text.StringBuilder csv5 = new System.Text.StringBuilder();


    //Normalization of trees
    NormalizeDatatree(tree_output1, minNorm, maxNorm);
    NormalizeDatatree(tree_output2, minNorm, maxNorm);
    NormalizeDatatree(tree_output3, minNorm, maxNorm);


    //write actuation file

    for (int j = 0;j < gact.NodeCount;j++)
    {
      var newline = string.Format("{0},{1}", gact.Nodes[j][0].ToString(), gact.Nodes[j][1].ToString());
      csv4.AppendLine(newline);
    }
    System.IO.File.WriteAllText(filePath4, csv4.ToString());

    //write actuation file

    for (int j = 0;j < list_output1.Count;j++)
    {
      var newline = string.Format("{0}", list_output1[j]);
      csv5.AppendLine(newline);
    }
    System.IO.File.WriteAllText(filePath5, csv5.ToString());


    //write shade, view & glare csv files
    for (int i = 0;i < nb;i++)
    {

      //populate shade files
      string newline1 = "";
      for (int j = 0;j < tree_output1.Branch(i).Count;j++)
      {
        if (j + 1 < tree_output1.Branch(i).Count)
        {
          newline1 += tree_output1.Branch(i)[j].ToString() + ",";
        }
        else
        {
          newline1 += tree_output1.Branch(i)[j].ToString();
        }
      }
      csv1.AppendLine(newline1);

      //populate view files
      string newline2 = "";
      for (int j = 0;j < tree_output1.Branch(i).Count;j++)
      {
        if (j + 1 < tree_output1.Branch(i).Count)
        {
          newline2 += tree_output2.Branch(i)[0].ToString() + ",";
        }
        else
        {
          newline2 += tree_output2.Branch(i)[0].ToString();
        }
      }
      csv2.AppendLine(newline2);

      //populate glare files
      string newline3 = "";
      for (int j = 0;j < tree_output3.Branch(i).Count;j++)
      {
        if (j + 1 < tree_output3.Branch(i).Count)
        {
          newline3 += tree_output3.Branch(i)[j].ToString() + ",";
        }
        else
        {
          newline3 += tree_output3.Branch(i)[j].ToString();
        }
      }
      csv3.AppendLine(newline3);

    }

    System.IO.File.WriteAllText(filePath1, csv1.ToString());
    System.IO.File.WriteAllText(filePath2, csv2.ToString());
    System.IO.File.WriteAllText(filePath3, csv3.ToString());


    //GH OUTPUT COMMENTS
    Print("OUTPUT DIR : " + workingDir);
    Print("PROCESS EXIT");
# ---------- c_script_9: C# additional code ----------
  private static DataTree<double> NormalizeDatatree(DataTree < double > tree, double min, double max)
  {
    double treemax = tree.AllData().Max();
    double treemin = tree.AllData().Min();
    double range = treemax - treemin;

    for (int i = 0;i < tree.BranchCount;i++)
    {
      var currentBrancha = new double[tree.Branch(i).Count];
      tree.Branch(i).CopyTo(currentBrancha);
      tree.Branch(i).Clear();
      tree.Branch(i).AddRange(NormalizeList(ArrayToList(currentBrancha), treemin, treemax, min, max));
    }

    return tree;
  }


  private static List<double> NormalizeList(List<double> data, double glmin, double glmax, double min, double max)
  {
    double dataMax = glmax;
    double dataMin = glmin;
    double range = dataMax - dataMin;

    return data
      .Select(d => (d - dataMin) / range)
      .Select(n => (double) ((1 - n) * min + n * max))
      .ToList();
  }

  private static List<double> ArrayToList(double[] data)
  {
    List<double> datalist = new List<double>(data.Length);
    for (int i = 0;i < data.Length;i++)
    {
      datalist.Add(data[i]);
    }
    return datalist;
  }
# ---------- end c_script_9 ----------
panel_12 = Panel(c_script_9)  # disabled

panel_13 = Panel("outMatlab.csv")  # disabled
workingdir = FilePath(path)  # disabled
timer = Timer(TimerInterval=10000, Target=concat_3)  # disabled
concat_3 = Concatenate(FragmentA=workingdir, FragmentB=panel_13)  # disabled
# Visualize data
panel_14 = Panel(concat_3)  # disabled
c_script_10 = CSharpScript(x=concat_3)  # -> out, A, B; inputs x: String; disabled
# ---------- c_script_10: C# ----------
    var filePath = (string) x;
    var reader = new StreamReader(filePath);

    List<string> listA = new List<string>();
    List<string> listB = new List<string>();

    while (!reader.EndOfStream)
    {
      var line = reader.ReadLine();
      var values = line.Split(',');

      listA.Add(values[0]);
      listB.Add(values[1]);
    }

    A = listA;
    B = listB;
# ---------- end c_script_10 ----------
num_3 = Number([4.8784e-06, 1.0894e-05, 4.5657e-05, 3.5625, 7.2872, 5.2224])  # disabled
num_4 = Number([1, 1, 1, 1, 1, 1])  # disabled
window_height = Number(number_slider_2)  # disabled
crv = Curve(item_4)  # disabled
window_normal = Vector(facen.Normals)  # disabled
extension_of_rolling_shade = Panel(c_script_10.B)  # disabled
angle_of_shade = Panel(c_script_10.A)  # disabled
top_rolling_shade = CSharpScript(
    act1=c_script_10.A,
    act2=c_script_10.B,
    hwindow=window_height,
    N=window_normal,
    tedge=crv,
    Reference="C:\USERS\VICTOR\APPDATA\ROAMING\GRASSHOPPER\LIBRARIES\IvyCore.dll")  # -> out, V, S; inputs act1: list of Double, act2: list of Double, hwindow: Double, N: Vector3d, tedge: Curve; disabled
# ---------- top_rolling_shade: C# ----------
    var normal = (Vector3d) N;
    var hwin = (double) hwindow;
    var Act1 = (List<double>) act1;
    var Act2 = (List<double>) act2;
    var top = (Curve) tedge;

    var surf = new List<GH_Surface>();

    var nn = Act1.Count;
    var vec = new List<Vector3d>();
    var origin = new Point3d(0.0, 0.0, 0.0);
    var rotaxis = Vector3d.CrossProduct(normal, new Vector3d(0.0, 0.0, -1.0));

    for (int i = 0;i < nn;i++)
    {
      var ag = -Math.PI * Act1[i] / 180;
      var ext = Act2[i];

      var current_vec = new Vector3d(0.0, 0.0, -1.0);

      current_vec.Transform(Transform.Rotation(ag, rotaxis, origin));
      current_vec = ext * (hwin) * current_vec;

      var current_surf = Rhino.Geometry.Extrusion.CreateExtrusion(top, current_vec);

      vec.Add(current_vec);
      surf.Add(new Grasshopper.Kernel.Types.GH_Surface(current_surf));

    }

    V = vec;
    S = surf;
# ---------- end top_rolling_shade ----------
srf = Surface(top_rolling_shade.S)  # disabled

panel_15 = Panel("optimization.m")  # disabled
matlab_exe_work = FilePath("C:\Program Files\MATLAB\R2016a\bin\matlab.exe")  # disabled
# Launch Matlab analysis
workingdir_2 = FilePath(path)  # disabled
concat_4 = Concatenate(FragmentA=workingdir_2, FragmentB=panel_15)  # disabled
lanch = Button()  # disabled
panel_16 = Panel(workingdir_2)  # disabled
c_script_11 = CSharpScript(path_to_m=concat_4, path_to_exe=matlab_exe_sp4, launch=lanch)  # -> out, A; inputs path_to_exe: String, launch: Boolean; disabled
# ---------- c_script_11: C# ----------
    string pathtoexe = (string) path_to_exe;
    string pathtofile = (string) path_to_m;

    string dir = System.IO.Path.GetDirectoryName(path_to_m.ToString());
    string filename = System.IO.Path.GetFileName(path_to_m.ToString());


    if (launch)
    {
      System.Diagnostics.Process p = new System.Diagnostics.Process();

      p.StartInfo.FileName = pathtoexe;
      p.StartInfo.WorkingDirectory = dir + "\\";
      p.StartInfo.Arguments = "/wait /nodisplay /nojvm /nosplash /nodesktop /r \"try, run('" + pathtofile + "\"'),catch,exit,end,exit\"";
      p.StartInfo.Verb = "runas";

      p.Start();
      p.WaitForExit();


    }
    //GH OUTPUT COMMENTS
    Print("MATLAB EXE : " + path_to_exe);
    Print("SCRIPT DIR : " + dir);
    Print("SCRIPT FILE : " + filename);
    Print("PROCESS EXIT");
# ---------- end c_script_11 ----------
panel_17 = Panel(c_script_11.out)  # disabled

medges_3 = MeshEdges(Mesh=mjoin)  # -> NakedEdges, InteriorEdges, NonManifoldEdges
item_7 = ListItem(List=mesh_4, Index=0, Wrap=True)  # disabled
swatch = ColourSwatch(SwatchColor=RGB(168, 224, 223))  # disabled
swatch_2 = ColourSwatch(SwatchColor=RGBA(221, 240, 53, 87))  # disabled
swatch_3 = ColourSwatch(SwatchColor=RGBA(0, 0, 0, 148))  # disabled
preview = CustomPreview(Geometry=item_7, Shader=swatch_2)  # disabled
preview_2 = CustomPreview(Geometry=mjoin, Shader=swatch_3)  # disabled
preview_3 = CustomPreview(
    Geometry=[medges.NakedEdges, medges_3.NakedEdges, medges_3.InteriorEdges],
    Shader=ColourSwatch(SwatchColor=RGBA(0, 0, 0, 41)))
preview_4 = CustomPreview(
    Geometry=mesh_4,
    Shader={ambient=RGB(0, 0, 0), diffuse=RGB(255, 105, 180), emission=RGB(76, 32, 54), shine=0.5, specular=RGB(255, 255, 255), transparency=0})  # disabled
preview_5 = CustomPreview(Geometry=mplane.Mesh, Shader=swatch)  # disabled

panel_18 = Panel(srf)  # disabled
item_8 = ListItem(List=srf, Index=0, Wrap=True)  # disabled

# ----
# Shade
# View
# Glare
wall_left = Mesh(refine)
floor = Mesh(refine_2)
back_wall = Mesh(refine_4)
vec_3 = Vector(multiplication_5)
wall_right = Mesh(refine_3)
mesh_5 = Mesh(mesh_2)
mesh_6 = Mesh(mesh_4)
vec_4 = Vector(multiplication_5)
vec_5 = Vector(facen.Normals)
shadeassess = ShadeAssessment(WindowPanelMesh=mesh_5, ShadeModuleMesh=mesh_6, ProjectionVector=vec_4, LaunchTheAnalysis=Toggle(False))  # -> MeshOfExposedWindowsSurface, AreaOfExposed, CommentOnOperationType, DebugMeshcutter, DebugHull
source = Mesh(shadeassess.MeshOfExposedWindowsSurface)
shadeassess_2 = ShadeAssessment(WindowPanelMesh=mesh_5, ShadeModuleMesh=mesh_6, ProjectionVector=vec_5, LaunchTheAnalysis=Toggle(True))  # -> MeshOfExposedWindowsSurface, AreaOfExposed, CommentOnOperationType, DebugMeshcutter, DebugHull
mesh_7 = Mesh(shadeassess.MeshOfExposedWindowsSurface)
num_5 = Number(shadeassess.AreaOfExposed)
mesh_8 = Mesh(shadeassess_2.MeshOfExposedWindowsSurface)
num_6 = Number(shadeassess_2.AreaOfExposed)

c_script_12 = CSharpScript(x=num_5)  # -> out, A; inputs x: tree of Double
# ---------- c_script_12: C# ----------
    var t = (DataTree<double>) x;
    bool output = false;

    if (t.BranchCount >= 1) {output = true;}

    A = output;
# ---------- end c_script_12 ----------

# ---- group: wall 1
glareassess = GlareOnWallPanel(WallPanel=wall_right, SourceOutline=source, ProjectionDirectionVector=vec_3, LaunchTheAnalysis=c_script_12.A)  # -> MeshOfGlareOnTheWallPanel, AreaOfGlareOnTheWallPanel, CommentOnOperationType, DebugMeshcutter

# ----
c_script_13 = CSharpScript(x=glareassess.AreaOfGlareOnTheWallPanel)  # -> out, A; inputs x: tree of Double; same code as c_script_12

# ---- group: Wall 2
glareassess_2 = GlareOnWallPanel(WallPanel=wall_left, SourceOutline=source, ProjectionDirectionVector=vec_3, LaunchTheAnalysis=c_script_13.A)  # -> MeshOfGlareOnTheWallPanel, AreaOfGlareOnTheWallPanel, CommentOnOperationType, DebugMeshcutter

# ----
c_script_14 = CSharpScript(x=glareassess_2.AreaOfGlareOnTheWallPanel)  # -> out, A; inputs x: tree of Double; same code as c_script_12

# ---- group: Floor
glareassess_3 = GlareOnWallPanel(WallPanel=floor, SourceOutline=source, ProjectionDirectionVector=vec_3, LaunchTheAnalysis=c_script_14.A)  # -> MeshOfGlareOnTheWallPanel, AreaOfGlareOnTheWallPanel, CommentOnOperationType, DebugMeshcutter

# ----
c_script_15 = CSharpScript(x=glareassess_3.AreaOfGlareOnTheWallPanel)  # -> out, A; inputs x: tree of Double; same code as c_script_12

# ---- group: back wall
glareassess_4 = GlareOnWallPanel(WallPanel=back_wall, SourceOutline=source, ProjectionDirectionVector=vec_3, LaunchTheAnalysis=c_script_15.A)  # -> MeshOfGlareOnTheWallPanel, AreaOfGlareOnTheWallPanel, CommentOnOperationType, DebugMeshcutter

# ----
addition_4 = Addition(
    A=glareassess.AreaOfGlareOnTheWallPanel,
    B=glareassess_2.AreaOfGlareOnTheWallPanel,
    C=glareassess_3.AreaOfGlareOnTheWallPanel,
    D=glareassess_4.AreaOfGlareOnTheWallPanel)
num_7 = Number(addition_4)

number_slider_12 = Slider(1, range=0..10)  # disabled
number_slider_13 = Slider(2245, range=0..2442)  # disabled
item_9 = ListItem(List=mesh_7, Index=number_slider_13, Wrap=True)  # disabled
# Debug
item_10 = ListItem(List=vec, Index=number_slider_13, Wrap=True)  # disabled
viewer = ParamViewer(glareassess.MeshOfGlareOnTheWallPanel)  # disabled
item_11 = ListItem(List=viewer, Index=number_slider_12, Wrap=True)  # disabled
branch = TreeBranch(Tree=glareassess.MeshOfGlareOnTheWallPanel, Path=item_11, MaintainPaths=True)  # disabled
branch_2 = TreeBranch(Tree=glareassess_2.MeshOfGlareOnTheWallPanel, Path=item_11, MaintainPaths=True)  # disabled
branch_3 = TreeBranch(Tree=glareassess_3.MeshOfGlareOnTheWallPanel, Path=item_11, MaintainPaths=True)  # disabled
branch_4 = TreeBranch(Tree=glareassess_4.MeshOfGlareOnTheWallPanel, Path=item_11, MaintainPaths=True)  # disabled
item_12 = ListItem(List=branch, Index=number_slider_13, Wrap=True)  # disabled
projecta = ProjectAlong(Geometry=item_9, Plane=rotate.Geometry, Direction=item_10)  # -> Geometry, Transform; disabled
item_13 = ListItem(List=branch_2, Index=number_slider_13, Wrap=True)  # disabled
item_14 = ListItem(List=branch_3, Index=number_slider_13, Wrap=True)  # disabled
medges_4 = MeshEdges(Mesh=item_9)  # -> NakedEdges, InteriorEdges, NonManifoldEdges; disabled
item_15 = ListItem(List=branch_4, Index=number_slider_13, Wrap=True)  # disabled
vdis_2 = VectorDisplay(Anchor=facen.Centers, Vector=item_10)  # disabled
item_16 = ListItem(List=glareassess.DebugMeshcutter, Index=number_slider_13, Wrap=True)  # disabled
